# Dynamo graph AUTOCHANGE.WINDOW.LEVEL.dyn (Dynamo 2.3.0.5885)
# packages: Modelical 2.2.19, Rhythm 2020.7.25

# group: FOR WINDOWS
select_model_element = DSModelElementSelection()  # 1 picked in the model
select_model_elements = DSModelElementsSelection()  # nothing selected

code_block = CodeBlock { "Level"; "Sill Height"; }

# group: new level
levels = Levels("ZP-01_SURVEY")

ʳʰʸᵗʰᵐ_elements = Rhythm.Revit.Elements.Elements.SetParameterByNameTypeOrInstance(element=select_model_element, parameterName=code_block.out0, value=levels)
selectInRevit = Custom[SelectInRevit](ElemsOrIDs=ʳʰʸᵗʰᵐ_elements)  # package Modelical; Select elements in Revit by Element or ID
parameters = Element.Parameters(element=select_model_element)
ʳʰʸᵗʰᵐ_elements_2 = Rhythm.Revit.Elements.Elements.GetParameterValueByNameCaSeiNSeNSiTiVe(element=select_model_element, parameterName=code_block.out1)
ʳʰʸᵗʰᵐ_elements_3 = Rhythm.Revit.Elements.Elements.GetParameterValueByNameCaSeiNSeNSiTiVe(element=select_model_element, parameterName=code_block.out0)
elevation = Level.Elevation(level=ʳʰʸᵗʰᵐ_elements_3)
elevation_2 = Level.Elevation(level=levels)
sub = elevation - elevation_2
add = ʳʰʸᵗʰᵐ_elements_2 + sub
round = Math.Round(number=add)
ʳʰʸᵗʰᵐ_elements_4 = Rhythm.Revit.Elements.Elements.SetParameterByNameTypeOrInstance(element=select_model_element, parameterName=code_block.out1, value=round)
