# Dynamo graph AccessDoorScript.dyn (Dynamo 2.3.0.5885)

select_model_element = DSModelElementSelection()  # 1 picked in the model
string = StringInput("Width")

# group: Width
integer_slider = IntegerSlider(240, range=120..1000 step 5)

setParameterByName = Element.SetParameterByName(element=select_model_element, parameterName=string, value=integer_slider)
string_2 = StringInput("Width Side")

# group: Width Side
integer_slider_2 = IntegerSlider(130, range=50..500 step 5)

setParameterByName_2 = Element.SetParameterByName(element=select_model_element, parameterName=string_2, value=integer_slider_2)
string_3 = StringInput("Height")

# group: Height
integer_slider_3 = IntegerSlider(1390, range=400..1400 step 5)

setParameterByName_3 = Element.SetParameterByName(element=select_model_element, parameterName=string_3, value=integer_slider_3)
string_4 = StringInput("Angle")

# group: Angle
number = DoubleInput(0)

setParameterByName_4 = Element.SetParameterByName(element=select_model_element, parameterName=string_4, value=number)
