# Dynamo graph AdaptiveComponentsOnDetailLineEndpoints.dyn (Dynamo 2.3.0.5885)

select_model_elements = DSModelElementsSelection()  # 246 picked in the model
geometry = Element.Geometry(element=select_model_elements)
flatten = List.Flatten(list=geometry)
sort = List.Sort(list=flatten)

# group: Old version
python_script = Python(IN[0]=sort)  # frozen
# ---------- python_script.python (54 lines) ----------
# Load the Python Standard and DesignScript Libraries
import sys
import clr
clr.AddReference('ProtoGeometry')
from Autodesk.DesignScript.Geometry import *

# The inputs to this node will be stored as a list in the IN variables.
lineList = UnwrapElement(IN[0])

fullPointList=[]
for x in lineList:
	pointList=[]
	pointList.append(x.StartPoint)
	pointList.append(x.EndPoint)
	
	fullPointList.append(pointList)

finishedList=[]


while len(fullPointList) > 0:

	for x in fullPointList:
		new4PointList=[]
		new4PointList.append(x)
		fullPointList.remove(x)
		
				
		for y in fullPointList:
		
			if new4PointList[0][0].ToString() == y[0].ToString() or new4PointList[0][0].ToString() == y[1].ToString() or new4PointList[0][1].ToString() == y[0].ToString() or new4PointList[0][1].ToString() == y[1].ToString():
				new4PointList.append(y)
				fullPointList.remove(y)
				
				
				for z in fullPointList:
				
					if new4PointList[-1][0].ToString() == z[0].ToString() or new4PointList[-1][0].ToString() == z[1].ToString() or new4PointList[-1][1].ToString() == z[0].ToString() or new4PointList[-1][1].ToString() == z[1].ToString():
						new4PointList.append(z)
						fullPointList.remove(z)
						
						
						for a in fullPointList:
						
							if new4PointList[-1][0].ToString() == a[0].ToString() or new4PointList[-1][0].ToString() == a[1].ToString() or new4PointList[-1][1].ToString() == a[0].ToString() or new4PointList[-1][1].ToString() == a[1].ToString():
								new4PointList.append(a)
								finishedList.append(new4PointList)
								fullPointList.remove(a)
								
								
								
								

OUT = finishedList
# ----------------------------------------

# group: New
python_script_2 = Python(IN[0]=sort)
# ---------- python_script_2.python (126 lines) ----------
# Load the Python Standard and DesignScript Libraries
import sys
import clr
clr.AddReference('ProtoGeometry')
from Autodesk.DesignScript.Geometry import *

# The inputs to this node will be stored as a list in the IN variables.
lineList = UnwrapElement(IN[0])

fullPointList=[]
for x in lineList:
	pointList=[]
	pointList.append(x.StartPoint)
	pointList.append(x.EndPoint)
	
	fullPointList.append(pointList)

finishedList=[]


while len(fullPointList) > 0:

	for x in fullPointList:
		new4PointList=[]
		new4PointList.append(x[0])
		fullPointList.remove(x)
		
				
		for y in fullPointList:
		
			if new4PointList[0].ToString() == y[0].ToString():
				new4PointList.append(y[1])
				fullPointList.remove(y)

				for z in fullPointList:
				
					if new4PointList[-1].ToString() == z[0].ToString():
						new4PointList.append(z[1])
						fullPointList.remove(z)
						
						
						for a in fullPointList:
						
							if new4PointList[-1].ToString() == a[0].ToString():
							
								new4PointList.append(a[1])
								finishedList.append(new4PointList)
								fullPointList.remove(a)
								
							elif new4PointList[-1].ToString() == a[1].ToString():
							
								new4PointList.append(a[0])
								finishedList.append(new4PointList)
								fullPointList.remove(a)
							
								
					elif new4PointList[-1].ToString() == z[1].ToString():
					
						new4PointList.append(z[0])
						fullPointList.remove(z)
						
						
						for a in fullPointList:
						
							if new4PointList[-1].ToString() == a[0].ToString():
							
								new4PointList.append(a[1])
								finishedList.append(new4PointList)
								fullPointList.remove(a)
								
							elif new4PointList[-1].ToString() == a[1].ToString():
							
								new4PointList.append(a[0])
								finishedList.append(new4PointList)
								fullPointList.remove(a)
								####
								
			elif new4PointList[0].ToString() == y[1].ToString():
				new4PointList.append(y[0])
				fullPointList.remove(y)

				for z in fullPointList:
				
					if new4PointList[-1].ToString() == z[0].ToString():
						new4PointList.append(z[1])
						fullPointList.remove(z)
						
						
						for a in fullPointList:
						
							if new4PointList[-1].ToString() == a[0].ToString():
							
								new4PointList.append(a[1])
								finishedList.append(new4PointList)
								fullPointList.remove(a)
							elif new4PointList[-1].ToString() == a[1].ToString():
							
								new4PointList.append(a[0])
								finishedList.append(new4PointList)
								fullPointList.remove(a)
							
								
					elif new4PointList[-1].ToString() == z[1].ToString():
					
						new4PointList.append(z[0])
						fullPointList.remove(z)
						
						
						for a in fullPointList:
						
							if new4PointList[-1].ToString() == a[0].ToString():
							
								new4PointList.append(a[1])
								finishedList.append(new4PointList)
								fullPointList.remove(a)
								
							elif new4PointList[-1].ToString() == a[1].ToString():
							
								new4PointList.append(a[0])
								finishedList.append(new4PointList)
								fullPointList.remove(a)

								
								

OUT = finishedList
# ----------------------------------------

family_types = FamilyTypes("Family1:Family1")
byPoints = AdaptiveComponent.ByPoints(points=python_script_2, familyType=family_types)
