# Dynamo graph Annotation Creator.dyn (Dynamo 2.12.0.5650)
# packages: Clockwork for Dynamo 2.x 2.4.0, Genius Loci 2022.8.5

# group: Select Reference spot level
select_model_element = DSModelElementSelection()  # 1 picked in the model

# group: Select detail lines (Intersection of detail lines on grid)
dimension_properties = Custom[Dimension Properties](dimension=select_model_element)  # package Genius Loci; Returns the origin of the dimension, the dimension's curve, the value, the text position, the prefix, the suffix, the value override and all elements that are referenced by the given dimension
watch = Watch(dimension_properties.Origin)
X = Point.X(point=watch)
Y = Point.Y(point=watch)
code_block = CodeBlock { 0; }
byCoordinates = Point.ByCoordinates(x=X, y=Y, z=code_block)
select_model_elements = DSModelElementsSelection()  # 17 picked in the model
geometry = Element.Geometry(element=select_model_elements)
flatten = List.Flatten(list=geometry)
python_script = Python(IN[0]=flatten)  # IronPython2
# ---------- python_script.python (70 lines) ----------
import clr

clr.AddReference('RevitAPI')
from Autodesk.Revit.DB import *
from Autodesk.Revit.DB.Structure import *

clr.AddReference('RevitNodes')
import Revit
clr.ImportExtensions(Revit.GeometryConversion)
clr.ImportExtensions(Revit.Elements)

clr.AddReference('RevitServices')
import RevitServices
from RevitServices.Persistence import DocumentManager
from RevitServices.Transactions import TransactionManager

doc = DocumentManager.Instance.CurrentDBDocument
uidoc=DocumentManager.Instance.CurrentUIApplication.ActiveUIDocument

#Unwrapping Dynamoelement to Revit element.
lineList = UnwrapElement(IN[0])

geoList = []
interList = []
flatList =[]
uniqListStr = []
stringList =[]
uniqListOUT =[]
iter=[]
#Do some action in a Transaction

#x = lineList[0].DoesIntersect(lineList[1])


c=0
for l1 in lineList:

			
	for l2 in lineList[c:]:
		if l1 == l2:
			pass
		else:
			if l1.DoesIntersect(l2):
				interList.append(l1.Intersect(l2))	
			else:
				pass
				
	iter.append(c)
	c=c+1

			
for x in interList:
	stringList.append(x[0].ToString())
	flatList.append(x[0])

for x in stringList:
	if x not in uniqListStr:
		uniqListStr.append(x)
		uniqListOUT.append(flatList[(stringList.index(x))])
	

	


#TransactionManager.Instance.EnsureInTransaction(doc)


#TransactionManager.Instance.TransactionTaskDone()

OUT =  flatList
# ----------------------------------------
byTwoPoints = Vector.ByTwoPoints(start=byCoordinates, end=python_script, lacing=CrossProduct)
boolean = BoolSelector(false)
copyByVector = Custom[Element.CopyByVector](element=select_model_element, vector=byTwoPoints, rehostToClosestLevel=boolean)  # package Clockwork for Dynamo 2.x; Copies an element or a list of elements by a given vector.

# group: Select Reference spot level
select_model_element_2 = DSModelElementSelection()  # nothing selected

dimension_properties_2 = Custom[Dimension Properties](dimension=select_model_element_2)
watch_2 = Watch(dimension_properties_2.Origin)
X_2 = Point.X(point=watch_2)
Y_2 = Point.Y(point=watch_2)
code_block_2 = CodeBlock { 0; }
byCoordinates_2 = Point.ByCoordinates(x=X_2, y=Y_2, z=code_block_2)

# group: Set points on Polyline by increments
select_model_elements_2 = DSModelElementsSelection()  # 51 picked in the model
curves = Element.Curves(element=select_model_elements_2)
flatten_2 = List.Flatten(list=curves)
python_script_2 = Python(IN[0]=flatten_2)  # IronPython2
# ---------- python_script_2.python (44 lines) ----------
import clr

clr.AddReference('RevitAPI')
from Autodesk.Revit.DB import *
from Autodesk.Revit.DB.Structure import *

clr.AddReference('RevitNodes')
import Revit
clr.ImportExtensions(Revit.GeometryConversion)
clr.ImportExtensions(Revit.Elements)

clr.AddReference('RevitServices')
import RevitServices
from RevitServices.Persistence import DocumentManager
from RevitServices.Transactions import TransactionManager

doc = DocumentManager.Instance.CurrentDBDocument
uidoc=DocumentManager.Instance.CurrentUIApplication.ActiveUIDocument


dataEnteringNode =(IN[0])
plist=[]

c = 0

for x in dataEnteringNode:
	if x == dataEnteringNode[0]:
		
		line = x.Join(dataEnteringNode[c+1])

		c = c+1
	elif x == dataEnteringNode[-1]:
		pass
	else:
		line = line.Join(dataEnteringNode[c+1])
		c = c+1
	

	

# Place your code below this line

# Assign your output to the OUT variable.
OUT = line
# ----------------------------------------
code_block_3 = CodeBlock { 200; }
boolean_2 = BoolSelector(false)
offset = PolyCurve.Offset(polyCurve=python_script_2, signedDistance=code_block_3, extendCircular=boolean_2)
length = Curve.Length(curve=offset)
code_block_4 = CodeBlock { 7000; }
python_script_3 = Python(IN[0]=length, IN[1]=code_block_4)  # IronPython2
# ---------- python_script_3.python (24 lines) ----------
# Enable Python support and load DesignScript library
import clr
clr.AddReference('ProtoGeometry')
from Autodesk.DesignScript.Geometry import *

# The inputs to this node will be stored as a list in the IN variables.
dataEnteringNode = IN[0]
distance = IN[1]
newList = []
rem = dataEnteringNode % distance
splits = (dataEnteringNode-rem) / distance

for x in range(int(splits)):
	
	newList.append(x*distance)


newList.append(dataEnteringNode)
	

# Place your code below this line

# Assign your output to the OUT variable.
OUT = newList
# ----------------------------------------
pointAtSegmentLength = Curve.PointAtSegmentLength(curve=offset, segmentLength=python_script_3)
code_block_5 = CodeBlock { -200; }
boolean_3 = BoolSelector(false)
offset_2 = PolyCurve.Offset(polyCurve=python_script_2, signedDistance=code_block_5, extendCircular=boolean_3)
length_2 = Curve.Length(curve=offset_2)
python_script_4 = Python(IN[0]=length_2, IN[1]=code_block_4)  # IronPython2; same code as python_script_3
pointAtSegmentLength_2 = Curve.PointAtSegmentLength(curve=offset_2, segmentLength=python_script_4)
list_create = List.Create(item0=pointAtSegmentLength, item1=pointAtSegmentLength_2)
flatten_3 = List.Flatten(list=list_create)

byTwoPoints_2 = Vector.ByTwoPoints(start=byCoordinates_2, end=flatten_3, lacing=CrossProduct)
boolean_4 = BoolSelector(false)
copyByVector_2 = Custom[Element.CopyByVector](element=select_model_element_2, vector=byTwoPoints_2, rehostToClosestLevel=boolean_4)
