# Dynamo graph AnnotationCreator2.dyn (Dynamo 2.3.1.11775)
# packages: Clockwork for Dynamo 2.x 2.1.2

# group: Select detail lines
select_model_elements = DSModelElementsSelection()  # 4 picked in the model

geometry = Element.Geometry(element=select_model_elements)
flatten = List.Flatten(list=geometry)
python_script = Python(IN[0]=flatten)
# ---------- python_script.python (70 lines) ----------
import clr

clr.AddReference('RevitAPI')
from Autodesk.Revit.DB import *
from Autodesk.Revit.DB.Structure import *

clr.AddReference('RevitNodes')
import Revit
clr.ImportExtensions(Revit.GeometryConversion)
clr.ImportExtensions(Revit.Elements)

clr.AddReference('RevitServices')
import RevitServices
from RevitServices.Persistence import DocumentManager
from RevitServices.Transactions import TransactionManager

doc = DocumentManager.Instance.CurrentDBDocument
uidoc=DocumentManager.Instance.CurrentUIApplication.ActiveUIDocument

#Unwrapping Dynamoelement to Revit element.
lineList = UnwrapElement(IN[0])

geoList = []
interList = []
flatList =[]
uniqListStr = []
stringList =[]
uniqListOUT =[]
iter=[]
#Do some action in a Transaction

#x = lineList[0].DoesIntersect(lineList[1])


c=0
for l1 in lineList:

			
	for l2 in lineList[c:]:
		if l1 == l2:
			pass
		else:
			if l1.DoesIntersect(l2):
				interList.append(l1.Intersect(l2))	
			else:
				pass
				
	iter.append(c)
	c=c+1

			
for x in interList:
	stringList.append(x[0].ToString())
	flatList.append(x[0])

for x in stringList:
	if x not in uniqListStr:
		uniqListStr.append(x)
		uniqListOUT.append(flatList[(stringList.index(x))])
	

	


#TransactionManager.Instance.EnsureInTransaction(doc)


#TransactionManager.Instance.TransactionTaskDone()

OUT =  flatList
# ----------------------------------------
X = Point.X(point=python_script)
Y = Point.Y(point=python_script)
Z = Point.Z(point=python_script)
number = DoubleInput(-30360)
add = Z + number
byCoordinates = Point.ByCoordinates(x=X, y=Y, z=add)

# group: Select the view where you want to create anotations and reference level
views = Views("POINT2-01-00-M3-G Michael")
levels = Levels("POINT2-01-03-M3-G")

byStartPointEndPoint = Line.ByStartPointEndPoint(startPoint=python_script, endPoint=byCoordinates)
direction = Line.Direction(line=byStartPointEndPoint)

# group: CLOCKWORK ORANGE LIBRARY
byFloorPlanAndPoint = Custom[SpotElevation.ByFloorPlanAndPoint](point=byCoordinates, view=views, bend=direction, end=direction)  # package Clockwork for Dynamo 2.x; Places a spot elevation at a given point in a given view. May not work in all view types.

boolean = BoolSelector(false)
deconstruct = WombatDynamo.Point.Deconstruct(point=python_script)  # frozen
code_block = CodeBlock { 5700; }
byCoordinates_2 = Point.ByCoordinates(x=deconstruct.X, y=deconstruct.Y, z=code_block)
asVector = Point.AsVector(point=byCoordinates_2)
deconstruct_2 = WombatDynamo.Point.Deconstruct(point=python_script)  # frozen
code_block_2 = CodeBlock { 0; }
byCoordinates_3 = Point.ByCoordinates(x=deconstruct_2.X, y=deconstruct_2.Y, z=code_block_2)
asVector_2 = Point.AsVector(point=byCoordinates_3)
elevation = Level.Elevation(level=levels)
XAxis = Vector.XAxis()
X_2 = Vector.X(vector=XAxis)
levels_2 = Levels("POINT2-01-01-M3-G")
elevation_2 = Level.Elevation(level=levels_2)
family_types = FamilyTypes("POINT2_Spot_Elevation_EXT_Filled:Standard")
byTwoPoints = Vector.ByTwoPoints()  # unwired: start, end
