# Dynamo graph BeamTypeChangeAndRename.dyn (Dynamo 2.3.0.5885)
# packages: Clockwork for Dynamo 2.x 2.1.2

select_model_element = DSModelElementSelection()  # 1 picked in the model
python_script = Python(IN[0]=select_model_element)
# ---------- python_script.python (13 lines) ----------
# Load the Python Standard and DesignScript Libraries
import sys
import clr
clr.AddReference('ProtoGeometry')
from Autodesk.DesignScript.Geometry import *

# The inputs to this node will be stored as a list in the IN variables.
dataEnteringNode = IN[0]

# Place your code below this line
type = (dataEnteringNode.ElementType)
# Assign your output to the OUT variable.
OUT = type
# ----------------------------------------
parameters = Element.Parameters(element=python_script)
code_block = CodeBlock { 2; }
getItemAtIndex = List.GetItemAtIndex(list=parameters, index=code_block)

# group: Width
integer_slider = IntegerSlider(400, range=50..3000 step 5)

setValue = Parameter.SetValue(parameter=getItemAtIndex, value=integer_slider)
code_block_2 = CodeBlock { 52; }
getItemAtIndex_2 = List.GetItemAtIndex(list=parameters, index=code_block_2)

# group: Height
integer_slider_2 = IntegerSlider(700, range=100..1400 step 5)

setValue_2 = Parameter.SetValue(parameter=getItemAtIndex_2, value=integer_slider_2)
python_script_2 = Python(IN[0]=integer_slider_2, IN[1]=integer_slider)
# ---------- python_script_2.python (13 lines) ----------
# Enable Python support and load DesignScript library
import clr
clr.AddReference('ProtoGeometry')
from Autodesk.DesignScript.Geometry import *

# The inputs to this node will be stored as a list in the IN variables.
Thickness = IN[0]
Offset= IN[1]

# Place your code below this line
namestr = (str(Offset) +  "B" + "x" + str(Thickness)+  "H")
# Assign your output to the OUT variable.
OUT = namestr
# ----------------------------------------
setName = Custom[Element.SetName](element=python_script, name=python_script_2)  # package Clockwork for Dynamo 2.x; Gets the name of a given Revit element
watch = Watch(setName.element)
watch_2 = Watch(setName.success)
name = Element.Name(element=python_script)
