# Dynamo graph CAD.dyn (Dynamo 2.0.2.6826)

collect_all_elements_in_model = Custom[Collect All Elements in Model]()
watch = Watch(collect_all_elements_in_model.elements)
string_from_object = FromObject(obj=watch)
uniqueItems = List.UniqueItems(list=string_from_object)
code_block = CodeBlock { 0; }
getItemAtIndex = List.GetItemAtIndex(list=uniqueItems, index=code_block)
indexOf = List.IndexOf(list=getItemAtIndex, element=string_from_object)
string_from_object_2 = FromObject(obj=indexOf)
string = StringInput("-1")
string_2 = StringInput("Null")
replace = String.Replace(str=string_from_object_2, searchFor=string, replaceWith=string_2)
filterByBoolMask = List.FilterByBoolMask(list=watch, mask=replace)
watch_2 = Watch(filterByBoolMask.in)
boolean = BoolSelector(false)
replaceNulls = Lists.Manage.ReplaceNulls(Data=replace, ReplaceWith=boolean)
categories = Categories()  # nothing selected
