# Dynamo graph ColorBylevel.dyn (Dynamo 2.0.2.6826)

code_block = CodeBlock { 1; }
boolean = BoolSelector(true)
level_element_collector = Custom[Level Element Collector](RunMe=boolean)  # This collects data for all of the Level elements in the model. Similar to the node on Lunchbox, but this one uses all O.O.B. nodes.
all_elements_at_level = ElementsAtLevel(Level=level_element_collector.Element)
views = Views(index=0)
isVisible = archilab.Revit.Elements.Elements.IsVisible(element=all_elements_at_level, view=views)
filterByBoolMask = List.FilterByBoolMask(list=all_elements_at_level, mask=isVisible)
watch = Watch(filterByBoolMask.in)
watch_2 = Watch(level_element_collector.Name)
indexOf = List.IndexOf(list=watch_2, element=watch_2)
replaceItemAtIndex = List.ReplaceItemAtIndex(list=watch, item=indexOf)  # unwired: index
code_block_2 = CodeBlock { 0; }
code_block_3 = CodeBlock { 1; }
remapRange = Math.RemapRange(numbers=indexOf, newMin=code_block_2, newMax=code_block_3)
uniqueItems = List.UniqueItems(list=remapRange)
sortIndexByValue = List.SortIndexByValue(list=uniqueItems)
integer_slider = IntegerSlider(255, range=0..255 step 1)
byARGB = Color.ByARGB(r=integer_slider)
byARGB_2 = Color.ByARGB(g=integer_slider)
byARGB_3 = Color.ByARGB(b=integer_slider)
list_create = List.Create(item0=byARGB, item1=byARGB_2, item2=byARGB_3)
color_range = ColorRange(colors=list_create, value=remapRange)  # unwired: indices
overrideColorInView = Element.OverrideColorInView(element=all_elements_at_level, color=color_range)
