# Dynamo graph CreatorPaint.dyn (Dynamo 2.3.0.5885)

all_elements_in_active_view = ElementsInView()
integer_slider = IntegerSlider(255, range=0..255 step 1)
byARGB = Color.ByARGB(r=integer_slider)
byARGB_2 = Color.ByARGB(g=integer_slider)
byARGB_3 = Color.ByARGB(b=integer_slider)
list_create = List.Create(item0=byARGB, item1=byARGB_2, item2=byARGB_3)
python_script = Python(IN[0]=all_elements_in_active_view)
# ---------- python_script.python (34 lines) ----------
# Load the Python Standard and DesignScript Libraries
import sys
import clr
clr.AddReference('RevitAPI')
from Autodesk.Revit.DB import *


clr.AddReference('RevitServices')
from RevitServices.Persistence import DocumentManager
from RevitServices.Transactions import TransactionManager

clr.AddReference('ProtoGeometry')
from Autodesk.DesignScript.Geometry import *

# The inputs to this node will be stored as a list in the IN variables.

doc = DocumentManager.Instance.CurrentDBDocument
dataEnteringNode = UnwrapElement(IN[0])

# Place your code below this line
creatorList=[]




for x in dataEnteringNode:
	creatorList.append(WorksharingUtils.GetWorksharingTooltipInfo(doc, x.Id).Creator)
	




# Assign your output to the OUT variable.
OUT = creatorList
# ----------------------------------------
uniqueItems = List.UniqueItems(list=python_script)
indexOf = List.IndexOf(list=uniqueItems, element=python_script)
code_block = CodeBlock { 0; }
code_block_2 = CodeBlock { 1; }
remapRange = Math.RemapRange(numbers=indexOf, newMin=code_block, newMax=code_block_2)
color_range = ColorRange(colors=list_create, value=remapRange)  # unwired: indices
overrideColorInView = Element.OverrideColorInView(element=all_elements_in_active_view, color=color_range)
uniqueItems_2 = List.UniqueItems(list=remapRange)
sortIndexByValue = List.SortIndexByValue(list=uniqueItems_2)
