# Dynamo graph DWGtoTopo.dyn (Dynamo 2.3.0.5885)
# packages: bimorphNodes 3.0.3

select_model_elements = DSModelElementsSelection()  # 330 picked in the model
watch = Watch(select_model_elements)
code_block = CodeBlock { 0; }
getItemAtIndex = List.GetItemAtIndex(list=watch, index=code_block)
parameters = Element.Parameters(element=getItemAtIndex)
python_script = Python(IN[0]=getItemAtIndex)
# ---------- python_script.python (29 lines) ----------
# Enable Python support and load DesignScript library
import clr
clr.AddReference('ProtoGeometry')
from Autodesk.DesignScript.Geometry import *

#import Revit API
clr.AddReference('RevitAPI')
from Autodesk.Revit.DB import *

#import Manager Classes(this is for transactions)

clr.AddReference('RevitServices')
from RevitServices.Persistence import DocumentManager
from RevitServices.Transactions import TransactionManager

clr.AddReference('RevitNodes')
import Revit
clr.ImportExtensions(Revit.Elements)
clr.ImportExtensions(Revit.GeometryConversion)

# The inputs to this node will be stored as a list in the IN variables.
dataEnteringNode = UnwrapElement(IN[0])

# Place your code below this line



# Assign your output to the OUT variable.
OUT = dataEnteringNode.Location
# ----------------------------------------
string_from_object = FromObject(obj=watch)
string = StringInput("ImportInstance")
eq = string_from_object == string
filterByBoolMask = List.FilterByBoolMask(list=watch, mask=eq)
watch_2 = Watch(filterByBoolMask.in)
views = Views("1ST FL")
layerNames = CAD.LayerNames(importInstance=getItemAtIndex)
detailCurvesFromCADLayers = CAD.DetailCurvesFromCADLayers(importInstance=watch_2, view=views, layerNames=layerNames)
watch_3 = Watch(detailCurvesFromCADLayers.layerKeys)
boolean = BoolSelector(false)
watch_4 = Watch(detailCurvesFromCADLayers.DetailCurve)
flatten = List.Flatten(list=watch_4)
curve = DetailCurve.Curve(detailCurve=flatten)
centerPoint = Circle.CenterPoint(circle=curve)
python_script_2 = Python(IN[0]=centerPoint)
# ---------- python_script_2.python (81 lines) ----------
import clr
import math
clr.AddReference('ProtoGeometry')
from Autodesk.DesignScript import Geometry as geom
clr.AddReference("RevitServices")
import RevitServices 
from RevitServices.Persistence import DocumentManager
doc = DocumentManager.Instance.CurrentDBDocument
clr.AddReference("RevitNodes")
import Revit
clr.ImportExtensions(Revit.Elements)
clr.ImportExtensions(Revit.GeometryConversion)
clr.AddReference("RevitAPI")
from Autodesk.Revit.DB import *
 
# Create a list object from singleton...
def tolist(obj1):
	if hasattr(obj1,"__iter__"): return obj1
	else: return [obj1]
	
################# Definitions ###################
# Convert Point from Relative to Shared Coordinates...
def ToSharedCoordinates(pt,iop,pbp,rot):
	# First we need to translate the point by adding the Internal Origin to the Point we're converting...
	pt = geom.Point.ByCoordinates(pt.X+iop.X, pt.Y+iop.Y, pt.Z+iop.Z)
	# Then we need to rotate this point about the Internal Origin in the opposite direction as the Project Rotation...
	pt = geom.Geometry.Rotate(pt,iop,geom.Vector.ZAxis(),rot*-1)
	return pt

# Convert Point from Relative to Project Coordinates...
def ToProjectCoordinates(pt,iop,pbp,rot):
	# First we need to Rotate the Project Base Point about the Internal Origin Point by the Project Rotation...
	pbp = geom.Geometry.Rotate(pbp,iop,geom.Vector.ZAxis(),rot)
	# Then we need to Translate the point we're converting by subtracting the Project Base Point and then adding the Internal Origin Point...
	pt = geom.Point.ByCoordinates(pt.X-pbp.X+iop.X,pt.Y-pbp.Y+iop.Y,pt.Z-pbp.Z+iop.Z)
	return pt

################# Variables ###################
# Input Variables...
pts = tolist(IN[0])
 
# Internal Variables...
pbp = None
iop = None
rot = 0
# Conversion to mm...
ft2mm = 304.8
 
# Output Variables...
shared = []
project = []
relative = []

################# Main ###################
# Collect Project Basepoint...
basePt = FilteredElementCollector(doc).OfCategory(BuiltInCategory.OST_ProjectBasePoint).ToElements()
 
# Convert Project Basepoint (pbp) to DS Point...
for e in basePt:
	# Get Project Base Points Parameter Values...
	ew = e.get_Parameter(BuiltInParameter.BASEPOINT_EASTWEST_PARAM).AsDouble()*ft2mm
	ns = e.get_Parameter(BuiltInParameter.BASEPOINT_NORTHSOUTH_PARAM).AsDouble()*ft2mm
	ele = e.get_Parameter(BuiltInParameter.BASEPOINT_ELEVATION_PARAM).AsDouble()*ft2mm
	rot = e.get_Parameter(BuiltInParameter.BASEPOINT_ANGLETON_PARAM).AsDouble()*180/math.pi    
	# Create Point from Project Base Point Values...
	pbp = geom.Point.ByCoordinates(ew,ns,ele)

# Convert Internal Origin Point (iop) as DS Point...
projPos = doc.ActiveProjectLocation.get_ProjectPosition(XYZ(0,0,0))
iop = geom.Point.ByCoordinates(projPos.EastWest*ft2mm,projPos.NorthSouth*ft2mm,0)
 
# Transform Input points to Shared/Project Coordinate System...
for pt in pts:
# Convert point to Shared Coordinates...
	shared.append(ToSharedCoordinates(pt,iop,pbp,rot))
	# Convert point to Project Coordinates...
	project.append(ToProjectCoordinates(pt,iop,pbp,rot))
	# Point is already Relative to the Internal Origin...
	relative.append(pt)
     
OUT = shared, project, relative
# ----------------------------------------
string_from_object_2 = FromObject(obj=watch)
string_2 = StringInput("TextNote")
eq_2 = string_from_object_2 == string_2
filterByBoolMask_2 = List.FilterByBoolMask(list=watch, mask=eq_2)
watch_5 = Watch(filterByBoolMask_2.in)
python_script_3 = Python(IN[0]=watch_5)
# ---------- python_script_3.python (18 lines) ----------
# Enable Python support and load DesignScript library
import clr
clr.AddReference('ProtoGeometry')
from Autodesk.DesignScript.Geometry import *

# The inputs to this node will be stored as a list in the IN variables.
dataEnteringNode = UnwrapElement(IN[0])

coordList=[]
for x in dataEnteringNode:
	coordList.append(x.Coord)



# Place your code below this line

# Assign your output to the OUT variable.
OUT = coordList
# ----------------------------------------
watch_6 = Watch(python_script_3)
python_script_4 = Python(IN[0]=watch_6)
# ---------- python_script_4.python (17 lines) ----------
# Enable Python support and load DesignScript library
import clr
clr.AddReference('ProtoGeometry')
from Autodesk.DesignScript.Geometry import *

# The inputs to this node will be stored as a list in the IN variables.
dataEnteringNode = UnwrapElement(IN[0])

XList=[]
YList=[]
for x in dataEnteringNode:
	XList.append(float(x.ToString()[1:-1].split(", ")[0])*304.8)
	YList.append(float(x.ToString()[1:-1].split(", ")[1])*304.8)
# Place your code below this line

# Assign your output to the OUT variable.
OUT = XList, YList
# ----------------------------------------
code_block_2 = CodeBlock { 0; }
getItemAtIndex_2 = List.GetItemAtIndex(list=python_script_4, index=code_block_2)
code_block_3 = CodeBlock { 1; }
getItemAtIndex_3 = List.GetItemAtIndex(list=python_script_4, index=code_block_3)
text = TextNote.Text(textNote=watch_5)
toNumber = String.ToNumber(str=text)
code_block_4 = CodeBlock { 100; }
mul = toNumber * code_block_4
byCoordinates = Point.ByCoordinates(x=getItemAtIndex_2, y=getItemAtIndex_3, z=mul)

# group: Change coordinates
# note: Index[0]- Shared Coordinates
# Index[1]- Project Coordinates
# Index[2]- Relative Coordinates
python_script_5 = Python(IN[0]=byCoordinates)
# ---------- python_script_5.python (81 lines) ----------
import clr
import math
clr.AddReference('ProtoGeometry')
from Autodesk.DesignScript import Geometry as geom
clr.AddReference("RevitServices")
import RevitServices 
from RevitServices.Persistence import DocumentManager
doc = DocumentManager.Instance.CurrentDBDocument
clr.AddReference("RevitNodes")
import Revit
clr.ImportExtensions(Revit.Elements)
clr.ImportExtensions(Revit.GeometryConversion)
clr.AddReference("RevitAPI")
from Autodesk.Revit.DB import *
 
# Create a list object from singleton...
def tolist(obj1):
	if hasattr(obj1,"__iter__"): return obj1
	else: return [obj1]
	
################# Definitions ###################
# Convert Point from Relative to Shared Coordinates...
def ToSharedCoordinates(pt,iop,pbp,rot):
	# First we need to translate the point by adding the Internal Origin to the Point we're converting...
	pt = geom.Point.ByCoordinates(pt.X+iop.X, pt.Y+iop.Y, pt.Z+iop.Z)
	# Then we need to rotate this point about the Internal Origin in the opposite direction as the Project Rotation...
	pt = geom.Geometry.Rotate(pt,iop,geom.Vector.ZAxis(),rot*-1)
	return pt

# Convert Point from Relative to Project Coordinates...
def ToProjectCoordinates(pt,iop,pbp,rot):
	# First we need to Rotate the Project Base Point about the Internal Origin Point by the Project Rotation...
	pbp = geom.Geometry.Rotate(pbp,iop,geom.Vector.ZAxis(),rot)
	# Then we need to Translate the point we're converting by subtracting the Project Base Point and then adding the Internal Origin Point...
	pt = geom.Point.ByCoordinates(pt.X-pbp.X+iop.X,pt.Y-pbp.Y+iop.Y,pt.Z-pbp.Z+iop.Z)
	return pt

################# Variables ###################
# Input Variables...
pts = tolist(IN[0])
 
# Internal Variables...
pbp = None
iop = None
rot = 0
# Conversion to mm...
ft2mm = 304.8
 
# Output Variables...
shared = []
project = []
relative = []

################# Main ###################
# Collect Project Basepoint...
basePt = FilteredElementCollector(doc).OfCategory(BuiltInCategory.OST_ProjectBasePoint).ToElements()
 
# Convert Project Basepoint (pbp) to DS Point...
for e in basePt:
	# Get Project Base Points Parameter Values...
	ew = e.get_Parameter(BuiltInParameter.BASEPOINT_EASTWEST_PARAM).AsDouble()*ft2mm
	ns = e.get_Parameter(BuiltInParameter.BASEPOINT_NORTHSOUTH_PARAM).AsDouble()*ft2mm
	ele = e.get_Parameter(BuiltInParameter.BASEPOINT_ELEVATION_PARAM).AsDouble()*ft2mm
	rot = e.get_Parameter(BuiltInParameter.BASEPOINT_ANGLETON_PARAM).AsDouble()*180/math.pi    
	# Create Point from Project Base Point Values...
	pbp = geom.Point.ByCoordinates(ew,ns,ele)

# Convert Internal Origin Point (iop) as DS Point...
projPos = doc.ActiveProjectLocation.GetProjectPosition (XYZ(0,0,0))
iop = geom.Point.ByCoordinates(projPos.EastWest*ft2mm,projPos.NorthSouth*ft2mm,0)
 
# Transform Input points to Shared/Project Coordinate System...
for pt in pts:
# Convert point to Shared Coordinates...
	shared.append(ToSharedCoordinates(pt,iop,pbp,rot))
	# Convert point to Project Coordinates...
	project.append(ToProjectCoordinates(pt,iop,pbp,rot))
	# Point is already Relative to the Internal Origin...
	relative.append(pt)
     
OUT = shared, project, relative
# ----------------------------------------

code_block_5 = CodeBlock { 1; }
getItemAtIndex_4 = List.GetItemAtIndex(list=python_script_5, index=code_block_5)
byPoints = Topography.ByPoints(points=getItemAtIndex_4)
