# Dynamo graph ElementPointLocation.dyn (Dynamo 2.0.2.6826)

collect_all_elements_in_model = Custom[Collect All Elements in Model]()
views = Views(index=0)
isVisible = archilab.Revit.Elements.Elements.IsVisible(element=collect_all_elements_in_model.elements, view=views)
filterByBoolMask = List.FilterByBoolMask(list=collect_all_elements_in_model.elements, mask=isVisible)
watch = Watch(filterByBoolMask.out)
watch_2 = Watch(filterByBoolMask.in)
location = Custom[Element.Location](element=watch_2)  # Returns the location of an element as an XYZ (or if it's line-based the start and end point of the line), along with some booleans to help filtering the results. Use this for some element types (e.g. walls or lines) that do not work with the built-in Get Family Instance Location node.
watch_3 = Watch(location.isPoint)
filterByBoolMask_2 = List.FilterByBoolMask(list=watch_2, mask=watch_3)
id = Element.Id(element=filterByBoolMask_2.in)
sort = List.Sort(list=id)
watch_4 = Watch(location.points)
indexOf = List.IndexOf(list=sort, element=id)
getItemAtIndex = List.GetItemAtIndex(list=watch_4, index=indexOf)
list_create = List.Create(item0=sort, item1=getItemAtIndex)
transpose = List.Transpose(lists=list_create)
watch_5 = Watch(location.hasLocation)
