# Dynamo graph Element_Location_Rotation.dyn "Element_Location" (Dynamo 2.3.1.11775)
# packages: archi-lab.net 2020.22.9, Clockwork for Dynamo 2.x 2.3.0

# group: Create Excel Files before and after rotation in same 3d view
all_elements_in_active_view = ElementsInView()  # frozen
getLocation = Element.GetLocation(element=all_elements_in_active_view)
string_from_object = FromObject(obj=getLocation)
string = StringInput("null")
eq = string_from_object == string
filterByBoolMask = List.FilterByBoolMask(list=all_elements_in_active_view, mask=eq)
watch = Watch(filterByBoolMask.in)
string_from_object_2 = FromObject(obj=watch)
uniqueItems = List.UniqueItems(list=string_from_object_2)
watch_2 = Watch(filterByBoolMask.out)
string_from_object_3 = FromObject(obj=watch_2)
uniqueItems_2 = List.UniqueItems(list=string_from_object_3)
file_path = Filename("..\Desktop\Dynamo\NotRotated.xlsx")
string_2 = StringInput("Sheet1")
code_block = CodeBlock { 0; }
uniqueId = Element.UniqueId(element=watch_2)
sort = List.Sort(list=uniqueId)
byElementId = archilab.Revit.Selection.Select.ByElementId(id=sort)
getLocation_2 = Element.GetLocation(element=byElementId)
string_from_object_4 = FromObject(obj=getLocation_2)
list_create = List.Create(item0=sort, item1=string_from_object_4)
transpose = List.Transpose(lists=list_create)
boolean = BoolSelector(true)
exportExcel = Data.ExportExcel(filePath=file_path, sheetName=string_2, startRow=code_block, startCol=code_block, data=transpose, overWrite=boolean)
watch_3 = Watch(exportExcel)

# group: Original File
file_path_2 = Filename("..\Desktop\Dynamo\NotRotated.xlsx")

file_from_path = FileObject(path=file_path_2)
string_3 = StringInput("Sheet1")
importExcel = Data.ImportExcel(file=file_from_path, sheetName=string_3)

# group: Rotated File
file_path_3 = Filename("..\Desktop\Dynamo\Rotated.xlsx")

file_from_path_2 = FileObject(path=file_path_3)
string_4 = StringInput("Sheet1")
importExcel_2 = Data.ImportExcel(file=file_from_path_2, sheetName=string_4)
transpose_2 = List.Transpose(lists=importExcel)
code_block_2 = CodeBlock { 0; }
getItemAtIndex = List.GetItemAtIndex(list=transpose_2, index=code_block_2)
watch_4 = Watch(getItemAtIndex)
transpose_3 = List.Transpose(lists=importExcel_2)
code_block_3 = CodeBlock { 0; }
getItemAtIndex_2 = List.GetItemAtIndex(list=transpose_3, index=code_block_3)
watch_5 = Watch(getItemAtIndex_2)
python_script = Python(IN[0]=watch_4, IN[1]=watch_5)
# ---------- python_script.python (16 lines) ----------
# Load the Python Standard and DesignScript Libraries
import sys
import clr
clr.AddReference('ProtoGeometry')
from Autodesk.DesignScript.Geometry import *

# The inputs to this node will be stored as a list in the IN variables.
list1 = IN[0]
list2 = IN[1]

newList=[x for x in list1 if x not in list2]

# Place your code below this line

# Assign your output to the OUT variable.
OUT = newList
# ----------------------------------------
python_script_2 = Python(IN[0]=importExcel, IN[1]=importExcel_2, IN[2]=python_script)
# ---------- python_script_2.python (20 lines) ----------
# Load the Python Standard and DesignScript Libraries
import sys
import clr
clr.AddReference('ProtoGeometry')
from Autodesk.DesignScript.Geometry import *

# The inputs to this node will be stored as a list in the IN variables.
List1 = UnwrapElement(IN[0])
List2 = UnwrapElement(IN[1])
List3 = UnwrapElement(IN[2])

badindex=[]


for count, x in enumerate(List1):
	for y in List3:
		if y == x[0]:
			badindex.append(int(count))

OUT = badindex
# ----------------------------------------
sort_2 = List.Sort(list=python_script_2)
reverse = List.Reverse(list=sort_2)
removeItemAtIndex = List.RemoveItemAtIndex(list=importExcel, indices=reverse)
python_script_3 = Python(IN[0]=removeItemAtIndex, IN[1]=importExcel_2)
# ---------- python_script_3.python (17 lines) ----------
# Load the Python Standard and DesignScript Libraries
import sys
import clr
clr.AddReference('ProtoGeometry')
from Autodesk.DesignScript.Geometry import *

# The inputs to this node will be stored as a list in the IN variables.
originalList = IN[0]
rotatedList = IN[1]

movedList=[]
# Place your code below this line
for count, x in enumerate(originalList):
	if x[1] == rotatedList[count][1]:
		movedList.append(x[0])
# Assign your output to the OUT variable.
OUT = movedList
# ----------------------------------------
byElementId_2 = archilab.Revit.Selection.Select.ByElementId(id=python_script_3)
views = Views("{3D - kristaps.rusis}")

# group: Elements that wont move
isolate_in_view = Custom[Isolate in View](element=byElementId_2, view=views)  # package archi-lab.net; This node will take input of elements and a view to isolate selected elements in a view.

# group: Elements that will dissapear from original file
byElementId_3 = archilab.Revit.Selection.Select.ByElementId(id=python_script)

getLocation_3 = Element.GetLocation(element=byElementId_3)
byLocation = TextNote.ByLocation()  # unwired: view, location, text, alignment
byPoint = FamilyInstance.ByPoint()  # unwired: familyType, point
name = Family.Name(family=byElementId_3)
byName = FamilyType.ByName(name=name)
family = FamilyType.Family(familyType=byName)
isInPlace = Custom[Family.IsInPlace](family=family)  # package Clockwork for Dynamo 2.x; Determines if a family is an in-place family
filterByBoolMask_2 = List.FilterByBoolMask(list=byElementId_3, mask=isInPlace)
watch_6 = Watch(filterByBoolMask_2.in)
setParameterByName = Element.SetParameterByName()  # unwired: element, parameterName, value
watch_7 = Watch(filterByBoolMask_2.out)
parameters = Element.Parameters(element=watch_7)
isReadOnly = Parameter.IsReadOnly(parameter=parameters)
filterByBoolMask_3 = List.FilterByBoolMask(list=parameters, mask=isReadOnly)
watch_8 = Watch(filterByBoolMask_3.out)
name_2 = Parameter.Name(parameter=watch_8)
getParameterValueByName = Element.GetParameterValueByName(element=watch_7, parameterName=name_2)
