# Dynamo graph Element_join_01.dyn (Dynamo 2.3.0.5885)
# packages: bimorphNodes 2.5.1, Clockwork for Dynamo 2.x 2.3.0

categories = Categories()  # nothing selected
all_elements_of_category = ElementsOfCategory(Category=categories)
geometry = Element.Geometry(element=all_elements_of_category)  # frozen
categories_2 = Categories("OST_AreaReinTags")
# note: Floor-Floor
# Floor-Walls
# Floor-Ceiling
# Floor-Structural Columns
# Floors-Structural Beams
# Wall-Wall
# Wall-Ceilings
all_elements_of_category_2 = ElementsOfCategory(Category=categories_2)
geometry_2 = Element.Geometry(element=all_elements_of_category_2)  # frozen
intersectsElement = Revit.Element.IntersectsElement(elementSetA=all_elements_of_category, elementSetB=all_elements_of_category_2)
python_script_underdevelopmeny = Python(IN[0]=intersectsElement, IN[1]=all_elements_of_category)
# ---------- python_script_underdevelopmeny.python (48 lines) ----------
import clr

clr.AddReference('RevitAPI')
from Autodesk.Revit.DB import *
from Autodesk.Revit.DB.Structure import *

clr.AddReference('RevitNodes')
import Revit
clr.ImportExtensions(Revit.GeometryConversion)
clr.ImportExtensions(Revit.Elements)

clr.AddReference('RevitServices')
import RevitServices
from RevitServices.Persistence import DocumentManager
from RevitServices.Transactions import TransactionManager

doc = DocumentManager.Instance.CurrentDBDocument
uidoc=DocumentManager.Instance.CurrentUIApplication.ActiveUIDocument

#Unwrapping Dynamoelement to Revit element.
intersectionlists = UnwrapElement(IN[0])
walllist = UnwrapElement(IN[1])
ellist01 = []
ellist02 = []
nointerseclist = []
explist=[]


#Do some action in a Transaction
TransactionManager.Instance.EnsureInTransaction(doc)
index = 0
for x in intersectionlists:
	if len(x) == 0:
		nointerseclist.append(walllist[index])
	else:
		for y in x:
			ellist01.append(y) 
			ellist02.append(walllist[index]) 
		
	index = index + 1

explist.append(nointerseclist)
explist.append(ellist01)
explist.append(ellist02)

TransactionManager.Instance.TransactionTaskDone()

OUT = explist
# ----------------------------------------
code_block = CodeBlock { 0; }
getItemAtIndex = List.GetItemAtIndex(list=python_script_underdevelopmeny, index=code_block)
watch = Watch(getItemAtIndex)
code_block_2 = CodeBlock { 1; }
getItemAtIndex_2 = List.GetItemAtIndex(list=python_script_underdevelopmeny, index=code_block_2)
code_block_3 = CodeBlock { 2; }
getItemAtIndex_3 = List.GetItemAtIndex(list=python_script_underdevelopmeny, index=code_block_3)
joinGeometry = Custom[Element.JoinGeometry](element1=getItemAtIndex_2, element2=getItemAtIndex_3)  # package Clockwork for Dynamo 2.x; Joins two model elements (if possible). Only works inside the project environment.
watch_2 = Watch(joinGeometry.success)
