# Dynamo graph ElementsPaintedByLevel.dyn (Dynamo 2.3.0.5885)

python_script = Python()  # unwired: IN[0]
# ---------- python_script.python (56 lines) ----------
# Load the Python Standard and DesignScript Libraries
import sys
import clr
clr.AddReference('RevitAPI')
from Autodesk.Revit.DB import *


clr.AddReference('RevitServices')
from RevitServices.Persistence import DocumentManager
from RevitServices.Transactions import TransactionManager

clr.AddReference('ProtoGeometry')
from Autodesk.DesignScript.Geometry import *

# The inputs to this node will be stored as a list in the IN variables.

doc = DocumentManager.Instance.CurrentDBDocument
#dataEnteringNode = IN

AllWalls = FilteredElementCollector(doc).OfCategory(BuiltInCategory.OST_Walls).WhereElementIsNotElementType().ToElements()

WallBaseConstr=[]

AllDoors = FilteredElementCollector(doc).OfCategory(BuiltInCategory.OST_Doors).WhereElementIsNotElementType().ToElements()

DoorLevel= []

AllWind = FilteredElementCollector(doc).OfCategory(BuiltInCategory.OST_Windows).WhereElementIsNotElementType().ToElements()

WindLevel=[]
# Place your code below this line

for x in AllWalls:
	try:
		WallBaseConstr.append(x.GetParameters("Base Constraint")[0].AsValueString())
	except:
		WallBaseConstr.append("")

for x in AllDoors:
	DoorLevel.append(x.GetParameters("Level")[0].AsValueString())
	
for x in AllWind:
	WindLevel.append(x.GetParameters("Level")[0].AsValueString())
	
allEl =[]
allEl.extend(AllWalls)
allEl.extend(AllDoors)
allEl.extend(AllWind)

allLev=[]
allLev.extend(WallBaseConstr)
allLev.extend(DoorLevel)
allLev.extend(WindLevel)

# Assign your output to the OUT variable.
OUT = allEl, allLev
# ----------------------------------------
code_block = CodeBlock { 0; }
getItemAtIndex = List.GetItemAtIndex(list=python_script, index=code_block)
integer_slider = IntegerSlider(255, range=0..255 step 1)
byARGB = Color.ByARGB(r=integer_slider)
byARGB_2 = Color.ByARGB(g=integer_slider)
byARGB_3 = Color.ByARGB(b=integer_slider)
list_create = List.Create(item0=byARGB, item1=byARGB_2, item2=byARGB_3)
code_block_2 = CodeBlock { 1; }
getItemAtIndex_2 = List.GetItemAtIndex(list=python_script, index=code_block_2)
uniqueItems = List.UniqueItems(list=getItemAtIndex_2)
indexOf = List.IndexOf(list=uniqueItems, element=getItemAtIndex_2)
code_block_3 = CodeBlock { 0; }
code_block_4 = CodeBlock { 1; }
remapRange = Math.RemapRange(numbers=indexOf, newMin=code_block_3, newMax=code_block_4)
color_range = ColorRange(colors=list_create, value=remapRange)  # unwired: indices
overrideColorInView = Element.OverrideColorInView(element=getItemAtIndex, color=color_range)
uniqueItems_2 = List.UniqueItems(list=remapRange)
sortIndexByValue = List.SortIndexByValue(list=uniqueItems_2)
