# Dynamo graph FloorPointsDecimate.dyn "TOPO.BOUNDARY.POINTS2" (Dynamo 2.3.1.11775)
# packages: Clockwork for Dynamo 2.x 2.3.0, Bakery 2018.4.301, archi-lab.net 2020.23.13

select_model_element = DSModelElementSelection()  # 1 picked in the model
points = Floor.Points(floor=select_model_element)
byPoints = Topography.ByPoints(points=points)
python_script = Python(IN[0]=byPoints)
# ---------- python_script.python (27 lines) ----------
# Load the Python Standard and DesignScript Libraries
import sys
import clr
clr.AddReference('ProtoGeometry')
from Autodesk.DesignScript.Geometry import *



# The inputs to this node will be stored as a list in the IN variables.
dataEnteringNode = UnwrapElement(IN[0]).GetBoundaryPoints()

dataEnteringNode2 = ((IN[0]).Points)

newList=[]

feet=304.8

for point in dataEnteringNode:
    newList.append(Point.ByCoordinates(point.X*feet,point.Y*feet,point.Z*feet))
realPoints=[]

for x in newList:
	for y in dataEnteringNode2:
		if x.ToString() == y.ToString():
			realPoints.append(y)

OUT = realPoints
# ----------------------------------------
tolerance = DoubleInput(3000)
relay = Relay(tolerance)
python_script_2 = Python(IN[0]=byPoints)
# ---------- python_script_2.python (27 lines) ----------
# Load the Python Standard and DesignScript Libraries
import sys
import clr
clr.AddReference('ProtoGeometry')
from Autodesk.DesignScript.Geometry import *



# The inputs to this node will be stored as a list in the IN variables.
dataEnteringNode = UnwrapElement(IN[0]).GetInteriorPoints()

dataEnteringNode2 = (IN[0]).Points

newList=[]

feet=304.8

for point in dataEnteringNode:
    newList.append(Point.ByCoordinates(point.X*feet,point.Y*feet,point.Z*feet))
realPoints=[]

for x in newList:
	for y in dataEnteringNode2:
		if x.ToString() == y.ToString():
			realPoints.append(y)

OUT = realPoints
# ----------------------------------------

# group: FIX this one, to get in new list rather than fuck with old list
python_script_3 = Python(IN[0]=relay, IN[1]=python_script_2)
# ---------- python_script_3.python (38 lines) ----------
# Load the Python Standard and DesignScript Libraries
import sys
import clr
clr.AddReference('ProtoGeometry')
from Autodesk.DesignScript.Geometry import *

# The inputs to this node will be stored as a list in the IN variables.
tolerance = IN[0]
floorPoints =IN[1]

for point in floorPoints:
	for checkPoint in floorPoints:
		if point != checkPoint:
			if Line.ByStartPointEndPoint(point,checkPoint).Length < tolerance:
				floorPoints.remove(checkPoint)
				
			else:
				pass
			
		else:
			pass
			
for point in floorPoints:
	for checkPoint in floorPoints:
		if point != checkPoint:
			if Line.ByStartPointEndPoint(point,checkPoint).Length < tolerance:
				floorPoints.remove(checkPoint)
				
			else:
				pass
			
		else:
			pass
			


# Assign your output to the OUT variable.
OUT = floorPoints
# ----------------------------------------

list_create = List.Create(item0=python_script, item1=python_script_3)
flatten = List.Flatten(list=list_create)
byPoints_2 = Topography.ByPoints(points=flatten)
list_create_2 = List.Create(item0=byPoints_2, item1=byPoints)
flatten_2 = List.Flatten(list=list_create_2)
points_2 = Topography.Points(topography=byPoints_2)
relay_2 = Relay(select_model_element)
passthrough = Custom[Passthrough](passThrough=relay_2, waitFor=byPoints_2)  # package Clockwork for Dynamo 2.x; Forces a sequential order of execution. The node wired into the output of the Passthrough node will be executed *after* the node wired into the waitFor input (e.g. important for some Revit operations). The value of the passThrough input will be passed on to the node wired into the output port of the Passthrough node.
resetSlabShape = Custom[Floor.ResetSlabShape](floor=passthrough)  # package Clockwork for Dynamo 2.x; Resets the slabshape of a floor
shape_edit_floor_with_points = Custom[Shape Edit Floor With Points](points=points_2, floorElement=resetSlabShape.floor)  # package Bakery
passthrough_2 = Custom[Passthrough](passThrough=flatten_2, waitFor=shape_edit_floor_with_points)
delete = Element.Delete(element=passthrough_2)
uniqueItems = List.UniqueItems()  # unwired: list
select_model_elements = DSModelElementsSelection()  # 218 picked in the model; frozen
points_3 = Floor.Points(floor=select_model_elements)
python_script_4 = Python(IN[0]=points_3)
# ---------- python_script_4.python (20 lines) ----------
# Load the Python Standard and DesignScript Libraries
import sys
import clr
clr.AddReference('ProtoGeometry')
from Autodesk.DesignScript.Geometry import *

# The inputs to this node will be stored as a list in the IN variables.
dataEnteringNode = IN[0]

boolList=[]
for x in dataEnteringNode:
	if len(x)!=0:
		boolList.append(True)
	else:
		boolList.append(False)

# Place your code below this line

# Assign your output to the OUT variable.
OUT = boolList
# ----------------------------------------
filterByBoolMask = List.FilterByBoolMask(list=select_model_elements, mask=python_script_4)
watch = Watch(filterByBoolMask.out)
watch_2 = Watch(filterByBoolMask.in)
views = Views("{3D - kristaps.rusis}")
isolate_in_view = Custom[Isolate in View](element=watch_2, view=views)  # package archi-lab.net; This node will take input of elements and a view to isolate selected elements in a view.
