# Dynamo graph IsolateMIP.dyn "IsolateMIPNEW" (Dynamo 2.3.0.5885)

# group: Choose view where you want to isolate MIP elements
views = Views("{3D - kristaps.rusis}")

python_script = Python()
# ---------- python_script.python (52 lines) ----------
import clr
import System
from System.Collections.Generic import List

#import Revit Nodes
clr.AddReference("RevitNodes")
import Revit
clr.ImportExtensions(Revit.Elements)

#Import RevitAPI
clr.AddReference("RevitAPI")
import Autodesk
from Autodesk.Revit.DB import *

#Import DocumentManager and TransactionManager
clr.AddReference("RevitServices")
from RevitServices.Persistence import DocumentManager
from RevitServices.Transactions import TransactionManager


#get the project document
doc = DocumentManager.Instance.CurrentDBDocument

#filter the doors 
collector = FilteredElementCollector(doc)
CollectedElements = collector.WhereElementIsNotElementType()

MIP = []

for x in CollectedElements:
	if x.ToString() == "Autodesk.Revit.DB.Family":
		if x.IsInPlace == True:
			MIP.append((UnwrapElement(x)))
		else:
			pass
		
	else:
		pass


#mipICollection = List[ElementId](MIP)


"""

TransactionManager.Instance.EnsureInTransaction(doc)
view.IsolateElementsTemporary(mipICollection)
TransactionManager.Instance.TransactionTaskDone()
"""


OUT = MIP
# ----------------------------------------
types = Family.Types(family=python_script)
flatten = List.Flatten(list=types)
byFamilyType = FamilyInstance.ByFamilyType(familyType=flatten)
flatten_2 = List.Flatten(list=byFamilyType)
python_script_2 = Python(IN[0]=views, IN[1]=flatten_2)
# ---------- python_script_2.python (43 lines) ----------
import clr
import System
from System.Collections.Generic import List

#import Revit Nodes
clr.AddReference("RevitNodes")
import Revit
clr.ImportExtensions(Revit.Elements)

#Import RevitAPI
clr.AddReference("RevitAPI")
import Autodesk
from Autodesk.Revit.DB import *

#Import DocumentManager and TransactionManager
clr.AddReference("RevitServices")
from RevitServices.Persistence import DocumentManager
from RevitServices.Transactions import TransactionManager


#get the project document
doc = DocumentManager.Instance.CurrentDBDocument

#filter the doors 


view = UnwrapElement(IN[0])
MIP = UnwrapElement(IN[1])
mipId=[]
for x in MIP:
	mipId.append(x.Id)
mipICollection = List[ElementId](mipId)




TransactionManager.Instance.EnsureInTransaction(doc)
view.IsolateElementsTemporary(mipICollection)
TransactionManager.Instance.TransactionTaskDone()



OUT = MIP
# ----------------------------------------
