# Dynamo graph IsolateWallTypeNewView.dyn (Dynamo 2.0.2.6826)

python_script = Python()  # unwired: IN[0]
# ---------- python_script.python (25 lines) ----------
# Load the Python Standard and DesignScript Libraries
import sys
import clr
clr.AddReference('RevitAPI')
from Autodesk.Revit.DB import *


clr.AddReference('RevitServices')
from RevitServices.Persistence import DocumentManager
from RevitServices.Transactions import TransactionManager

clr.AddReference('ProtoGeometry')
from Autodesk.DesignScript.Geometry import *

# The inputs to this node will be stored as a list in the IN variables.

doc = DocumentManager.Instance.CurrentDBDocument
#dataEnteringNode = IN

AllConduits = FilteredElementCollector(doc).OfCategory(BuiltInCategory.OST_Walls).WhereElementIsElementType().ToElements()

AllConduits = UnwrapElement(AllConduits)

# Assign your output to the OUT variable.
OUT = (AllConduits)
# ----------------------------------------
allWallsOfType = Revit.Selection.AllWallsOfType(wallType=python_script)
string_from_object = FromObject(obj=python_script)
python_script_2 = Python(IN[0]=string_from_object)
# ---------- python_script_2.python (16 lines) ----------
# Enable Python support and load DesignScript library
import clr
clr.AddReference('ProtoGeometry')
from Autodesk.DesignScript.Geometry import *

# The inputs to this node will be stored as a list in the IN variables.
dataEnteringNode = IN[0]

indexList=[]
for x,y in enumerate(dataEnteringNode):
	indexList.append(x)

# Place your code below this line

# Assign your output to the OUT variable.
OUT = indexList
# ----------------------------------------
getItemAtIndex = List.GetItemAtIndex(list=allWallsOfType, index=python_script_2)
python_script_3 = Python(IN[0]=getItemAtIndex)
# ---------- python_script_3.python (21 lines) ----------
# Enable Python support and load DesignScript library
import clr
clr.AddReference('ProtoGeometry')
from Autodesk.DesignScript.Geometry import *

# The inputs to this node will be stored as a list in the IN variables.
wallTypes = (IN[0])
empList=[]
newList=[]
# Place your code below this line

for x in wallTypes:
	if len(x)>0:
		newList.append(x[0])
	else:
		newList.append(empList)

	

# Assign your output to the OUT variable.
OUT = (newList)
# ----------------------------------------
isEmpty = List.IsEmpty(list=python_script_3, lacing=Longest)
filterByBoolMask = List.FilterByBoolMask(list=getItemAtIndex, mask=isEmpty)
filterByBoolMask_2 = List.FilterByBoolMask(list=python_script_3, mask=isEmpty)
# note: ACA_3085_BRICK _LIGHT
# ACA_3085_BRICK DARK
# ACA_3085 Rainscreen Cladding
getMaterials = Element.GetMaterials(element=filterByBoolMask_2.out)
name = Material.Name(material=getMaterials)
string = StringInput("ACA_3085_BRICK DARK")
python_script_4 = Python(IN[0]=name, IN[1]=string)
# ---------- python_script_4.python (21 lines) ----------
# Enable Python support and load DesignScript library
import clr
clr.AddReference('ProtoGeometry')
from Autodesk.DesignScript.Geometry import *

# The inputs to this node will be stored as a list in the IN variables.
dataEnteringNode = IN[0]
string=IN[1]
newList=[]

for x in dataEnteringNode:
	if string in x:
		newList.append(True)
	else:
		newList.append(False)
		

# Place your code below this line

# Assign your output to the OUT variable.
OUT = newList
# ----------------------------------------
filterByBoolMask_3 = List.FilterByBoolMask(list=filterByBoolMask.out, mask=python_script_4)
watch = Watch(filterByBoolMask_3.in)
flatten = List.Flatten(list=watch)
views = Views(index=2)
string_2 = StringInput("Duplicate")
duplicate = archilab.Revit.Views.Views.Duplicate(view=views, name=string, options=string_2)
isolate_in_view = Custom[Isolate in View](Element=flatten, View=duplicate)  # This node will take input of elements and a view to isolate selected elements in a view.
watch_2 = Watch(python_script)
flatten_2 = List.Flatten(list=name)
uniqueItems = List.UniqueItems(list=flatten_2)
watch_3 = Watch(filterByBoolMask.out)
