# Dynamo graph JAMES_SECRET_SCRIPT.dyn (Dynamo 2.3.0.5885)

categories = Categories("OST_Doors")
all_elements_of_category = ElementsOfCategory(Category=categories)
python_script = Python(IN[0]=all_elements_of_category)
# ---------- python_script.python (78 lines) ----------
import clr

#import Revit Nodes
clr.AddReference("RevitNodes")
import Revit
clr.ImportExtensions(Revit.Elements)

#Import RevitAPI
clr.AddReference("RevitAPI")
import Autodesk
from Autodesk.Revit.DB import *

#Import DocumentManager and TransactionManager
clr.AddReference("RevitServices")
from RevitServices.Persistence import DocumentManager
from RevitServices.Transactions import TransactionManager

doorCat = UnwrapElement(IN[0])

naming = []
projDoors = []
notWHDoors = []
renamedList = []


#get the project document
doc = DocumentManager.Instance.CurrentDBDocument

#filter the doors 
collector = FilteredElementCollector(doc)
doors = collector.OfCategory(BuiltInCategory.OST_Doors).WhereElementIsElementType()

#Get all Parameters 

feetToMm = 304.8

for door in doors:
	widthParam = door.get_Parameter(BuiltInParameter.DOOR_WIDTH)
	heightParam = door.get_Parameter(BuiltInParameter.DOOR_HEIGHT)

	newName = (str(int(widthParam.AsDouble()*feetToMm)) + "W" + " x " + str(int(heightParam.AsDouble()*feetToMm)) + "H")
	naming.append(newName)

	
	
for door in doors:
	projDoors.append(door)
	
count = 0	
for name in naming:
	if name == "0W x 0H":
		notWHDoors.append(projDoors[count])
		#naming.remove("0W x 0H")
		count += 1
		
	else:
		count += 1
		

for x in notWHDoors:
	del naming[projDoors.index(x)]
	projDoors.remove(x)
	
	
TransactionManager.Instance.EnsureInTransaction(doc)

count = 0
for door in projDoors:
	door.Name = naming[count]
	renamedList.append(door.ToDSType(True))
	count += 1



TransactionManager.Instance.TransactionTaskDone()


OUT = naming, notWHDoors, renamedList
# ----------------------------------------
watch = Watch(python_script)
code_block = CodeBlock { 1; }
getItemAtIndex = List.GetItemAtIndex(list=watch, index=code_block)

# group: Doors that dont have W and H parameters assigned
watch_2 = Watch(getItemAtIndex)

code_block_2 = CodeBlock { 2; }
getItemAtIndex_2 = List.GetItemAtIndex(list=watch, index=code_block_2)

# group: Sucessfuly named doors
watch_3 = Watch(getItemAtIndex_2)

categories_2 = Categories("OST_Windows")
all_elements_of_category_2 = ElementsOfCategory(Category=categories_2)
python_script_2 = Python(IN[0]=all_elements_of_category_2)
# ---------- python_script_2.python (78 lines) ----------
import clr

#import Revit Nodes
clr.AddReference("RevitNodes")
import Revit
clr.ImportExtensions(Revit.Elements)

#Import RevitAPI
clr.AddReference("RevitAPI")
import Autodesk
from Autodesk.Revit.DB import *

#Import DocumentManager and TransactionManager
clr.AddReference("RevitServices")
from RevitServices.Persistence import DocumentManager
from RevitServices.Transactions import TransactionManager

doorCat = UnwrapElement(IN[0])

naming = []
projDoors = []
notWHDoors = []
renamedList = []


#get the project document
doc = DocumentManager.Instance.CurrentDBDocument

#filter the doors 
collector = FilteredElementCollector(doc)
doors = collector.OfCategory(BuiltInCategory.OST_Windows).WhereElementIsElementType()

#Get all Parameters 

feetToMm = 304.8

for door in doors:
	widthParam = door.get_Parameter(BuiltInParameter.WINDOW_WIDTH)
	heightParam = door.get_Parameter(BuiltInParameter.WINDOW_HEIGHT)

	newName = (str(int(widthParam.AsDouble()*feetToMm)) + "W" + " x " + str(int(heightParam.AsDouble()*feetToMm)) + "H")
	naming.append(newName)

	
	
for door in doors:
	projDoors.append(door)
	
count = 0	
for name in naming:
	if name == "0W x 0H":
		notWHDoors.append(projDoors[count])
		#naming.remove("0W x 0H")
		count += 1
		
	else:
		count += 1
		

for x in notWHDoors:
	del naming[projDoors.index(x)]
	projDoors.remove(x)
	
	
TransactionManager.Instance.EnsureInTransaction(doc)

count = 0
for door in projDoors:
	door.Name = naming[count]
	renamedList.append(door.ToDSType(True))
	count += 1



TransactionManager.Instance.TransactionTaskDone()


OUT = naming, notWHDoors, renamedList
# ----------------------------------------
watch_4 = Watch(python_script_2)
code_block_3 = CodeBlock { 2; }
getItemAtIndex_3 = List.GetItemAtIndex(list=watch_4, index=code_block_3)

# group: Sucessfuly named Windows
watch_5 = Watch(getItemAtIndex_3)

code_block_4 = CodeBlock { 1; }
getItemAtIndex_4 = List.GetItemAtIndex(list=watch_4, index=code_block_4)

# group: Windows that dont have W and H parameters assigned
watch_6 = Watch(getItemAtIndex_4)

# group: Type Mark change for category
categories_3 = Categories("OST_Doors")
all_elements_of_category_3 = ElementsOfCategory(Category=categories_3)
string = StringInput("Mark")
parameters = Element.Parameters(element=all_elements_of_category_3)

categories_4 = Categories("OST_Windows")
all_elements_of_category_4 = ElementsOfCategory(Category=categories_4)
list_create = List.Create(item0=all_elements_of_category_3, item1=all_elements_of_category_4)
flatten = List.Flatten(list=list_create)

# group (continued): Type Mark change for category
python_script_3 = Python(IN[0]=flatten)
# ---------- python_script_3.python (20 lines) ----------
# Enable Python support and load DesignScript library
import clr
clr.AddReference('ProtoGeometry')
from Autodesk.DesignScript.Geometry import *

# The inputs to this node will be stored as a list in the IN variables.
dataEnteringNode = UnwrapElement(IN[0])
newTypeM=[]

count=0


for y in range(len(dataEnteringNode)):
	newTypeM.append(str(count))
	count=count+1
	
# Place your code below this line

# Assign your output to the OUT variable.
OUT = newTypeM
# ----------------------------------------
setParameterByName = Element.SetParameterByName(element=flatten, parameterName=string, value=python_script_3)
parameterByName = Parameter.ParameterByName(element=setParameterByName, name=string)
