# Dynamo graph JSKR_TRUVIEW.dyn (Dynamo 2.12.0.5650)

# group: SWL
file_path = Filename("K:\R&D\B1 PSO TRUVIEW\SWLocation.txt")

readText = FileSystem.ReadText(file=file_path)
string_from_object = FromObject(object=readText)

# group: FROM STATIONSLOCATION.XML
python_script = Python(IN[0]=string_from_object)  # IronPython2
# ---------- python_script.python (41 lines) ----------
# Load the Python Standard and DesignScript Libraries
import sys
import clr
clr.AddReference('ProtoGeometry')
from Autodesk.DesignScript.Geometry import *

# The inputs to this node will be stored as a list in the IN variables.
inputTxt = IN[0].split("<Registration>")[1].strip().split("</Registration>")[0].split("<ScanWorld")[1:]

# Place your code below this line
nameList=[]
locationList=[]
xList=[]
yList=[]
zList=[]

for x in inputTxt:
	x =x.strip().split(" name=")[1].split(" rotation_angle=")
	name=x[0][1:-1]
	nameList.append(name)
	location=x[1].split("translation=")[1].split("><")[0][2:-2].split(", ")
	locationList.append(location)
for y in locationList:
	xcord =float(y[0])*1000
	ycord =float(y[1])*1000
	zcord =float(y[2])*1000
	xList.append(xcord)
	yList.append(ycord)
	zList.append(zcord)
	
newDictList={}
for count, y in enumerate (nameList):
    newDictList[y]={"name":y,"x":(xList[count]),"y":(yList[count]),"z":(zList[count])}
  
	# new_dict = {"Name": y[0], "Http":y[1] }
	# newDictList.append(new_dict)


#for no,x in enumerate(inputTxt):
# Assign your output to the OUT variable.
OUT =  nameList, xList, yList, zList, newDictList #locationList  #inputTxt httpList 
# ----------------------------------------
code_block = CodeBlock { 0; 1; 2; 3; 4; }
X = List.GetItemAtIndex(list=python_script, index=code_block.out1)
NAME = List.GetItemAtIndex(list=python_script, index=code_block.out0)
Y = List.GetItemAtIndex(list=python_script, index=code_block.out2)
Z = List.GetItemAtIndex(list=python_script, index=code_block.out3)

dict = List.GetItemAtIndex(list=python_script, index=code_block.out4)
keys = DesignScript.Builtin.Dictionary.Keys(dictionary=dict)

# group: TVG
file_path_2 = Filename(".\POST STRIP BASEMENT 1.txt")

readText_2 = FileSystem.ReadText(file=file_path_2)
string_from_object_2 = FromObject(obj=readText_2)

# group: FROM TRUVIEW GLOBAL (WWW)
python_script_2 = Python(IN[0]=string_from_object_2)  # IronPython2
# ---------- python_script_2.python (25 lines) ----------
# Load the Python Standard and DesignScript Libraries
import sys
import clr
clr.AddReference('ProtoGeometry')
from Autodesk.DesignScript.Geometry import *

# The inputs to this node will be stored as a list in the IN variables.
inputTxt = IN[0].split("Imported by	admin")[1].strip().split("// Error Message")[0].strip()[0:-2].strip().split(" m")[0:-1]

# Place your code below this line
empList=[]
nameList=[]
httpList=[]
for x in inputTxt:
	x = x.strip().splitlines()
	empList.append(x)
	name = x[0].split("\t")[1]
	nameList.append(name)
	http=x[2][1:-1].split("info/")
	httpName=(str(http[0]+http[1]))
	httpList.append(httpName)
"""
for no,x in enumerate(inputTxt):
"""# Assign your output to the OUT variable.
OUT = httpList, nameList #empList 
# ----------------------------------------
code_block_2 = CodeBlock { 0; 1; }
NAME_2 = List.GetItemAtIndex(list=python_script_2, index=code_block_2.out1)
URL = List.GetItemAtIndex(list=python_script_2, index=code_block_2.out0)

watch = Watch(NAME_2)
valueAtKey = DesignScript.Builtin.Dictionary.ValueAtKey(dictionary=dict, key=watch)
code_block_3 = CodeBlock { "x"; "y"; "z"; }
valueAtKey_2 = DesignScript.Builtin.Dictionary.ValueAtKey(dictionary=valueAtKey, key=code_block_3.out0)
element_types = ElementTypes("BasePoint")  # graph input
all_elements_of_type = ElementsOfType(element_type=element_types)
number = DoubleInput(1)
getItemAtIndex = List.GetItemAtIndex(list=all_elements_of_type, index=number)
python_script_3 = Python(IN[0]=getItemAtIndex)  # IronPython2
# ---------- python_script_3.python (30 lines) ----------
# Enable Python support and load DesignScript library
import clr
clr.AddReference('ProtoGeometry')
from Autodesk.DesignScript.Geometry import *

#import Revit API
clr.AddReference('RevitAPI')
from Autodesk.Revit.DB import *

#import Manager Classes(this is for transactions)

clr.AddReference('RevitServices')
from RevitServices.Persistence import DocumentManager
from RevitServices.Transactions import TransactionManager

clr.AddReference('RevitNodes')
import Revit
clr.ImportExtensions(Revit.Elements)
clr.ImportExtensions(Revit.GeometryConversion)

doc =  DocumentManager.Instance.CurrentDBDocument
# The inputs to this node will be stored as a list in the IN variables.
dataEnteringNode = UnwrapElement(IN[0])



# Place your code below this line

# Assign your output to the OUT variable.
OUT = (dataEnteringNode.SharedPosition.Y),(dataEnteringNode.SharedPosition.X)
# ----------------------------------------
convert_between_units = DynamoConvert(python_script_3, MeasurementType="Length", FromConversion="Feet", ToConversion="Millimeters")
round = Math.Round(number=convert_between_units)
number_2 = DoubleInput(1)
X_2 = List.GetItemAtIndex(list=round, index=number_2)
valueAtKey_3 = DesignScript.Builtin.Dictionary.ValueAtKey(dictionary=valueAtKey, key=code_block_3.out1)
number_3 = DoubleInput(0)
Y_2 = List.GetItemAtIndex(list=round, index=number_3)

# group: Transpose Calculation
X_3 = CodeBlock(EXCEL_EASTING=valueAtKey_2, EASTING=X_2) { EXCEL_EASTING-EASTING; }
Y_3 = CodeBlock(EXCEL_NORTHING=valueAtKey_3, NORTHING=Y_2) { EXCEL_NORTHING-NORTHING; }

valueAtKey_4 = DesignScript.Builtin.Dictionary.ValueAtKey(dictionary=valueAtKey, key=code_block_3.out2)

# group: Place the family
family_types = FamilyTypes("G-Pr_60_75_86_80-POINT2-ScanStation-Bubble:G-Pr_60_75_86_80-POINT2-ScanStation-Bubble")  # graph input
x_coordinate = Watch(X_3)
y_coordinate = Watch(Y_3)
levels = Levels("POINT2-01-ZZ-M3-G-DATUM")  # graph input

# group: Project North - Rotation
projectRotation = Coordinates.ProjectRotation()
watch_2 = Watch(projectRotation)
cos_theta = Math.Cos(angle=watch_2)
x_cos = CodeBlock(X=x_coordinate, COS=cos_theta) { X*COS; }
watch_3 = Watch(x_cos)
sin_theta = Math.Sin(angle=watch_2)
y_sin = CodeBlock(Y=y_coordinate, SIN=sin_theta) { Y*SIN; }
watch_4 = Watch(y_sin)
x_cos_y_sin = CodeBlock(xcos=watch_3, ysin=watch_4) { xcos-ysin; }
watch_5 = Watch(x_cos_y_sin)
x_coordinate_2 = Watch(watch_5)
x_sin = CodeBlock(X=x_coordinate, SIN=sin_theta) { X*SIN; }
watch_6 = Watch(x_sin)
y_cos = CodeBlock(Y=y_coordinate, COS=cos_theta) { Y*COS; }
watch_7 = Watch(y_cos)
x_sin_y_cos = CodeBlock(xsin=watch_6, ycos=watch_7) { xsin+ycos; }
watch_8 = Watch(x_sin_y_cos)
y_coordinate_2 = Watch(watch_8)

# group (continued): Place the family
byCoordinates = Point.ByCoordinates(x=x_coordinate_2, y=y_coordinate_2, z=valueAtKey_4)
watch_9 = Watch(byCoordinates)
byPointAndLevel = FamilyInstance.ByPointAndLevel(familyType=family_types, point=watch_9, level=levels)
watch_10 = Watch(byPointAndLevel)

# group: Z Coordinate
code_block_4 = CodeBlock { "Z"; }
setParameterByName = Element.SetParameterByName(element=byPointAndLevel, parameterName=code_block_4, value=valueAtKey_4)

# group: X Coordinate
code_block_5 = CodeBlock { "X"; }
setParameterByName_2 = Element.SetParameterByName(element=byPointAndLevel, parameterName=code_block_5, value=valueAtKey_2)

# group: Y Coordinate
code_block_6 = CodeBlock { "Y"; }
setParameterByName_3 = Element.SetParameterByName(element=byPointAndLevel, parameterName=code_block_6, value=valueAtKey_3)

# group: Mark // Station Reference
code_block_7 = CodeBlock { "StationRef"; }
setParameterByName_4 = Element.SetParameterByName(element=byPointAndLevel, parameterName=code_block_7, value=watch)

watch_11 = Watch(URL)

# group: Image Link
code_block_8 = CodeBlock { "360Photo"; }
# note: Ignore the warning
setParameterByName_5 = Element.SetParameterByName(element=byPointAndLevel, parameterName=code_block_8, value=watch_11)

# group: To rotate family to True North
code_block_9 = CodeBlock(ROTATION=projectRotation) { 360-ROTATION; }
setRotation = FamilyInstance.SetRotation(degree=code_block_9)  # unwired: familyInstance
