# Dynamo graph KRDEMO.dyn (Dynamo 2.0.2.6826)

select_model_elements = DSModelElementsSelection()  # 2 picked in the model
select_model_elements_2 = DSModelElementsSelection()  # 2 picked in the model
python_script = Python(IN[0]=select_model_elements, IN[1]=select_model_elements_2)
# ---------- python_script.python (46 lines) ----------
import clr

clr.AddReference('RevitAPI')
from Autodesk.Revit.DB import *
from Autodesk.Revit.DB.Structure import *

clr.AddReference('RevitNodes')
import Revit
clr.ImportExtensions(Revit.GeometryConversion)
clr.ImportExtensions(Revit.Elements)

clr.AddReference('RevitServices')
import RevitServices
from RevitServices.Persistence import DocumentManager
from RevitServices.Transactions import TransactionManager

doc = DocumentManager.Instance.CurrentDBDocument
uidoc=DocumentManager.Instance.CurrentUIApplication.ActiveUIDocument

#Unwrapping Dynamoelement to Revit element.
lineIn = UnwrapElement(IN[0])
floorIn = UnwrapElement(IN[1])

lineList = []
floorList = []

options = Options()
transform = Transform.OfPoint()
"""
for l in lineIn:
	lineList.append(l.Geometry[options].GetTransformed(transform))
"""
for l in lineIn:
	lineList.append(l.Geometry[options].GetTransformed())


for f in floorIn:
	floorList.append(f.get_Geometry(options).GetEnumerator())


TransactionManager.Instance.EnsureInTransaction(doc)


TransactionManager.Instance.TransactionTaskDone()

OUT =  lineList, floorList
# ----------------------------------------
