# Dynamo graph Level - Create views With all the Elements.dyn (Dynamo 2.12.0.5650)
# packages: Clockwork for Dynamo 2.x 2.4.0

levels = Levels("POINT2-02-00-M3-G")
views = Views("Levels_")
string = StringInput("QA_POINT2_")
categories = Categories("OST_Levels")
all_elements_of_category = ElementsOfCategory(Category=categories)
code_block = CodeBlock { 0; }
removeItemAtIndex = List.RemoveItemAtIndex(list=all_elements_of_category, indices=code_block)
name = Level.Name(level=removeItemAtIndex)
duplicateView = View.DuplicateView(view=views, prefix=string, suffix=name)
all_elements_at_level = ElementsAtLevel(Level=removeItemAtIndex)
permanentlyIsolateElement = Custom[View.PermanentlyIsolateElement](view=duplicateView, element=all_elements_at_level)  # package Clockwork for Dynamo 2.x; Permanently isolates elements in the given view
