# Dynamo graph MIPtoFam.dyn (Dynamo 2.0.2.6826)

select_model_element = DSModelElementSelection()  # 1 picked in the model; frozen
python_script = Python(IN[0]=select_model_element)
# ---------- python_script.python (64 lines) ----------
# Enable Python support and load DesignScript library
import clr
clr.AddReference('ProtoGeometry')
from Autodesk.DesignScript.Geometry import *

#import Revit API
clr.AddReference('RevitAPI')
from Autodesk.Revit.DB import *

#import Manager Classes(this is for transactions)

clr.AddReference('RevitServices')
from RevitServices.Persistence import DocumentManager
from RevitServices.Transactions import TransactionManager

clr.AddReference('RevitNodes')
import Revit
clr.ImportExtensions(Revit.Elements)
clr.ImportExtensions(Revit.GeometryConversion)




dataEnteringNode = UnwrapElement(IN[0])
x = dataEnteringNode.GetType()
y = dataEnteringNode.GetOriginalGeometry(Options())

nlist = []

for el in y:
		nlist.append(el.Faces)



OUT = x,  nlist

"""
# The inputs to this node will be stored as a list in the IN variables.
familytype = UnwrapElement(IN[0])
output =[]

# Place your code below this line
doc = DocumentManager.Instance.CurrentDBDocument

TransactionManager.Instance.EnsureInTransaction(doc)

for x in range(0, 5000, 500):
	x =UnitUtils.ConvertToInternalUnits(x, DisplayUnitType.DUT_MILLIMETERS)
	fam = doc.Create.NewFamilyInstance(XYZ(x, 0, 0), familytype, Structure.StructuralType.NonStructural)
	wrappedfam = fam.ToDSType(True) #wraps element so it's visible in Dynamo
	output.append(wrappedfam)
	
#End transaction

TransactionManager.Instance.TransactionTaskDone()
	

# Assign your output to the OUT variable.
OUT = output



"""
# Enable Python support and load DesignScript library
# ----------------------------------------
watch = Watch(python_script)
select_model_element_2 = DSModelElementSelection()  # 1 picked in the model
geometry = Element.Geometry(element=select_model_element_2)
file_path = Filename("..\..\..\..\..\ProgramData\Autodesk\RVT 2018\Family Templates\English\Metric Generic Model.rft")
code_block = CodeBlock { "POINT2_SecurityBars_01"; }
categories = Categories(index=228)
string = StringInput("POINT2_MATERIAL_GREY")
byName = Material.ByName(name=string)
string_2 = StringInput("")
byGeometry = Custom[Springs.FamilyInstance.ByGeometry](geometry=geometry, familyTemplatePath=file_path, familyName=code_block, category=categories, materialName=byName, subcategoryName=string_2)  # You must provide a valid family template path that will be used for all input geometry objects. The project units(and not the templates) will be used to determine the size of the output geometry. The provided category will be used only if the family template supports it. If not, the default template category will be used instead. Likewise, the family material(provided as a string) will be set only if a material with that name exists in the template. If not, the default material will be used instead ("By Category"). For void cuts, the material settings will be ignored. The Subcategory name is an optional input. If you'd like to skip assigning a Subcategory to any new instance, simply use null. The node expects a unique family name for each geometry object. The rest of the input lists will be processed as if the node lacing is set to longest.
watch_2 = Watch(byGeometry.family)
watch_3 = Watch(byGeometry.instance)
boolean = BoolSelector(true)
bakeElements = Revit.Utilities.BakeElements(element=watch_3, bakeElementsToggle=boolean)  # frozen
watch_4 = Watch(bakeElements.element)
watch_5 = Watch(bakeElements.wasRan)
