# Dynamo graph MIPtoFam2022.dyn (Dynamo 2.10.1.3976)
# packages: spring nodes 210.1.1, Synthesize toolkit 12.3.9

file_path = Filename("C:\Users\krist\Desktop\SAT\Project1_-_3D_View_-_3D.sat")
importFromSAT = Geometry.ImportFromSAT(file=file_path)
file_path_2 = Filename("C:\ProgramData\Autodesk\RVT 2022\Family Templates\English\Metric Generic Model.rft")
code_block = CodeBlock { "POINT2_StairStinger_01"; }
categories = Categories("OST_GenericModel")
string = StringInput("POINT2_MATERIAL_GREY")
byName = Material.ByName(name=string)
string_2 = StringInput("")
ꟿ_familyinstance_bygeometry = Custom[ꟿ FamilyInstance.ByGeometry](geometry=importFromSAT, familyTemplatePath=file_path_2, familyName=code_block, category=categories, materialName=byName, subcategoryName=string_2)  # frozen; package spring nodes; You must provide a valid family template path that will be used for all input geometry objects. The project units(and not the templates) will be used to determine the size of the output geometry. The provided category will be used only if the family template supports it. If not, the default template category will be used instead. Likewise, the family material(provided as a string) will be set only if a material with that name exists in the template. If not, the default material will be used instead ("By Category"). For void cuts, the material settings will be ignored. The Subcategory name is an optional input. If you'd like to skip assigning a Subcategory to any new instance, simply use null. The node expects a unique family name for each geometry object. The rest of the input lists will be processed as if the node lacing is set to longest.
watch = Watch(ꟿ_familyinstance_bygeometry.family)
watch_2 = Watch(ꟿ_familyinstance_bygeometry.instance)
boolean = BoolSelector(true)
bakeElements = Revit.Utilities.BakeElements(element=watch_2, bakeElementsToggle=boolean)  # frozen
watch_3 = Watch(bakeElements.element)
watch_4 = Watch(bakeElements.wasRan)
select_model_element = DSModelElementSelection()  # 1 picked in the model
geometry = Element.Geometry(element=select_model_element)
string_from_object = FromObject(object=geometry)
string_3 = StringInput("Solid")
eq = string_from_object == string_3
filterByBoolMask = List.FilterByBoolMask(list=geometry, mask=eq)
string_4 = StringInput("Surface")
eq_2 = string_from_object == string_4
filterByBoolMask_2 = List.FilterByBoolMask(list=geometry, mask=eq_2)
code_block_2 = CodeBlock { -40; }
boolean_2 = BoolSelector(false)
thicken = Surface.Thicken(surface=filterByBoolMask_2.in, thickness=code_block_2, both_sides=boolean_2)
list_create = List.Create(item0=filterByBoolMask.in, item1=thicken)
flatten = List.Flatten(list=list_create)
differenceAll = Solid.DifferenceAll(solid=flatten, others=flatten)
difference = Solid.Difference()  # unwired: solid, other
list_create_2 = List.Create(item0=flatten)
ꟿ_mesh_topolysurface = Custom[ꟿ Mesh.ToPolySurface]()  # package spring nodes; Converts a Dynamo mesh to a polysurface. By default the node is single threaded, but if you specify a higher number of threads in the `NUMTHREAD` input, the node will run multi-threaded to speed up the conversion. *WARNING* Using multi-threaded code with Dynamo's geometry kernel may crash Revit in some cases.; unwired: mesh
bySolid = PolySurface.BySolid(solid=flatten)
byJoinedSurfaces = PolySurface.ByJoinedSurfaces(surfaces=bySolid)
surfaces = PolySurface.Surfaces(polySurface=byJoinedSurfaces)
byJoinedSurfaces_2 = Solid.ByJoinedSurfaces(facesOfSolid=surfaces)
centroid = Solid.Centroid(solid=byJoinedSurfaces_2)
python_script = Python(IN[0]=byJoinedSurfaces_2)  # IronPython2
# ---------- python_script.python (13 lines) ----------
# Load the Python Standard and DesignScript Libraries
import sys
import clr
clr.AddReference('ProtoGeometry')
from Autodesk.DesignScript.Geometry import *

# The inputs to this node will be stored as a list in the IN variables.
dataEnteringNode = UnwrapElement(IN[0])

# Place your code below this line

# Assign your output to the OUT variable.
OUT = (dataEnteringNode.Tessellate)
# ----------------------------------------
exportToSAT = ExportWithUnits(geometry=byJoinedSurfaces_2, SelectedExportedUnitsSource=[0, 1, 2, 3, 5, 4], SelectedExportedUnit=0)
string_5 = StringInput("C:\Users\krist\Desktop\SAT")
directoryName = FileSystem.DirectoryName(path=string_5)
byMesh = DirectShape.ByMesh(mesh=importFromSAT, category=categories)
ꟿ_form_bygeometry = Custom[ꟿ Form.ByGeometry](geometry=importFromSAT)  # package spring nodes; Convert the input geometry to a Revit Form object. Forms can exist only in the family environment. You can convert complicated solids or surfaces directly into forms. A form can act as a void. Provide either one true boolean value to convert a form into a void. The node's lacing is set to longest by default.
union = Solid.Union(solid=importFromSAT)  # unwired: solid_2
bySolid_2 = PolySurface.BySolid(solid=importFromSAT)
ꟿ_form_bygeometry_2 = Custom[ꟿ Form.ByGeometry]()  # unwired: geometry
toSolidDef = Geometry.ToSolidDef(geometry=byJoinedSurfaces_2)
k_family_insert = Custom[K-Family Insert](VARGeometryorSAT=flatten, VARFamilyName=code_block, VARFamilyCategory=categories, VARFamilyTemplatePath=file_path_2)  # package Synthesize toolkit; K-Family Insert
