# Dynamo graph Materials_Wall.dyn (Dynamo 2.3.1.11775)
# packages: spring nodes 203.1.0

views = Views("POINT2-01-ZZ-M3-G-DATUM")
select_model_element = DSModelElementSelection()  # 1 picked in the model
python_script = Python(IN[0]=select_model_element)
# ---------- python_script.python (72 lines) ----------
import clr

#Import the Revit Services
clr.AddReference("RevitServices")
import RevitServices
from RevitServices.Persistence import DocumentManager
from RevitServices.Transactions import TransactionManager

doc = DocumentManager.Instance.CurrentDBDocument

#Import the Revit Nodes
clr.AddReference("RevitNodes")
import Revit
clr.ImportExtensions(Revit.Elements)
clr.ImportExtensions(Revit.GeometryConversion)

#Import the Revit API
clr.AddReference("RevitAPI")
import Autodesk
from Autodesk.Revit.DB import *

def tolist(obj1):
	if hasattr(obj1,"__iter__"):
		return obj1
	else:
		return [obj1]

def ReturnSingleOrList(list):
	if len(list)==1:
		return list[0]
	else:
		return list

#This returns all the Geometries in an element
def GetElementGeometries(element):
	element = UnwrapElement(element)
	result = []
	geometries = element.Geometry[Options()]
	for geometry in geometries:
		result.append(geometry)
	return ReturnSingleOrList(result)

#Define Input (IN)
walls = UnwrapElement(tolist(IN[0]))
output = []
wallFList=[]
# Start Transaction
TransactionManager.Instance.EnsureInTransaction(doc)
Coordin=[]

options = Options()
for wall in walls:
	wallMaterials = []
	wallGeometry = GetElementGeometries(wall)
	wallFaces = wallGeometry.Faces
	
	
	for face in wallFaces:
		materialId = face.MaterialElementId
		material = doc.GetElement(materialId)
		wallMaterials.append(material)
	output.append(wallMaterials)
	
for x in wallFaces:
	Coordin.append(x.Origin.ToPoint())


#End Transaction
TransactionManager.Instance.TransactionTaskDone()

#Define Output (OUT)
OUT = Coordin, output
# ----------------------------------------
code_block = CodeBlock { 1; }
getItemAtIndex = List.GetItemAtIndex(list=python_script, index=code_block)
name = Material.Name(material=getItemAtIndex)
flatten = List.Flatten(list=name)
code_block_2 = CodeBlock { 0; }
getItemAtIndex_2 = List.GetItemAtIndex(list=python_script, index=code_block_2)
python_script_2 = Python(IN[0]=flatten, IN[1]=getItemAtIndex_2)
# ---------- python_script_2.python (24 lines) ----------
# Load the Python Standard and DesignScript Libraries
import sys
import clr
clr.AddReference('ProtoGeometry')
from Autodesk.DesignScript.Geometry import *

# The inputs to this node will be stored as a list in the IN variables.
material = IN[0]
point=IN[1]

outMat=[]
outPoint=[]

for count, x in enumerate(material):
	if x != "POINT2_MATERIAL_GREY":
		outMat.append(x)
		outPoint.append(point[count])
	else:
		pass

# Place your code below this line

# Assign your output to the OUT variable.
OUT = outPoint, outMat
# ----------------------------------------
getItemAtIndex_3 = List.GetItemAtIndex(list=python_script_2, index=code_block_2)
getItemAtIndex_4 = List.GetItemAtIndex(list=python_script_2, index=code_block)
ꟿ_textnote_bypoint = Custom[ꟿ TextNote.ByPoint](view=views, point=getItemAtIndex_3, content=getItemAtIndex_4)  # package spring nodes; Places a text note at a given point in the view. View, text type and content can either be a single item for all points or the same length as the number of points. Set track to false if you'd like to place notes on every run.
string = StringInput("DICK")
string_2 = StringInput("POINT2_MATERIAL_GREY")
removeItemAtIndex = List.RemoveItemAtIndex()  # unwired: list, indices
select_model_elements = DSModelElementsSelection()  # 2 picked in the model
python_script_3 = Python(IN[0]=select_model_element)
# ---------- python_script_3.python (72 lines) ----------
import clr

#Import the Revit Services
clr.AddReference("RevitServices")
import RevitServices
from RevitServices.Persistence import DocumentManager
from RevitServices.Transactions import TransactionManager

doc = DocumentManager.Instance.CurrentDBDocument

#Import the Revit Nodes
clr.AddReference("RevitNodes")
import Revit
clr.ImportExtensions(Revit.Elements)
clr.ImportExtensions(Revit.GeometryConversion)

#Import the Revit API
clr.AddReference("RevitAPI")
import Autodesk
from Autodesk.Revit.DB import *

def tolist(obj1):
	if hasattr(obj1,"__iter__"):
		return obj1
	else:
		return [obj1]

def ReturnSingleOrList(list):
	if len(list)==1:
		return list[0]
	else:
		return list

#This returns all the Geometries in an element
def GetElementGeometries(element):
	element = UnwrapElement(element)
	result = []
	geometries = element.Geometry[Options()]
	for geometry in geometries:
		result.append(geometry)
	return ReturnSingleOrList(result)

#Define Input (IN)
walls = UnwrapElement(tolist(IN[0]))
output = []
wallFList=[]
# Start Transaction
TransactionManager.Instance.EnsureInTransaction(doc)
Coordin=[]

options = Options()
for wall in walls:
	wallMaterials = []
	wallGeometry = GetElementGeometries(wall)
	wallFaces = wallGeometry.Faces
	
	
	for face in wallFaces:
		materialId = face.MaterialElementId
		material = doc.GetElement(materialId)
		wallMaterials.append(material)
	output.append(wallMaterials)
	
for x in wallFaces:
	Coordin.append(x.Origin.ToPoint())


#End Transaction
TransactionManager.Instance.TransactionTaskDone()

#Define Output (OUT)
OUT = (str(wallFaces[0].GetSurface().Origin).split("(")[1].split(",")) #Coordin ,output
# ----------------------------------------
toNumber = String.ToNumber(str=python_script_3)
code_block_3 = CodeBlock { 304.8; }
mul = toNumber * code_block_3
code_block_4 = CodeBlock { 0; }
getItemAtIndex_5 = List.GetItemAtIndex(list=mul, index=code_block_4)
code_block_5 = CodeBlock { 1; }
getItemAtIndex_6 = List.GetItemAtIndex(list=mul, index=code_block_5)
code_block_6 = CodeBlock { 0; }
byCoordinates = Point.ByCoordinates(x=getItemAtIndex_5, y=getItemAtIndex_6, z=code_block_6)
geometry = Element.Geometry(element=select_model_element)
