# Dynamo graph ModelCurvesDEMO.dyn (Dynamo 2.0.2.6826)

select_model_elements = DSModelElementsSelection()  # 690 picked in the model
type = Custom[ModelCurve.Type](modelCurve=select_model_elements)  # Gets the type of a given model curve
watch = Watch(type)
elementCurveReference = CurveElement.ElementCurveReference(curveElement=select_model_elements)
watch_2 = Watch(elementCurveReference)
