# Dynamo graph PaintSurf.dyn (Dynamo 2.0.2.6826)

select_model_element = DSModelElementSelection()  # 1 picked in the model
string = StringInput("POINT2_MATERIAL_FACADE_WHITE_ARGOS")
byName = Material.ByName(name=string)
python_script = Python(IN[0]=select_model_element, IN[1]=byName, IN[2]=select_model_element)
# ---------- python_script.python (64 lines) ----------
import clr


clr.AddReference("RevitAPI")

from Autodesk.Revit.DB import *
import math, sys
from System.Collections.Generic import *

clr.AddReference('ProtoGeometry')
from Autodesk.DesignScript.Geometry import *


clr.AddReference("RevitNodes")
import Revit
clr.ImportExtensions(Revit.Elements)
clr.ImportExtensions(Revit.GeometryConversion)
clr.ImportExtensions(Revit.GeometryReferences)


clr.AddReference("DSCoreNodes")
import DSCore
from DSCore import *

clr.AddReference("RevitServices")
import RevitServices
from RevitServices.Persistence import DocumentManager
from RevitServices.Transactions import TransactionManager


doc = DocumentManager.Instance.CurrentDBDocument
uidoc = DocumentManager.Instance.CurrentUIApplication.ActiveUIDocument
uiapp= DocumentManager.Instance.CurrentUIApplication
app = uiapp.Application
view = doc.ActiveView


surfaces = (IN[0])
material = UnwrapElement(IN[1])
el = UnwrapElement(IN[2])

opt=Options()

geometryElement = el.get_Geometry(opt)
faceList=[]

for geoObj in geometryElement:
	solid = geoObj
	for face in solid.Faces:
		faceList.append(face)

OUT = [faceList]





TransactionManager.Instance.EnsureInTransaction(doc)

for x in faceList:
	doc.Paint(el.Id, x, material.Id)
	

TransactionManager.Instance.TransactionTaskDone() 
# ----------------------------------------
