# Dynamo graph PanelChangeAndRename.dyn (Dynamo 2.0.2.6826)

select_model_element = DSModelElementSelection()  # 1 picked in the model
type = archilab.Revit.Elements.Elements.Type(element=select_model_element)
parameters = Element.Parameters(element=type)
code_block = CodeBlock { 58; }
getItemAtIndex = List.GetItemAtIndex(list=parameters, index=code_block)

# group: Offset
integer_slider = IntegerSlider(-5, range=-110..800 step 5)

setValue = Parameter.SetValue(parameter=getItemAtIndex, value=integer_slider)
code_block_2 = CodeBlock { 63; }
getItemAtIndex_2 = List.GetItemAtIndex(list=parameters, index=code_block_2)

# group: Thickness
integer_slider_2 = IntegerSlider(470, range=80..1420 step 5)

setValue_2 = Parameter.SetValue(parameter=getItemAtIndex_2, value=integer_slider_2)
python_script = Python(IN[0]=integer_slider_2, IN[1]=integer_slider)
# ---------- python_script.python (13 lines) ----------
# Enable Python support and load DesignScript library
import clr
clr.AddReference('ProtoGeometry')
from Autodesk.DesignScript.Geometry import *

# The inputs to this node will be stored as a list in the IN variables.
Thickness = IN[0]
Offset= IN[1]

# Place your code below this line
namestr = ("POINT2_Panel_Solid" + " " + str(Thickness) +  "T " + "O" + str(Offset))
# Assign your output to the OUT variable.
OUT = namestr
# ----------------------------------------
setName = Custom[Element.SetName](element=type, name=python_script)  # Gets the name of a given Revit element
watch = Watch(setName.Success)
watch_2 = Watch(setName.Fail)
name = Element.Name(element=type)
python_script_2 = Python()  # frozen; unwired: IN[0]
# ---------- python_script_2.python (28 lines) ----------
import sys
import clr
clr.AddReference('RevitAPI')
from Autodesk.Revit.DB import *


clr.AddReference('RevitServices')
from RevitServices.Persistence import DocumentManager
from RevitServices.Transactions import TransactionManager

clr.AddReference('ProtoGeometry')
from Autodesk.DesignScript.Geometry import *

# The inputs to this node will be stored as a list in the IN variables.

doc = DocumentManager.Instance.CurrentDBDocument


AllMullions = FilteredElementCollector(doc).OfCategory(BuiltInCategory.OST_CurtainWallPanels).WhereElementIsElementType().ToElements()

MulList=[]
AllMullions = UnwrapElement(AllMullions)

	


# Assign your output to the OUT variable.
OUT = (AllMullions)
# ----------------------------------------
string_from_object = FromObject(obj=python_script_2)
python_script_3 = Python(IN[0]=string_from_object)
# ---------- python_script_3.python (25 lines) ----------
# Enable Python support and load DesignScript library
import clr
clr.AddReference('ProtoGeometry')
from Autodesk.DesignScript.Geometry import *

# The inputs to this node will be stored as a list in the IN variables.
input = IN[0]

newList=[]

count=0
for x in input:
	if x.split(",")[-1] == " Family: System Panel":
				
		newList.append(count)
		count=count+1
	else:
		count =count+1
		pass
	

# Place your code below this line

# Assign your output to the OUT variable.
OUT = newList
# ----------------------------------------
getItemAtIndex_3 = List.GetItemAtIndex(list=python_script_2, index=python_script_3)
string = StringInput("Thickness")
parameterByName = Parameter.ParameterByName(element=getItemAtIndex_3, name=string)
string_from_object_2 = FromObject(obj=parameterByName)
string_2 = StringInput("Offset")
parameterByName_2 = Parameter.ParameterByName(element=getItemAtIndex_3, name=string_2)
string_from_object_3 = FromObject(obj=parameterByName_2)
python_script_4 = Python(IN[0]=string_from_object_2, IN[1]=string_from_object_3)
# ---------- python_script_4.python (26 lines) ----------
# Enable Python support and load DesignScript library
import clr
clr.AddReference('ProtoGeometry')
from Autodesk.DesignScript.Geometry import *

# The inputs to this node will be stored as a list in the IN variables.
ThicknessL = (IN[0])
OffsetL= IN[1]
Thickness = []
Offset=[]
for x in ThicknessL:
	Thickness.append(x.split(" : ")[-1])

for x in OffsetL:
	Offset.append(x.split(" : ")[-1])



# Place your code below this line
namestr=[]

for count, x in enumerate(Thickness):
	namestr.append("POINT2_Panel_Solid" + " " + str(Thickness[count]) +  "T " + "O" + str(Offset[count]))

# Assign your output to the OUT variable.
OUT = namestr
# ----------------------------------------
setName_2 = Custom[Element.SetName](element=getItemAtIndex_3, name=python_script_4)
watch_3 = Watch(setName_2.Success)
watch_4 = Watch(setName_2.Fail)
categories = Categories(index=142)  # frozen
all_elements_of_category = ElementsOfCategory(Category=categories)
type_2 = archilab.Revit.Elements.Elements.Type(element=all_elements_of_category)
uniqueItems = List.UniqueItems(list=type_2)
shuffle = List.Shuffle(list=uniqueItems)
indexOf = List.IndexOf(list=shuffle, element=type_2)
remapRange = Math.RemapRange(numbers=indexOf)
uniqueItems_2 = List.UniqueItems(list=remapRange)
integer_slider_3 = IntegerSlider(255, range=0..255 step 1)
byARGB = Color.ByARGB(r=integer_slider_3)
byARGB_2 = Color.ByARGB(g=integer_slider_3)
byARGB_3 = Color.ByARGB(b=integer_slider_3)
byARGB_4 = Color.ByARGB()
code_block_3 = CodeBlock { 0; }
byARGB_5 = Color.ByARGB(a=code_block_3)
list_create = List.Create(item0=byARGB, item1=byARGB_2, item2=byARGB_3, item3=byARGB_4, item4=byARGB_5)
color_range = ColorRange(colors=list_create, value=remapRange)  # unwired: indices
overrideColorInView = Element.OverrideColorInView(element=all_elements_of_category, color=color_range)
select_model_element_2 = DSModelElementSelection()  # 1 picked in the model; frozen
python_script_5 = Python(IN[0]=select_model_element_2)
# ---------- python_script_5.python (24 lines) ----------
# Enable Python support and load DesignScript library
import clr
clr.AddReference('ProtoGeometry')
from Autodesk.DesignScript.Geometry import *

# The inputs to this node will be stored as a list in the IN variables.
topo = UnwrapElement(IN[0])



# Place your code below this line
boundPoints= topo.GetBoundaryPoints()

xList=[]
yList=[]
zList=[]
feetToMm=304.8
for x, y in enumerate(boundPoints):
	xList.append(boundPoints[x].X*feetToMm)
	yList.append(boundPoints[x].Y*feetToMm)
	zList.append(boundPoints[x].Z*feetToMm)
	
# Assign your output to the OUT variable.
OUT = xList, yList, zList
# ----------------------------------------
code_block_4 = CodeBlock { 0; }
getItemAtIndex_4 = List.GetItemAtIndex(list=python_script_5, index=code_block_4)
code_block_5 = CodeBlock { 1; }
getItemAtIndex_5 = List.GetItemAtIndex(list=python_script_5, index=code_block_5)
code_block_6 = CodeBlock { 2; }
getItemAtIndex_6 = List.GetItemAtIndex(list=python_script_5, index=code_block_6)
byCoordinates = Point.ByCoordinates(x=getItemAtIndex_4, y=getItemAtIndex_5, z=getItemAtIndex_6)
