# Dynamo graph PointCloudOverride.dyn (Dynamo 2.0.2.6826)

python_script = Python()  # frozen; unwired: IN[0]
# ---------- python_script.python (50 lines) ----------
import clr

#import Revit Nodes
clr.AddReference("RevitNodes")
import Revit
clr.ImportExtensions(Revit.Elements)

#Import RevitAPI
clr.AddReference("RevitAPI")
import Autodesk
from Autodesk.Revit.DB import *
from Autodesk.Revit import DB

#Import DocumentManager and TransactionManager
clr.AddReference("RevitServices")
from RevitServices.Persistence import DocumentManager
from RevitServices.Transactions import TransactionManager

#get the project document
doc = DocumentManager.Instance.CurrentDBDocument

pointClouds= UnwrapElement(IN[0])
pointClouds = DB.FilteredElementCollector(doc).OfClass(DB.PointCloudInstance).WhereElementIsNotElementType().ToElements()
pt_cloud_settings = DB.PointClouds.PointCloudOverrideSettings()


PCParam = pointClouds.GetOrderedParameters()
PCParamUn = []

PCScans = pointClouds.GetScans()

PCOver = pointClouds.SupportsOverrides


for x in PCParam:
	PCParamUn.append(x.AsValueString())
	



	
	
TransactionManager.Instance.EnsureInTransaction(doc)



TransactionManager.Instance.TransactionTaskDone()


OUT = pointClouds,PCParam, PCParamUn, PCScans, PCOver
# ----------------------------------------
python_script_2 = Python()  # unwired: IN[0]
# ---------- python_script_2.python (52 lines) ----------
import clr

clr.AddReference('RevitAPI')
clr.AddReference('RevitAPIUI')

from Autodesk.Revit import DB

clr.AddReference("RevitServices")
import RevitServices
from RevitServices.Persistence import DocumentManager
from RevitServices.Transactions import TransactionManager

uiapp = DocumentManager.Instance.CurrentUIApplication
uidoc = uiapp.ActiveUIDocument
doc = DocumentManager.Instance.CurrentDBDocument

#Choose colour
col1= DB.Color(0, 0, 255)
col2= DB.Color(255, 0, 0)

pts = DB.FilteredElementCollector(doc).OfClass(DB.PointCloudInstance).WhereElementIsNotElementType().ToElements()
pt_cloud_settings = DB.PointClouds.PointCloudOverrideSettings()

#overrides MODE - Choose between NoOverride,FixedColor, Elevation, Intensity,  Normals
pt_cloud_settings.ColorMode = DB.PointCloudColorMode.Intensity


pt_cloud_cset = DB.PointClouds.PointCloudColorSettings(col1, col2)


#pt_cloud_cset.PointCloudColorSettings(col1, col2)



pt_cloud_mode_over=pt_cloud_settings.SetModeOverride(pt_cloud_settings.ColorMode, pt_cloud_cset)

#https://www.revitapidocs.com/2019/d44adc12-6607-719a-98fd-fd8efbc85771.htm


for pt in pts:
    view = uidoc.ActiveView
    pt_overrides = view.GetPointCloudOverrides()
    
TransactionManager.Instance.EnsureInTransaction(doc)
    
    
    

    
pt_overrides.SetPointCloudScanOverrideSettings(pt.Id, pt_cloud_settings)
    
TransactionManager.Instance.TransactionTaskDone()
# ----------------------------------------
