# Dynamo graph PointCloudScanStations2022.dyn (Dynamo 2.10.1.3976)

select_model_element = DSModelElementSelection()  # 1 picked in the model
python_script = Python(IN[0]=select_model_element)  # CPython3
# ---------- python_script.python (37 lines) ----------
import clr

clr.AddReference('RevitAPI')
clr.AddReference('RevitAPIUI')

from Autodesk.Revit import DB

clr.AddReference("RevitServices")
import RevitServices
from RevitServices.Persistence import DocumentManager
from RevitServices.Transactions import TransactionManager

uiapp = DocumentManager.Instance.CurrentUIApplication
uidoc = uiapp.ActiveUIDocument
doc = DocumentManager.Instance.CurrentDBDocument
# The inputs to this node will be stored as a list in the IN variables.
dataEnteringNode = UnwrapElement(IN[0])
scans = dataEnteringNode.GetScans()
# Place your code below this line


ScanCoordinates=[]
# Assign your output to the OUT variable.
XList=[]
YList=[]
ZList=[]

for x in scans:
    ScanCoordinates.append(dataEnteringNode.GetScanOrigin(x.ToString()))

for s in ScanCoordinates:
    XList.append(float(str(s)[1:-1].split(", ")[0])*304.8)
    YList.append(float(str(s)[1:-1].split(", ")[1])*304.8)
    ZList.append(float(str(s)[1:-1].split(", ")[2])*304.8)

# Assign your output to the OUT variable.
OUT = scans, ScanCoordinates, XList, YList, ZList
# ----------------------------------------
code_block = CodeBlock { 2; }
getItemAtIndex = List.GetItemAtIndex(list=python_script, index=code_block)
code_block_2 = CodeBlock { 3; }
getItemAtIndex_2 = List.GetItemAtIndex(list=python_script, index=code_block_2)
code_block_3 = CodeBlock { 4; }
getItemAtIndex_3 = List.GetItemAtIndex(list=python_script, index=code_block_3)

# group: Scan Location
byCoordinates = Point.ByCoordinates(x=getItemAtIndex, y=getItemAtIndex_2, z=getItemAtIndex_3)

# group: Scan Names
code_block_4 = CodeBlock { 0; }
getItemAtIndex_4 = List.GetItemAtIndex(list=python_script, index=code_block_4)
watch = Watch(getItemAtIndex_4)
