# Dynamo graph REVIT_EXPORT_DOWNGRADE_VERSION.dyn "ExportWalls" (Dynamo 2.3.1.11775)
# packages: archi-lab.net 2020.22.9, Modelical 2.2.19

# group: EXPORT WALLS
file_path = Filename("..\Desktop\New Microsoft Excel Worksheet.xlsx")
string = StringInput("Sheet1")
code_block = CodeBlock { 0; }
select_model_elements = DSModelElementsSelection()  # 94 picked in the model; frozen
watch = Watch(select_model_elements)
getLocation = Element.GetLocation(element=watch)
startPoint = Curve.StartPoint(curve=getLocation)
python_script = Python(IN[0]=startPoint)
# ---------- python_script.python (19 lines) ----------
# Load the Python Standard and DesignScript Libraries
import sys
import clr
clr.AddReference('ProtoGeometry')
from Autodesk.DesignScript.Geometry import *

# The inputs to this node will be stored as a list in the IN variables.
dataEnteringNode = UnwrapElement(IN[0])
lx=[]
ly=[]
lz=[]
for x in dataEnteringNode:
	lx.append(x.X)
	ly.append(x.Y)
	lz.append(x.Z)
# Place your code below this line

# Assign your output to the OUT variable.
OUT = lx, ly, lz
# ----------------------------------------
code_block_2 = CodeBlock { 0; 1; 2; }
getItemAtIndex = List.GetItemAtIndex(list=python_script, index=code_block_2.out0)
getItemAtIndex_2 = List.GetItemAtIndex(list=python_script, index=code_block_2.out1)
getItemAtIndex_3 = List.GetItemAtIndex(list=python_script, index=code_block_2.out2)
endPoint = Curve.EndPoint(curve=getLocation)
python_script_2 = Python(IN[0]=endPoint)  # same code as python_script
code_block_3 = CodeBlock { 0; 1; 2; }
getItemAtIndex_4 = List.GetItemAtIndex(list=python_script_2, index=code_block_3.out0)
getItemAtIndex_5 = List.GetItemAtIndex(list=python_script_2, index=code_block_3.out1)
getItemAtIndex_6 = List.GetItemAtIndex(list=python_script_2, index=code_block_3.out2)
type = archilab.Revit.Elements.Elements.Type(element=watch)
name = Element.Name(element=type)
string_2 = StringInput("Base Constraint")
getParameterValueByName = Element.GetParameterValueByName(element=watch, parameterName=string_2)
name_2 = Level.Name(level=getParameterValueByName)
string_3 = StringInput("Base Offset")
getParameterValueByName_2 = Element.GetParameterValueByName(element=watch, parameterName=string_3)
watch_2 = Watch(getParameterValueByName_2)
string_4 = StringInput("Top Constraint")
getParameterValueByName_3 = Element.GetParameterValueByName(element=watch, parameterName=string_4)
name_3 = Level.Name(level=getParameterValueByName_3)
string_5 = StringInput("Top Offset")
getParameterValueByName_4 = Element.GetParameterValueByName(element=watch, parameterName=string_5)
watch_3 = Watch(getParameterValueByName_4)
list_create = List.Create(item0=getItemAtIndex, item1=getItemAtIndex_2, item2=getItemAtIndex_3, item3=getItemAtIndex_4, item4=getItemAtIndex_5, item5=getItemAtIndex_6, item6=name, item7=name_2, item8=watch_2, item9=name_3, item10=watch_3)
transpose = List.Transpose(lists=list_create)
boolean = BoolSelector(true)
exportExcel = Data.ExportExcel(filePath=file_path, sheetName=string, startRow=code_block, startCol=code_block, data=transpose, overWrite=boolean)

# group: COLUMNS
select_model_elements_2 = DSModelElementsSelection()  # 62 picked in the model; frozen
string_from_object = FromObject(obj=select_model_elements_2)
uniqueItems = List.UniqueItems(list=string_from_object)
code_block_4 = CodeBlock { 0; }
getItemAtIndex_7 = List.GetItemAtIndex(list=select_model_elements_2, index=code_block_4)
type_2 = archilab.Revit.Elements.Elements.Type(element=select_model_elements_2)
name_4 = FamilyType.Name(familyType=type_2)
file_path_2 = Filename("..\Desktop\New Microsoft Excel Worksheet.xlsx")
string_6 = StringInput("Sheet2")
code_block_5 = CodeBlock { 0; }
getLocation_2 = Element.GetLocation(element=select_model_elements_2)
startPoint_2 = Curve.StartPoint(curve=getLocation_2)
python_script_3 = Python(IN[0]=startPoint_2)  # same code as python_script
code_block_6 = CodeBlock { 0; 1; 2; }
getItemAtIndex_8 = List.GetItemAtIndex(list=python_script_3, index=code_block_6.out0)
getItemAtIndex_9 = List.GetItemAtIndex(list=python_script_3, index=code_block_6.out1)
getItemAtIndex_10 = List.GetItemAtIndex(list=python_script_3, index=code_block_6.out2)
endPoint_2 = Curve.EndPoint(curve=getLocation_2)
python_script_4 = Python(IN[0]=endPoint_2)  # same code as python_script
code_block_7 = CodeBlock { 0; 1; 2; }
getItemAtIndex_11 = List.GetItemAtIndex(list=python_script_4, index=code_block_7.out0)
getItemAtIndex_12 = List.GetItemAtIndex(list=python_script_4, index=code_block_7.out1)
getItemAtIndex_13 = List.GetItemAtIndex(list=python_script_4, index=code_block_7.out2)
name_5 = Family.Name(family=select_model_elements_2)
string_from_object_2 = FromObject(obj=type_2)
python_script_5 = Python(IN[0]=string_from_object_2)
# ---------- python_script_5.python (16 lines) ----------
# Load the Python Standard and DesignScript Libraries
import sys
import clr
clr.AddReference('ProtoGeometry')
from Autodesk.DesignScript.Geometry import *

# The inputs to this node will be stored as a list in the IN variables.
dataEnteringNode = IN[0]
newList=[]
for x in dataEnteringNode:
	newList.append(x.split(":")[-1][1:])

# Place your code below this line

# Assign your output to the OUT variable.
OUT = newList
# ----------------------------------------
string_7 = StringInput("Base Level")
getParameterValueByName_5 = Element.GetParameterValueByName(element=select_model_elements_2, parameterName=string_7)
name_6 = Level.Name(level=getParameterValueByName_5)
string_8 = StringInput("Cross-Section Rotation")
getParameterValueByName_6 = Element.GetParameterValueByName(element=select_model_elements_2, parameterName=string_8)
list_create_2 = List.Create(item0=getItemAtIndex_8, item1=getItemAtIndex_9, item2=getItemAtIndex_10, item3=getItemAtIndex_11, item4=getItemAtIndex_12, item5=getItemAtIndex_13, item6=name_5, item7=python_script_5, item8=name_6, item9=getParameterValueByName_6)
transpose_2 = List.Transpose(lists=list_create_2)
boolean_2 = BoolSelector(true)
exportExcel_2 = Data.ExportExcel(filePath=file_path_2, sheetName=string_6, startRow=code_block_5, startCol=code_block_5, data=transpose_2, overWrite=boolean_2)

# group: COLUMNS
select_model_elements_3 = DSModelElementsSelection()  # 111 picked in the model; frozen
string_from_object_3 = FromObject(obj=select_model_elements_3)
uniqueItems_2 = List.UniqueItems(list=string_from_object_3)
code_block_8 = CodeBlock { 0; }
getItemAtIndex_14 = List.GetItemAtIndex(list=select_model_elements_3, index=code_block_8)
type_3 = archilab.Revit.Elements.Elements.Type(element=select_model_elements_3)
name_7 = FamilyType.Name(familyType=type_3)
file_path_3 = Filename("..\Desktop\New Microsoft Excel Worksheet.xlsx")
string_9 = StringInput("Sheet3")
code_block_9 = CodeBlock { 0; }
getLocation_3 = Element.GetLocation(element=select_model_elements_3)
startPoint_3 = Curve.StartPoint(curve=getLocation_3)
python_script_6 = Python(IN[0]=startPoint_3)  # same code as python_script
code_block_10 = CodeBlock { 0; 1; 2; }
getItemAtIndex_15 = List.GetItemAtIndex(list=python_script_6, index=code_block_10.out0)
getItemAtIndex_16 = List.GetItemAtIndex(list=python_script_6, index=code_block_10.out1)
getItemAtIndex_17 = List.GetItemAtIndex(list=python_script_6, index=code_block_10.out2)
endPoint_3 = Curve.EndPoint(curve=getLocation_3)
python_script_7 = Python(IN[0]=endPoint_3)  # same code as python_script
code_block_11 = CodeBlock { 0; 1; 2; }
getItemAtIndex_18 = List.GetItemAtIndex(list=python_script_7, index=code_block_11.out0)
getItemAtIndex_19 = List.GetItemAtIndex(list=python_script_7, index=code_block_11.out1)
getItemAtIndex_20 = List.GetItemAtIndex(list=python_script_7, index=code_block_11.out2)
name_8 = Family.Name(family=select_model_elements_3)
string_from_object_4 = FromObject(obj=type_3)
python_script_8 = Python(IN[0]=string_from_object_4)  # same code as python_script_5
string_10 = StringInput("Reference Level")
getParameterValueByName_7 = Element.GetParameterValueByName(element=select_model_elements_3, parameterName=string_10)
name_9 = Level.Name(level=getParameterValueByName_7)
string_11 = StringInput("Cross-Section Rotation")
getParameterValueByName_8 = Element.GetParameterValueByName(element=select_model_elements_3, parameterName=string_11)
list_create_3 = List.Create(item0=getItemAtIndex_15, item1=getItemAtIndex_16, item2=getItemAtIndex_17, item3=getItemAtIndex_18, item4=getItemAtIndex_19, item5=getItemAtIndex_20, item6=name_8, item7=python_script_8, item8=name_9, item9=getParameterValueByName_8)
transpose_3 = List.Transpose(lists=list_create_3)
boolean_3 = BoolSelector(true)
exportExcel_3 = Data.ExportExcel(filePath=file_path_3, sheetName=string_9, startRow=code_block_9, startCol=code_block_9, data=transpose_3, overWrite=boolean_3)

uniqueItems_3 = List.UniqueItems(list=string_from_object_4)

# group: CONCRETE BLOCKS
file_path_4 = Filename("..\Desktop\New Microsoft Excel Worksheet.xlsx")
string_12 = StringInput("Sheet4")
code_block_12 = CodeBlock { 0; }
select_model_elements_4 = DSModelElementsSelection()  # 38 picked in the model
geometry = Element.Geometry(element=select_model_elements_4)
flatten = List.Flatten(list=geometry)
centroid = Solid.Centroid(solid=flatten)
python_script_9 = Python(IN[0]=centroid)  # same code as python_script
code_block_13 = CodeBlock { 0; 1; 2; }
getItemAtIndex_21 = List.GetItemAtIndex(list=python_script_9, index=code_block_13.out0)
getItemAtIndex_22 = List.GetItemAtIndex(list=python_script_9, index=code_block_13.out1)
getItemAtIndex_23 = List.GetItemAtIndex(list=python_script_9, index=code_block_13.out2)
string_13 = StringInput("Height")
getParameterValueByName_9 = Element.GetParameterValueByName(element=select_model_elements_4, parameterName=string_13)
code_block_14 = CodeBlock { 2; }
div = getParameterValueByName_9 / code_block_14
sub = getItemAtIndex_23 - div
string_14 = StringInput("Width")
getParameterValueByName_10 = Element.GetParameterValueByName(element=select_model_elements_4, parameterName=string_14)
string_15 = StringInput("Depth")
getParameterValueByName_11 = Element.GetParameterValueByName(element=select_model_elements_4, parameterName=string_15)
getElementRotation = Custom[GetElementRotation](FamInstance=select_model_elements_4)  # package Modelical; Get the rotation of a family instance whose location is a point.
watch_4 = Watch(getElementRotation.Rotation)
list_create_4 = List.Create(item0=getItemAtIndex_21, item1=getItemAtIndex_22, item2=sub, item3=getParameterValueByName_9, item4=getParameterValueByName_10, item5=getParameterValueByName_11, item6=watch_4)
transpose_4 = List.Transpose(lists=list_create_4)
boolean_4 = BoolSelector(true)
exportExcel_4 = Data.ExportExcel(filePath=file_path_4, sheetName=string_12, startRow=code_block_12, startCol=code_block_12, data=transpose_4, overWrite=boolean_4)
