# Dynamo graph REVIT_IMPORT_DOWNGRADE_VERSION.dyn (Dynamo 1.3.4.6666)

# group: WALLS
file_path = Filename("C:\Users\krist\Desktop\New Microsoft Excel Worksheet.xlsx")  # frozen
fromPath = FileObject(file_path)  # "File.FromPath"
string = StringInput("Sheet1")
readFromFile = Excel.ReadFromFile(file=fromPath, sheetName=string)
transpose = List.Transpose(readFromFile)
code_block = CodeBlock { 0; 1; 2; 3; 4; 5; 6; 7; 8; 9; 10; }
getItemAtIndex = List.GetItemAtIndex(list=transpose, index=code_block.out0)
getItemAtIndex_2 = List.GetItemAtIndex(list=transpose, index=code_block.out1)
getItemAtIndex_3 = List.GetItemAtIndex(list=transpose, index=code_block.out2)
byCoordinates = Point.ByCoordinates(x=getItemAtIndex, y=getItemAtIndex_2, z=getItemAtIndex_3)
getItemAtIndex_4 = List.GetItemAtIndex(list=transpose, index=code_block.out3)
getItemAtIndex_5 = List.GetItemAtIndex(list=transpose, index=code_block.out4)
getItemAtIndex_6 = List.GetItemAtIndex(list=transpose, index=code_block.out5)
byCoordinates_2 = Point.ByCoordinates(x=getItemAtIndex_4, y=getItemAtIndex_5, z=getItemAtIndex_6)
byStartPointEndPoint = Line.ByStartPointEndPoint(startPoint=byCoordinates, endPoint=byCoordinates_2)
code_block_2 = CodeBlock { 100; }
getItemAtIndex_7 = List.GetItemAtIndex(list=transpose, index=code_block.out7)
string_from_object = FromObject(getItemAtIndex_7)
getLevelByName = archilab.Revit.Selection.Select.GetLevelByName(string_from_object)
getItemAtIndex_8 = List.GetItemAtIndex(list=transpose, index=code_block.out6)
byName = WallType.ByName(getItemAtIndex_8)
byCurveAndHeight = Wall.ByCurveAndHeight(curve=byStartPointEndPoint, height=code_block_2, level=getLevelByName, wallType=byName)
string_2 = StringInput("Base Offset")
getItemAtIndex_9 = List.GetItemAtIndex(list=transpose, index=code_block.out8)
setParameterByName = Element.SetParameterByName(element=byCurveAndHeight, parameterName=string_2, value=getItemAtIndex_9)
string_3 = StringInput("Top Offset")
getItemAtIndex_10 = List.GetItemAtIndex(list=transpose, index=code_block.out10)
setParameterByName_2 = Element.SetParameterByName(element=byCurveAndHeight, parameterName=string_3, value=getItemAtIndex_10)
string_4 = StringInput("Top Constraint")
getItemAtIndex_11 = List.GetItemAtIndex(list=transpose, index=code_block.out9)
string_from_object_2 = FromObject(getItemAtIndex_11)
getLevelByName_2 = archilab.Revit.Selection.Select.GetLevelByName(string_from_object_2)
setParameterByName_3 = Element.SetParameterByName(element=byCurveAndHeight, parameterName=string_4, value=getLevelByName_2)

# group: COLUMNS
file_path_2 = Filename("C:\Users\krist\Desktop\New Microsoft Excel Worksheet.xlsx")  # frozen
fromPath_2 = FileObject(file_path_2)  # "File.FromPath"
string_5 = StringInput("Sheet2")
readFromFile_2 = Excel.ReadFromFile(file=fromPath_2, sheetName=string_5)
transpose_2 = List.Transpose(readFromFile_2)
code_block_3 = CodeBlock { 0; 1; 2; 3; 4; 5; 6; 7; 8; 9; }
getItemAtIndex_12 = List.GetItemAtIndex(list=transpose_2, index=code_block_3.out7)
getItemAtIndex_13 = List.GetItemAtIndex(list=transpose_2, index=code_block_3.out0)
getItemAtIndex_14 = List.GetItemAtIndex(list=transpose_2, index=code_block_3.out1)
getItemAtIndex_15 = List.GetItemAtIndex(list=transpose_2, index=code_block_3.out2)
byCoordinates_3 = Point.ByCoordinates(x=getItemAtIndex_13, y=getItemAtIndex_14, z=getItemAtIndex_15)
getItemAtIndex_16 = List.GetItemAtIndex(list=transpose_2, index=code_block_3.out3)
getItemAtIndex_17 = List.GetItemAtIndex(list=transpose_2, index=code_block_3.out4)
getItemAtIndex_18 = List.GetItemAtIndex(list=transpose_2, index=code_block_3.out5)
byCoordinates_4 = Point.ByCoordinates(x=getItemAtIndex_16, y=getItemAtIndex_17, z=getItemAtIndex_18)
byStartPointEndPoint_2 = Line.ByStartPointEndPoint(startPoint=byCoordinates_3, endPoint=byCoordinates_4)
getItemAtIndex_19 = List.GetItemAtIndex(list=transpose_2, index=code_block_3.out8)
getLevelByName_3 = archilab.Revit.Selection.Select.GetLevelByName(getItemAtIndex_19)
getItemAtIndex_20 = List.GetItemAtIndex(list=transpose_2, index=code_block_3.out6)
byName_2 = FamilyType.ByName(getItemAtIndex_20)
columnByCurve = StructuralFraming.ColumnByCurve(curve=byStartPointEndPoint_2, level=getLevelByName_3, structuralColumnType=byName_2)
string_6 = StringInput("Cross-Section Rotation")
getItemAtIndex_21 = List.GetItemAtIndex(list=transpose_2, index=code_block_3.out9)
setParameterByName_4 = Element.SetParameterByName(element=columnByCurve, parameterName=string_6, value=getItemAtIndex_21)
structural_column_types = StructuralColumnTypes("CHS101.6x3.2")

# group: BEAMS
file_path_3 = Filename("C:\Users\krist\Desktop\New Microsoft Excel Worksheet.xlsx")  # frozen
fromPath_3 = FileObject(file_path_3)  # "File.FromPath"
string_7 = StringInput("Sheet3")
readFromFile_3 = Excel.ReadFromFile(file=fromPath_3, sheetName=string_7)
transpose_3 = List.Transpose(readFromFile_3)
code_block_4 = CodeBlock { 0; 1; 2; 3; 4; 5; 6; 7; 8; 9; }
getItemAtIndex_22 = List.GetItemAtIndex(list=transpose_3, index=code_block_4.out0)
getItemAtIndex_23 = List.GetItemAtIndex(list=transpose_3, index=code_block_4.out1)
getItemAtIndex_24 = List.GetItemAtIndex(list=transpose_3, index=code_block_4.out2)
byCoordinates_5 = Point.ByCoordinates(x=getItemAtIndex_22, y=getItemAtIndex_23, z=getItemAtIndex_24)
getItemAtIndex_25 = List.GetItemAtIndex(list=transpose_3, index=code_block_4.out3)
getItemAtIndex_26 = List.GetItemAtIndex(list=transpose_3, index=code_block_4.out4)
getItemAtIndex_27 = List.GetItemAtIndex(list=transpose_3, index=code_block_4.out5)
byCoordinates_6 = Point.ByCoordinates(x=getItemAtIndex_25, y=getItemAtIndex_26, z=getItemAtIndex_27)
byStartPointEndPoint_3 = Line.ByStartPointEndPoint(startPoint=byCoordinates_5, endPoint=byCoordinates_6)
getItemAtIndex_28 = List.GetItemAtIndex(list=transpose_3, index=code_block_4.out8)
getLevelByName_4 = archilab.Revit.Selection.Select.GetLevelByName(getItemAtIndex_28)
getItemAtIndex_29 = List.GetItemAtIndex(list=transpose_3, index=code_block_4.out6)
byName_3 = FamilyType.ByName(getItemAtIndex_29)
beamByCurve = StructuralFraming.BeamByCurve(curve=byStartPointEndPoint_3, level=getLevelByName_4, structuralFramingType=byName_3)
string_8 = StringInput("Cross-Section Rotation")
getItemAtIndex_30 = List.GetItemAtIndex(list=transpose_3, index=code_block_4.out9)
setParameterByName_5 = Element.SetParameterByName(element=beamByCurve, parameterName=string_8, value=getItemAtIndex_30)
getItemAtIndex_31 = List.GetItemAtIndex(list=transpose_3, index=code_block_4.out7)

family_types = FamilyTypes("POINT2_RectangularConcreteBlock_01:POINT2_RectangularConcreteBlock_01")
file_path_4 = Filename("C:\Users\krist\Desktop\New Microsoft Excel Worksheet.xlsx")
fromPath_4 = FileObject(file_path_4)  # "File.FromPath"
string_9 = StringInput("Sheet4")
readFromFile_4 = Excel.ReadFromFile(file=fromPath_4, sheetName=string_9)
transpose_4 = List.Transpose(readFromFile_4)
code_block_5 = CodeBlock { 0; 1; 2; 3; 4; 5; 6; }
getItemAtIndex_32 = List.GetItemAtIndex(list=transpose_4, index=code_block_5.out0)
getItemAtIndex_33 = List.GetItemAtIndex(list=transpose_4, index=code_block_5.out1)
getItemAtIndex_34 = List.GetItemAtIndex(list=transpose_4, index=code_block_5.out2)
byCoordinates_7 = Point.ByCoordinates(x=getItemAtIndex_32, y=getItemAtIndex_33, z=getItemAtIndex_34)
byPoint = FamilyInstance.ByPoint(familyType=family_types, point=byCoordinates_7)
string_10 = StringInput("Height")
getItemAtIndex_35 = List.GetItemAtIndex(list=transpose_4, index=code_block_5.out3)
setParameterByName_6 = Element.SetParameterByName(element=byPoint, parameterName=string_10, value=getItemAtIndex_35)
string_11 = StringInput("Width")
getItemAtIndex_36 = List.GetItemAtIndex(list=transpose_4, index=code_block_5.out4)
setParameterByName_7 = Element.SetParameterByName(element=byPoint, parameterName=string_11, value=getItemAtIndex_36)
string_12 = StringInput("Depth")
getItemAtIndex_37 = List.GetItemAtIndex(list=transpose_4, index=code_block_5.out5)
setParameterByName_8 = Element.SetParameterByName(element=byPoint, parameterName=string_12, value=getItemAtIndex_37)
getItemAtIndex_38 = List.GetItemAtIndex(list=transpose_4, index=code_block_5.out6)
setRotation = FamilyInstance.SetRotation(familyInstance=byPoint, degree=getItemAtIndex_38)
