# Dynamo graph RenameConcreteTypes.dyn (Dynamo 2.3.0.5885)
# packages: Clockwork for Dynamo 2.x 2.3.0

categories = Categories("OST_Doors")
select_model_element = DSModelElementSelection()  # nothing selected; frozen
python_script = Python(IN[0]=select_model_element)
# ---------- python_script.python (13 lines) ----------
# Load the Python Standard and DesignScript Libraries
import sys
import clr
clr.AddReference('ProtoGeometry')
from Autodesk.DesignScript.Geometry import *

# The inputs to this node will be stored as a list in the IN variables.
dataEnteringNode = IN[0]

# Place your code below this line
type = (dataEnteringNode.ElementType)
# Assign your output to the OUT variable.
OUT = type
# ----------------------------------------
parameters = Element.Parameters(element=python_script)
code_block = CodeBlock { 75; }
getItemAtIndex = List.GetItemAtIndex(list=parameters, index=code_block)

# group: Width
integer_slider = IntegerSlider(520, range=400..1520 step 5)

setValue = Parameter.SetValue(parameter=getItemAtIndex, value=integer_slider)

# group: Depth
integer_slider_2 = IntegerSlider(540, range=100..2500 step 5)

python_script_2 = Python(IN[0]=integer_slider_2, IN[1]=integer_slider)
# ---------- python_script_2.python (13 lines) ----------
# Enable Python support and load DesignScript library
import clr
clr.AddReference('ProtoGeometry')
from Autodesk.DesignScript.Geometry import *

# The inputs to this node will be stored as a list in the IN variables.
Thickness = IN[0]
Offset= IN[1]

# Place your code below this line
namestr = ("W" +str(Offset) + " D" + str(Thickness))
# Assign your output to the OUT variable.
OUT = namestr
# ----------------------------------------
setName = Custom[Element.SetName](element=python_script, name=python_script_2)  # package Clockwork for Dynamo 2.x; Gets the name of a given Revit element
watch = Watch(setName.element)
watch_2 = Watch(setName.success)
code_block_2 = CodeBlock { 47; }
getItemAtIndex_2 = List.GetItemAtIndex(list=parameters, index=code_block_2)
setValue_2 = Parameter.SetValue(parameter=getItemAtIndex_2, value=integer_slider_2)
name = Element.Name(element=python_script)
string = StringInput("Concrete - Rectangular Beam")
byName = Family.ByName(name=string)
types = Family.Types(family=byName)
string_2 = StringInput("b")
getParameterValueByName = Element.GetParameterValueByName(element=types, parameterName=string_2)
string_3 = StringInput("h")
getParameterValueByName_2 = Element.GetParameterValueByName(element=types, parameterName=string_3)
python_script_3 = Python(IN[0]=getParameterValueByName, IN[1]=getParameterValueByName_2)
# ---------- python_script_3.python (17 lines) ----------
# Enable Python support and load DesignScript library
import clr
clr.AddReference('ProtoGeometry')
from Autodesk.DesignScript.Geometry import *

# The inputs to this node will be stored as a list in the IN variables.
B = IN[0]
H = IN[1]

# Place your code below this line
nameList=[]
for count, each in enumerate(B):
	nameList.append("B" + str(int(each)) +"x" + "H" + str(int(H[count])))
#"B" + str(B[]) + " H" + str(Thickness)
#namestr = ("B" +str(Offset) + " H" + str(Thickness))
# Assign your output to the OUT variable.
OUT = nameList
# ----------------------------------------
setName_2 = Custom[Element.SetName](element=types, name=python_script_3)
watch_3 = Watch(setName_2.element)
