# Dynamo graph RenameFamily.dyn (Dynamo 2.6.1.8786)
# packages: Clockwork for Dynamo 2.x 2.3.0

watch = Watch()  # frozen; unwired: arg0
code_block = CodeBlock { 1; }
getItemAtIndex = List.GetItemAtIndex(list=watch, index=code_block)

# group: Doors that dont have W and H parameters assigned
watch_2 = Watch(getItemAtIndex)

code_block_2 = CodeBlock { 2; }
getItemAtIndex_2 = List.GetItemAtIndex(list=watch, index=code_block_2)

# group: Sucessfuly named doors
watch_3 = Watch(getItemAtIndex_2)

categories = Categories("OST_WallsSubstrate")  # frozen
all_elements_of_category = ElementsOfCategory(Category=categories)
python_script = Python(IN[0]=all_elements_of_category)
# ---------- python_script.python (78 lines) ----------
import clr

#import Revit Nodes
clr.AddReference("RevitNodes")
import Revit
clr.ImportExtensions(Revit.Elements)

#Import RevitAPI
clr.AddReference("RevitAPI")
import Autodesk
from Autodesk.Revit.DB import *

#Import DocumentManager and TransactionManager
clr.AddReference("RevitServices")
from RevitServices.Persistence import DocumentManager
from RevitServices.Transactions import TransactionManager

doorCat = UnwrapElement(IN[0])

naming = []
projDoors = []
notWHDoors = []
renamedList = []


#get the project document
doc = DocumentManager.Instance.CurrentDBDocument

#filter the doors 
collector = FilteredElementCollector(doc)
doors = collector.OfCategory(BuiltInCategory.OST_Windows).WhereElementIsElementType()

#Get all Parameters 

feetToMm = 304.8

for door in doors:
	widthParam = door.get_Parameter(BuiltInParameter.WINDOW_WIDTH)
	heightParam = door.get_Parameter(BuiltInParameter.WINDOW_HEIGHT)

	newName = (str(int(widthParam.AsDouble()*feetToMm)) + "W" + " x " + str(int(heightParam.AsDouble()*feetToMm)) + "H")
	naming.append(newName)

	
	
for door in doors:
	projDoors.append(door)
	
count = 0	
for name in naming:
	if name == "0W x 0H":
		notWHDoors.append(projDoors[count])
		#naming.remove("0W x 0H")
		count += 1
		
	else:
		count += 1
		

for x in notWHDoors:
	del naming[projDoors.index(x)]
	projDoors.remove(x)
	
	
TransactionManager.Instance.EnsureInTransaction(doc)

count = 0
for door in projDoors:
	door.Name = naming[count]
	renamedList.append(door.ToDSType(True))
	count += 1



TransactionManager.Instance.TransactionTaskDone()


OUT = naming, notWHDoors, renamedList
# ----------------------------------------
watch_4 = Watch(python_script)
code_block_3 = CodeBlock { 2; }
getItemAtIndex_3 = List.GetItemAtIndex(list=watch_4, index=code_block_3)

# group: Sucessfuly named Windows
watch_5 = Watch(getItemAtIndex_3)

code_block_4 = CodeBlock { 1; }
getItemAtIndex_4 = List.GetItemAtIndex(list=watch_4, index=code_block_4)

# group: Windows that dont have W and H parameters assigned
watch_6 = Watch(getItemAtIndex_4)

categories_2 = Categories("OST_Doors")  # frozen
all_elements_of_category_2 = ElementsOfCategory(Category=categories_2)
python_script_2 = Python(IN[0]=all_elements_of_category_2)
# ---------- python_script_2.python (37 lines) ----------
import clr

#import Revit Nodes
clr.AddReference("RevitNodes")
import Revit
clr.ImportExtensions(Revit.Elements)

#Import RevitAPI
clr.AddReference("RevitAPI")
import Autodesk
from Autodesk.Revit.DB import *

#Import DocumentManager and TransactionManager
clr.AddReference("RevitServices")
from RevitServices.Persistence import DocumentManager
from RevitServices.Transactions import TransactionManager

doorCat = UnwrapElement(IN[0])

naming = []
projDoors = []
notWHDoors = []
renamedList = []


#get the project document
doc = DocumentManager.Instance.CurrentDBDocument

#filter the doors 
collector = FilteredElementCollector(doc)
doors = collector.OfCategory(BuiltInCategory.OST_Doors).WhereElementIsElementType()
for x in collector:
	projDoors.append(x)



OUT = projDoors
# ----------------------------------------
code_block_5 = CodeBlock { 2; }
setName = Custom[Element.SetName]()  # package Clockwork for Dynamo 2.x; Gets the name of a given Revit element; unwired: element, name
string_from_object = FromObject()  # unwired: obj
string = StringInput("Concrete - Rectangular Beam")
byName = Family.ByName(name=string)
types = Family.Types(family=byName)
string_2 = StringInput("b")
getParameterValueByName = Element.GetParameterValueByName(element=types, parameterName=string_2)
string_3 = StringInput("h")
getParameterValueByName_2 = Element.GetParameterValueByName(element=types, parameterName=string_3)
python_script_3 = Python(IN[0]=getParameterValueByName, IN[1]=getParameterValueByName_2)
# ---------- python_script_3.python (20 lines) ----------
# Load the Python Standard and DesignScript Libraries
import sys
import clr
clr.AddReference('ProtoGeometry')
from Autodesk.DesignScript.Geometry import *

# The inputs to this node will be stored as a list in the IN variables.
b = IN[0]
d = IN[1]

renameList=[]
c=0
for x in b:
	renameList.append("W" + str(int(x))+" "+ "H" +str(int(d[c])))
	c=c+1

# Place your code below this line

# Assign your output to the OUT variable.
OUT = renameList
# ----------------------------------------
setName_2 = Custom[Element.SetName](element=types, name=python_script_3)
watch_7 = Watch(setName_2.element)
watch_8 = Watch(setName_2.success)
