# Dynamo graph RenameTiles2019.dyn (Dynamo 1.3.4.6666)

string = StringInput("POINT2_Wall_Tile_01")
byName = Family.ByName(string)
types = Family.Types(byName)
string_2 = StringInput("Width")
getParameterValueByName = Element.GetParameterValueByName(element=types, parameterName=string_2)
round = Math.Round(getParameterValueByName)
string_3 = StringInput("Height")
getParameterValueByName_2 = Element.GetParameterValueByName(element=types, parameterName=string_3)
round_2 = Math.Round(getParameterValueByName_2)
string_4 = StringInput("Depth")
getParameterValueByName_3 = Element.GetParameterValueByName(element=types, parameterName=string_4)
python_script = Python(IN[0]=round, IN[1]=round_2, IN[2]=getParameterValueByName_3)
# ---------- python_script.python (14 lines) ----------
import clr
clr.AddReference('ProtoGeometry')
from Autodesk.DesignScript.Geometry import *
#The inputs to this node will be stored as a list in the IN variables.
Width = IN[0]
Height =IN[1]
Depth =IN[2]

Nameing=[]

for counter, W in enumerate(Width):
	Nameing.append(str(int(W))+"x"+str(int(Height[counter]))+"x"+str(int(Depth[counter])))
#Assign your output to the OUT variable.
OUT = Nameing 
# ----------------------------------------
setName = Custom[Element.SetName](element=types, name=python_script)  # Gets the name of a given Revit element
