# Dynamo graph RenameWinDoor.dyn (Dynamo 2.3.1.11775)

doors = Categories("OST_Doors")
all_elements_of_category = ElementsOfCategory(Category=doors)
python_script = Python(IN[0]=all_elements_of_category)
# ---------- python_script.python (37 lines) ----------
import clr

#import Revit Nodes
clr.AddReference("RevitNodes")
import Revit
clr.ImportExtensions(Revit.Elements)

#Import RevitAPI
clr.AddReference("RevitAPI")
import Autodesk
from Autodesk.Revit.DB import *

#Import DocumentManager and TransactionManager
clr.AddReference("RevitServices")
from RevitServices.Persistence import DocumentManager
from RevitServices.Transactions import TransactionManager

doorCat = UnwrapElement(IN[0])

naming = []
projDoors = []
notWHDoors = []
renamedList = []


#get the project document
doc = DocumentManager.Instance.CurrentDBDocument

#filter the doors 
collector = FilteredElementCollector(doc)
doors = collector.OfCategory(BuiltInCategory.OST_Doors).WhereElementIsElementType()
for x in collector:
	projDoors.append(x)



OUT = projDoors
# ----------------------------------------
string = StringInput("Width")
getParameterValueByName = Element.GetParameterValueByName(element=python_script, parameterName=string)
string_2 = StringInput("Height")
getParameterValueByName_2 = Element.GetParameterValueByName(element=python_script, parameterName=string_2)
python_script_2 = Python(IN[0]=all_elements_of_category, IN[1]=getParameterValueByName, IN[2]=getParameterValueByName_2)
# ---------- python_script_2.python (83 lines) ----------
import clr

#import Revit Nodes
clr.AddReference("RevitNodes")
import Revit
clr.ImportExtensions(Revit.Elements)

#Import RevitAPI
clr.AddReference("RevitAPI")
import Autodesk
from Autodesk.Revit.DB import *

#Import DocumentManager and TransactionManager
clr.AddReference("RevitServices")
from RevitServices.Persistence import DocumentManager
from RevitServices.Transactions import TransactionManager

doorCat = UnwrapElement(IN[0])

naming = []
projDoors = []
notWHDoors = []
renamedList = []


#get the project document
doc = DocumentManager.Instance.CurrentDBDocument

#filter the doors 
collector = FilteredElementCollector(doc)
doors = collector.OfCategory(BuiltInCategory.OST_Doors).WhereElementIsElementType()

DoorW = IN[1]
DoorH = IN[2]

#Get all Parameters 

counter=0

for door in doors:
	if str(DoorW[counter]) == "":
		naming.append("Type1")
		counter += 1
	else:
		newName = (str(int(DoorW[counter]))+ "W" + " x "+ str(int(DoorH[counter])) + "H")
		naming.append(newName)
		counter += 1

	
	
for door in doors:
	projDoors.append(door)
	
count = 0	
for name in naming:
	if name == "0W x 0H" or "Type1":
		notWHDoors.append(projDoors[count])
		#naming.remove("0W x 0H")
		count += 1
		
	else:
		count += 1
		

for x in notWHDoors:
	del naming[projDoors.index(x)]
	projDoors.remove(x)
	
	
TransactionManager.Instance.EnsureInTransaction(doc)

count = 0
for door in projDoors:
	door.Name = naming[count]
	renamedList.append(door.ToDSType(True))
	count += 1



TransactionManager.Instance.TransactionTaskDone()


OUT = naming, notWHDoors, renamedList
# ----------------------------------------
watch = Watch(python_script_2)
code_block = CodeBlock { 1; }
getItemAtIndex = List.GetItemAtIndex(list=watch, index=code_block)

# group: Doors that dont have W and H parameters assigned
watch_2 = Watch(getItemAtIndex)

code_block_2 = CodeBlock { 2; }
getItemAtIndex_2 = List.GetItemAtIndex(list=watch, index=code_block_2)

# group: Sucessfuly named doors
watch_3 = Watch(getItemAtIndex_2)

windows = Categories("OST_Windows")
all_elements_of_category_2 = ElementsOfCategory(Category=windows)
python_script_3 = Python(IN[0]=all_elements_of_category_2)  # same code as python_script
string_3 = StringInput("Width")
getParameterValueByName_3 = Element.GetParameterValueByName(element=python_script_3, parameterName=string_3)
string_4 = StringInput("Height")
getParameterValueByName_4 = Element.GetParameterValueByName(element=python_script_3, parameterName=string_4)
python_script_4 = Python(IN[0]=all_elements_of_category_2, IN[1]=getParameterValueByName_3, IN[2]=getParameterValueByName_4)
# ---------- python_script_4.python (83 lines) ----------
import clr

#import Revit Nodes
clr.AddReference("RevitNodes")
import Revit
clr.ImportExtensions(Revit.Elements)

#Import RevitAPI
clr.AddReference("RevitAPI")
import Autodesk
from Autodesk.Revit.DB import *

#Import DocumentManager and TransactionManager
clr.AddReference("RevitServices")
from RevitServices.Persistence import DocumentManager
from RevitServices.Transactions import TransactionManager

doorCat = UnwrapElement(IN[0])

naming = []
projDoors = []
notWHDoors = []
renamedList = []


#get the project document
doc = DocumentManager.Instance.CurrentDBDocument

#filter the doors 
collector = FilteredElementCollector(doc)
doors = collector.OfCategory(BuiltInCategory.OST_Windows).WhereElementIsElementType()

DoorW = IN[1]
DoorH = IN[2]

#Get all Parameters 

counter=0

for door in doors:
	if str(DoorW[counter]) == "":
		naming.append("Type1")
		counter += 1
	else:
		newName = (str(int(DoorW[counter]))+ "W" + " x "+ str(int(DoorH[counter])) + "H")
		naming.append(newName)
		counter += 1

	
	
for door in doors:
	projDoors.append(door)
	
count = 0	
for name in naming:
	if name == "0W x 0H" or "Type1":
		notWHDoors.append(projDoors[count])
		#naming.remove("0W x 0H")
		count += 1
		
	else:
		count += 1
		

for x in notWHDoors:
	del naming[projDoors.index(x)]
	projDoors.remove(x)
	
	
TransactionManager.Instance.EnsureInTransaction(doc)

count = 0
for door in projDoors:
	door.Name = naming[count]
	renamedList.append(door.ToDSType(True))
	count += 1



TransactionManager.Instance.TransactionTaskDone()


OUT = naming, notWHDoors, renamedList
# ----------------------------------------
watch_4 = Watch(python_script_4)
code_block_3 = CodeBlock { 1; }
getItemAtIndex_3 = List.GetItemAtIndex(list=watch_4, index=code_block_3)

# group: Windows that dont have W and H parameters assigned
watch_5 = Watch(getItemAtIndex_3)

code_block_4 = CodeBlock { 2; }
getItemAtIndex_4 = List.GetItemAtIndex(list=watch_4, index=code_block_4)

# group: Sucessfuly named Windows
watch_6 = Watch(getItemAtIndex_4)
