# Dynamo graph SectionCreatorOnLines.dyn (Dynamo 2.0.2.6826)

select_model_elements = DSModelElementsSelection()  # 63 picked in the model
code_block = CodeBlock { 1000; }
code_block_2 = CodeBlock { -1000; }
revit_section_view_at_line = Custom[Revit Section View at Line](revitLines=select_model_elements, ViewDepth=code_block, ViewHeight=code_block_2)
string = StringInput("View Name")
python_script = Python(IN[0]=revit_section_view_at_line)
# ---------- python_script.python (16 lines) ----------
# Enable Python support and load DesignScript library
import clr
clr.AddReference('ProtoGeometry')
from Autodesk.DesignScript.Geometry import *

# The inputs to this node will be stored as a list in the IN variables.
dataEnteringNode = IN[0]

nameList=[]
for count, value in enumerate(dataEnteringNode):
	nameList.append("POINT2_Section_Level02 " + str(count))

# Place your code below this line

# Assign your output to the OUT variable.
OUT = nameList
# ----------------------------------------
setParameterByName = Element.SetParameterByName(element=revit_section_view_at_line, parameterName=string, value=python_script)
