# Dynamo graph SetPointsOnDetailLine.dyn (Dynamo 2.0.2.6826)

family_types = FamilyTypes(index=263)
select_model_elements = DSModelElementsSelection()  # 19 picked in the model
curves = Element.Curves(element=select_model_elements)
flatten = List.Flatten(list=curves)
python_script = Python(IN[0]=flatten)
# ---------- python_script.python (44 lines) ----------
import clr

clr.AddReference('RevitAPI')
from Autodesk.Revit.DB import *
from Autodesk.Revit.DB.Structure import *

clr.AddReference('RevitNodes')
import Revit
clr.ImportExtensions(Revit.GeometryConversion)
clr.ImportExtensions(Revit.Elements)

clr.AddReference('RevitServices')
import RevitServices
from RevitServices.Persistence import DocumentManager
from RevitServices.Transactions import TransactionManager

doc = DocumentManager.Instance.CurrentDBDocument
uidoc=DocumentManager.Instance.CurrentUIApplication.ActiveUIDocument


dataEnteringNode =(IN[0])
plist=[]

c = 0

for x in dataEnteringNode:
	if x == dataEnteringNode[0]:
		
		line = x.Join(dataEnteringNode[c+1])

		c = c+1
	elif x == dataEnteringNode[-1]:
		pass
	else:
		line = line.Join(dataEnteringNode[c+1])
		c = c+1
	

	

# Place your code below this line

# Assign your output to the OUT variable.
OUT = line
# ----------------------------------------
code_block = CodeBlock { 50; }
boolean = BoolSelector(false)
offset = PolyCurve.Offset(polyCurve=python_script, signedDistance=code_block, extendCircular=boolean)
length = Curve.Length(curve=offset)
python_script_2 = Python(IN[0]=length)
# ---------- python_script_2.python (24 lines) ----------
# Enable Python support and load DesignScript library
import clr
clr.AddReference('ProtoGeometry')
from Autodesk.DesignScript.Geometry import *

# The inputs to this node will be stored as a list in the IN variables.
dataEnteringNode = IN[0]

newList = []
rem = dataEnteringNode % 2000
splits = (dataEnteringNode-rem) / 2000

for x in range(int(splits)):
	
	newList.append(x*2000)


newList.append(dataEnteringNode)
	

# Place your code below this line

# Assign your output to the OUT variable.
OUT = newList
# ----------------------------------------
pointAtSegmentLength = Curve.PointAtSegmentLength(curve=offset, segmentLength=python_script_2)
removeNulls = Lists.Manage.RemoveNulls(Data=pointAtSegmentLength)
code_block_2 = CodeBlock { -50; }
boolean_2 = BoolSelector(false)
offset_2 = PolyCurve.Offset(polyCurve=python_script, signedDistance=code_block_2, extendCircular=boolean_2)
length_2 = Curve.Length(curve=offset_2)
python_script_3 = Python(IN[0]=length_2)  # same code as python_script_2
pointAtSegmentLength_2 = Curve.PointAtSegmentLength(curve=offset_2, segmentLength=python_script_3)
removeNulls_2 = Lists.Manage.RemoveNulls(Data=pointAtSegmentLength_2)
list_create = List.Create(item0=removeNulls.Cleaned, item1=removeNulls_2.Cleaned)
flatten_2 = List.Flatten(list=list_create)
byPoint = FamilyInstance.ByPoint(familyType=family_types, point=flatten_2)
watch = Watch(byPoint)
