# Dynamo graph Split_surfaces.dyn (Dynamo 2.0.2.6826)

select_model_elements = DSModelElementsSelection()  # 57 picked in the model
geometry = Element.Geometry(element=select_model_elements)
bySolid = PolySurface.BySolid(solid=geometry)
surfaces = PolySurface.Surfaces(polySurface=bySolid)
