# Dynamo graph StructuralElementReferenceLevels.dyn (Dynamo 2.3.0.5885)

# group: Structural Columns
categories = Categories("OST_StructuralColumns")

all_elements_of_category = ElementsOfCategory(Category=categories)
python_script = Python(IN[0]=all_elements_of_category)
# ---------- python_script.python (19 lines) ----------
# Load the Python Standard and DesignScript Libraries
import sys
import clr
clr.AddReference('ProtoGeometry')
from Autodesk.DesignScript.Geometry import *

# The inputs to this node will be stored as a list in the IN variables.
dataEnteringNode = IN[0]
outList=[]
for x in dataEnteringNode:
	outList.append(str(x.GetParameterValueByName("Level")).split("=")[1].split(",")[0])

#for x in dataEnteringNode:
	

# Place your code below this line

# Assign your output to the OUT variable.
OUT = outList
# ----------------------------------------

# group: Structural Framing
categories_2 = Categories("OST_StructuralFraming")

all_elements_of_category_2 = ElementsOfCategory(Category=categories_2)
python_script_2 = Python(IN[0]=all_elements_of_category_2)
# ---------- python_script_2.python (24 lines) ----------
# Load the Python Standard and DesignScript Libraries
import sys
import clr
clr.AddReference('ProtoGeometry')
from Autodesk.DesignScript.Geometry import *

# The inputs to this node will be stored as a list in the IN variables.
dataEnteringNode = IN[0]
outList=[]

for x in dataEnteringNode:
	if len(str(x.GetParameterValueByName("Reference Level"))) != 0:
		outList.append(str(x.GetParameterValueByName("Reference Level")).split("=")[1].split(",")[0])
	else:
		outList.append(str(x.GetParameterValueByName("Level")).split("=")[1].split(",")[0])
		

#for x in dataEnteringNode:
	

# Place your code below this line

# Assign your output to the OUT variable.
OUT = outList
# ----------------------------------------
list_create = List.Create(item0=python_script, item1=python_script_2)
flatten = List.Flatten(list=list_create)
uniqueItems = List.UniqueItems(list=flatten)
sort = List.Sort(list=uniqueItems)
count = List.Count(list=sort)
code_block = CodeBlock { -1; }
sub = count - code_block
list_create_2 = List.Create(item0=all_elements_of_category, item1=all_elements_of_category_2)
flatten_2 = List.Flatten(list=list_create_2)
integer_slider = IntegerSlider(255, range=0..255 step 1)
byARGB = Color.ByARGB(r=integer_slider)
byARGB_2 = Color.ByARGB(g=integer_slider)
byARGB_3 = Color.ByARGB(b=integer_slider)
list_create_3 = List.Create(item0=byARGB, item1=byARGB_2, item2=byARGB_3)
indexOf = List.IndexOf(list=sort, element=flatten)
code_block_2 = CodeBlock { 0; }
code_block_3 = CodeBlock { 1; }
remapRange = Math.RemapRange(numbers=indexOf, newMin=code_block_2, newMax=code_block_3)
color_range = ColorRange(colors=list_create_3, value=remapRange)  # unwired: indices
overrideColorInView = Element.OverrideColorInView(element=flatten_2, color=color_range)
uniqueItems_2 = List.UniqueItems(list=remapRange)
sortIndexByValue = List.SortIndexByValue(list=uniqueItems_2)
