# Dynamo graph TRUEVIEW_STATIONS.dyn (Dynamo 2.3.1.11775)
# packages: SteamNodes 1.2.4

# group: XML
file_path = Filename("C:\Users\krist\Downloads\SWLocation NEW.xml")

readText = FileSystem.ReadText(file=file_path)
string_from_object = FromObject(obj=readText)

# group: TXT
file_path_2 = Filename("C:\Users\krist\Downloads\GLOBAL_B1_INFO SUPERNEW.txt")

readText_2 = FileSystem.ReadText(file=file_path_2)
string_from_object_2 = FromObject(obj=readText_2)
python_script = Python(IN[0]=string_from_object, IN[1]=string_from_object_2)
# ---------- python_script.python (46 lines) ----------
# Load the Python Standard and DesignScript Libraries
import sys
import clr
clr.AddReference('ProtoGeometry')
from Autodesk.DesignScript.Geometry import *

# The inputs to this node will be stored as a list in the IN variables.
dataEnteringNode = UnwrapElement(IN[0])
splitUpList = dataEnteringNode.split("<ScanWorld")[1:-1]

cleanList=[]
for x in splitUpList:	
	newList = x.split("\"")[1:-1]
	cleanSubList=[newList[0], newList[-1][1:-1]]
	cleanList.append(cleanSubList)

realLocations = UnwrapElement(IN[1])

realLocSplitUpList = realLocations.split("Imported by")[1].split("Setup ")[1:-1]

txtList=[]
for y in realLocSplitUpList:
	newList2 = y.split("	")[1:-1]
	http = newList2[1].split("Position")[0].split("<")[1].strip()[:-1].split("/info")
	cleanTxtList=[newList2[0].split("Unique Identifier")[0].strip(),(http[0]+http[1])]
	txtList.append(cleanTxtList)
	
newDictList={}
for y in txtList:
    newDictList[y[0]]={"Http":y[1]}
	# new_dict = {"Name": y[0], "Http":y[1] }
	# newDictList.append(new_dict)
	

for d in cleanList:
    if d[0] in newDictList.keys():
        newDictList[d[0]]['XYZ']=d[1]
        
for key in newDictList.keys():
	item = newDictList[key]
	
	if "XYZ" not in item.keys() or "Http" not in item.keys():
		del newDictList[key]
	
# Assign your output to the OUT variable.
OUT =  newDictList #txtList, cleanList
# ----------------------------------------
keys = DesignScript.Builtin.Dictionary.Keys(dictionary=python_script)
valueAtKey = DesignScript.Builtin.Dictionary.ValueAtKey(dictionary=python_script, key=keys)
string = StringInput("XYZ")
valueAtKey_2 = DesignScript.Builtin.Dictionary.ValueAtKey(dictionary=valueAtKey, key=string)
python_script_2 = Python(IN[0]=valueAtKey_2)
# ---------- python_script_2.python (20 lines) ----------
# Load the Python Standard and DesignScript Libraries
import sys
import clr
clr.AddReference('ProtoGeometry')
from Autodesk.DesignScript.Geometry import *

# The inputs to this node will be stored as a list in the IN variables.
dataEnteringNode = IN[0]
X=[]
Y=[]
Z=[]
for x in dataEnteringNode:
	splitList = x.split(",")
	X.append(float(splitList[0].strip())*1000)
	Y.append(float(splitList[1].strip())*1000)
	Z.append(float(splitList[2].strip())*1000)
# Place your code below this line

# Assign your output to the OUT variable.
OUT = X, Y, Z
# ----------------------------------------
code_block = CodeBlock(x=python_script_2) { x[0]; x[1]; x[2]; }

# group: Basepoint / Survey Point Values
element_types = ElementTypes("BasePoint")  # graph input
all_elements_of_type = ElementsOfType(element_type=element_types)
parameters = Element.Parameters(element=all_elements_of_type)
watch = Watch(parameters)

# group: Calculate the project basepoint value is in relation to the origin.
string_2 = StringInput("E/W")  # graph input
filterByString = Custom[List.FilterByString](list=watch, string_2)  # package SteamNodes; Filter a list by a string match
watch_2 = Watch(filterByString.Match)
number = DoubleInput(1)  # graph input
getItemAtIndex = List.GetItemAtIndex(list=watch_2, index=number)
value = Parameter.Value(parameter=getItemAtIndex)
watch_3 = Watch(value)
string_3 = StringInput("N/S")  # graph input
filterByString_2 = Custom[List.FilterByString](list=watch, string_3)
watch_4 = Watch(filterByString_2.Match)
number_2 = DoubleInput(1)  # graph input
getItemAtIndex_2 = List.GetItemAtIndex(list=watch_4, index=number_2)
value_2 = Parameter.Value(parameter=getItemAtIndex_2)
watch_5 = Watch(value_2)
number_3 = DoubleInput(0)  # graph input
getItemAtIndex_3 = List.GetItemAtIndex(list=watch_4, index=number_3)
value_3 = Parameter.Value(parameter=getItemAtIndex_3)
watch_6 = Watch(value_3)
number_4 = DoubleInput(0)  # graph input
getItemAtIndex_4 = List.GetItemAtIndex(list=watch_2, index=number_4)
value_4 = Parameter.Value(parameter=getItemAtIndex_4)
watch_7 = Watch(value_4)
e_w_transpose = value_4 - value
e_w_origin = Watch(e_w_transpose)
n_s_transpose = value_3 - value_2
n_s_origin = Watch(n_s_transpose)

# group: Transpose Calculation
X = CodeBlock(EXCEL_EASTING=code_block.out0, EASTING=watch_3) { EXCEL_EASTING-EASTING; }
Y = CodeBlock(EXCEL_EASTING=code_block.out1, NORTHING=watch_5) { EXCEL_EASTING-NORTHING; }

# group: Place the family
family_types = FamilyTypes("G-Pr_60_75_86_80-POINT2-ScanStation-Bubble:G-Pr_60_75_86_80-POINT2-ScanStation-Bubble")  # graph input
x_coordinate = Watch(X)
y_coordinate = Watch(Y)
levels = Levels("POINT2-01-ZZ-M3-G-DATUM")  # graph input

# group: Project North - Rotation
projectRotation = Coordinates.ProjectRotation()
watch_8 = Watch(projectRotation)
cos_theta = Math.Cos(angle=watch_8)
x_cos = CodeBlock(X=x_coordinate, COS=cos_theta) { X*COS; }
watch_9 = Watch(x_cos)
sin_theta = Math.Sin(angle=watch_8)
y_sin = CodeBlock(Y=y_coordinate, SIN=sin_theta) { Y*SIN; }
watch_10 = Watch(y_sin)
x_cos_y_sin = CodeBlock(xcos=watch_9, ysin=watch_10) { xcos-ysin; }
watch_11 = Watch(x_cos_y_sin)
x_coordinate_2 = Watch(watch_11)
x_sin = CodeBlock(X=x_coordinate, SIN=sin_theta) { X*SIN; }
watch_12 = Watch(x_sin)
y_cos = CodeBlock(Y=y_coordinate, COS=cos_theta) { Y*COS; }
watch_13 = Watch(y_cos)
x_sin_y_cos = CodeBlock(xsin=watch_12, ycos=watch_13) { xsin+ycos; }
watch_14 = Watch(x_sin_y_cos)
y_coordinate_2 = Watch(watch_14)

# group (continued): Place the family
byCoordinates = Point.ByCoordinates(x=x_coordinate_2, y=y_coordinate_2, z=code_block.out2)
watch_15 = Watch(byCoordinates)
byPointAndLevel = FamilyInstance.ByPointAndLevel(familyType=family_types, point=watch_15, level=levels)

# group: To rotate family to True North
code_block_2 = CodeBlock(ROTATION=projectRotation) { 360-ROTATION; }
setRotation = FamilyInstance.SetRotation(familyInstance=byPointAndLevel, degree=code_block_2)

watch_16 = Watch(setRotation)
string_4 = StringInput("360Photo")
string_5 = StringInput("Http")
valueAtKey_3 = DesignScript.Builtin.Dictionary.ValueAtKey(dictionary=valueAtKey, key=string_5)
setParameterByName = Element.SetParameterByName(element=setRotation, parameterName=string_4, value=valueAtKey_3)
string_6 = StringInput("StationRef")
setParameterByName_2 = Element.SetParameterByName(element=setRotation, parameterName=string_6, value=keys)
string_7 = StringInput("X")
watch_17 = Watch(code_block.out0)
setParameterByName_3 = Element.SetParameterByName(element=setRotation, parameterName=string_7, value=watch_17)
string_8 = StringInput("Y")
watch_18 = Watch(code_block.out1)
setParameterByName_4 = Element.SetParameterByName(element=setRotation, parameterName=string_8, value=watch_18)
string_9 = StringInput("Z")
watch_19 = Watch(code_block.out2)
setParameterByName_5 = Element.SetParameterByName(element=setRotation, parameterName=string_9, value=watch_19)
python_script_3 = Python(IN[0]=string_from_object)
# ---------- python_script_3.python (17 lines) ----------
# Load the Python Standard and DesignScript Libraries
import sys
import clr
clr.AddReference('ProtoGeometry')
from Autodesk.DesignScript.Geometry import *

# The inputs to this node will be stored as a list in the IN variables.
dataEnteringNode = UnwrapElement(IN[0])
splitUpList = dataEnteringNode.split("<ScanWorld")[1:-1]

cleanList=[]
for x in splitUpList:	
	newList = x.split("\"")[3:-1]
	cleanSubList=[newList[0], newList[-1][1:-1]]
	cleanList.append(cleanSubList)
	
OUT= newList, cleanList
# ----------------------------------------
string_from_object_3 = FromObject(obj=valueAtKey_2)
string_10 = StringInput("null")
countOccurrences = String.CountOccurrences(str=string_from_object_3, searchFor=string_10)
string_11 = StringInput("")
python_script_4 = Python()  # unwired: IN[0]; starter script, not edited (OUT = 0)
