# Dynamo graph TimberSizes.dyn (Dynamo 2.0.2.6826)

file_path = Filename(".\Mullions.xlsx")
string = StringInput("Sheet1")
code_block = CodeBlock { 0; }
categories = Categories(index=535)
all_elements_of_category = ElementsOfCategory(Category=categories)
string_2 = StringInput("Dimension Lumber")
filter_elements_by_family_name = Custom[Filter Elements by Family Name](elementList=all_elements_of_category, familyNameString=string_2)
type = archilab.Revit.Elements.Elements.Type(element=filter_elements_by_family_name)
uniqueItems = List.UniqueItems(list=type)
sort = List.Sort(list=uniqueItems)
name = FamilyType.Name(familyType=sort)
string_3 = StringInput("b")
parameterByName = Parameter.ParameterByName(element=sort, name=string_3)
watch = Watch(parameterByName)
string_from_object = FromObject(obj=watch)
string_4 = StringInput(" : ")
split = String.Split(str=string_from_object, separater0=string_4)
flatten = List.Flatten(list=split)
code_block_2 = CodeBlock { 2; }
takeEveryNthItem = List.TakeEveryNthItem(list=flatten, n=code_block_2)
string_5 = StringInput("d")
parameterByName_2 = Parameter.ParameterByName(element=sort, name=string_5)
watch_2 = Watch(parameterByName_2)
string_from_object_2 = FromObject(obj=watch_2)
string_6 = StringInput(" : ")
split_2 = String.Split(str=string_from_object_2, separater0=string_6)
flatten_2 = List.Flatten(list=split_2)
code_block_3 = CodeBlock { 2; }
takeEveryNthItem_2 = List.TakeEveryNthItem(list=flatten_2, n=code_block_3)
list_create = List.Create(item0=name, item1=takeEveryNthItem, item2=takeEveryNthItem_2)
transpose = List.Transpose(lists=list_create)
boolean = BoolSelector(true)
exportExcel = Data.ExportExcel(filePath=file_path, sheetName=string, startRow=code_block, startCol=code_block, data=transpose, overWrite=boolean)
