# Dynamo graph TitleSheetFillIn2022.dyn (Dynamo 2.10.1.3976)
# packages: archi-lab.net 2020.22.9

byElementId = archilab.Revit.Selection.Select.ByElementId()  # unwired: id
python_script = Python()  # CPython3; unwired: IN[0]
# ---------- python_script.python (14 lines) ----------
import clr
clr.AddReference("RevitServices")
import RevitServices
from RevitServices.Persistence import DocumentManager

doc = DocumentManager.Instance.CurrentDBDocument

elList=[]
projectInfo = doc.ProjectInformation

# Place your code below this line

# Assign your output to the OUT variable.
OUT = (projectInfo)
# ----------------------------------------
file_path = Filename("C:\Users\krist\Desktop\16CS-REVIT-INFO_AMENDED.xlsx")
file_from_path = FileObject(path=file_path)
# note: SURVEY-PROJECTBASEPOINT
# SURVEY-SURVEYBASEPOINT
# ROTATION??
# TAKE THESE FROM PROJECT
string = StringInput("Sheet1")
importExcel = Data.ImportExcel(file=file_from_path, sheetName=string)
transpose = List.Transpose(lists=importExcel)
code_block = CodeBlock { 1; 3; }
getItemAtIndex = List.GetItemAtIndex(list=transpose, index=code_block.out0)
element_by_id = ElementById(Id=getItemAtIndex)
string_from_object = FromObject(obj=element_by_id)
string_2 = StringInput("null")
eq = string_from_object == string_2
filterByBoolMask = List.FilterByBoolMask(list=getItemAtIndex, mask=eq)
watch = Watch(filterByBoolMask.in)
string_from_object_2 = FromObject(obj=watch)
eq_2 = string_from_object_2 == string_2
filterByBoolMask_2 = List.FilterByBoolMask(list=watch, mask=eq_2)
watch_2 = Watch(filterByBoolMask_2.out)
getItemAtIndex_2 = List.GetItemAtIndex(list=transpose, index=code_block.out1)
indexOf = List.IndexOf(list=getItemAtIndex, element=watch_2)
getItemAtIndex_3 = List.GetItemAtIndex(list=getItemAtIndex_2, index=indexOf)
string_from_object_3 = FromObject(obj=getItemAtIndex_3)
setParameterByName = Element.SetParameterByName(element=python_script, parameterName=watch_2, value=string_from_object_3)
element_by_id_2 = ElementById(Id=getItemAtIndex)
# note: LOD id's are the same thats
watch_3 = Watch(filterByBoolMask.out)
indexOf_2 = List.IndexOf(list=getItemAtIndex, element=watch_3)
code_block_2 = CodeBlock { 3; 4; }
code_block_3 = CodeBlock { 26; 27; }
replaceItemAtIndex = List.ReplaceItemAtIndex(list=indexOf_2, index=code_block_2.out0, item=code_block_3.out0)
replaceItemAtIndex_2 = List.ReplaceItemAtIndex(list=replaceItemAtIndex, index=code_block_2.out1, item=code_block_3.out1)
getItemAtIndex_4 = List.GetItemAtIndex(list=getItemAtIndex_2, index=replaceItemAtIndex_2)
python_script_2 = Python(IN[0]=element_by_id_2, IN[1]=getItemAtIndex_4)  # CPython3
# ---------- python_script_2.python (22 lines) ----------
# Load the Python Standard and DesignScript Libraries
import sys
import clr
clr.AddReference('ProtoGeometry')
from Autodesk.DesignScript.Geometry import *

# The inputs to this node will be stored as a list in the IN variables.
dataEnteringNode = IN[0]
intInput=IN[1]
newList=[]
for x in intInput:
    if str(x) == "null":
        newList.append("1")
    else:
        newList.append(x)

inputString = (str(int(newList[2]))+" ") + (str(newList[3])+" ") + (str(newList[4])+" ")




OUT = "Smoke Weed Everyday", (dataEnteringNode[0].SetText(str(newList[0]))), (dataEnteringNode[1].SetText(str(newList[1]))), (dataEnteringNode[2].SetText(str(inputString)))
# ----------------------------------------
code_block_4 = CodeBlock { 5; }
getItemAtIndex_5 = List.GetItemAtIndex(list=element_by_id_2, index=code_block_4)
parameters = Element.Parameters(element=getItemAtIndex_5)
getItemAtIndex_6 = List.GetItemAtIndex(list=getItemAtIndex_4, index=code_block_4)
python_script_3 = Python(IN[0]=getItemAtIndex_5, IN[1]=getItemAtIndex_6)  # IronPython2
# ---------- python_script_3.python (21 lines) ----------
# Load the Python Standard and DesignScript Libraries
import sys
import clr
clr.AddReference('ProtoGeometry')
from Autodesk.DesignScript.Geometry import *

# The inputs to this node will be stored as a list in the IN variables.
element = IN[0]
string = IN[1]

if string == "15MM":
	val=[1,0,0]
elif string == "30MM":
	val=[0,1,0]
elif string == "60MM":
	val=[0,0,1]

# Place your code below this line
par=["15mmTolerance","30mmTolerance","60mmTolerance"]
# Assign your output to the OUT variable.
OUT = par, val
# ----------------------------------------
code_block_5 = CodeBlock { 0; 1; }
getItemAtIndex_7 = List.GetItemAtIndex(list=python_script_3, index=code_block_5.out0)
getItemAtIndex_8 = List.GetItemAtIndex(list=python_script_3, index=code_block_5.out1)
setParameterByName_2 = Element.SetParameterByName(element=getItemAtIndex_5, parameterName=getItemAtIndex_7, value=getItemAtIndex_8)
