# Dynamo graph TopoPointsToRevit_-JS-WITH_ROTATION2022.dyn (Dynamo 2.12.0.5650)

file_path = Filename("C:\Users\krist\Documents\PointCloudExample\2.txt")
readText = FileSystem.ReadText(file=file_path)
python_script = Python(IN[0]=readText)  # IronPython2
# ---------- python_script.python (32 lines) ----------
# Load the Python Standard and DesignScript Libraries
import sys
import clr
clr.AddReference('ProtoGeometry')
from Autodesk.DesignScript.Geometry import *

# The inputs to this node will be stored as a list in the IN variables.
dataEnteringNode = IN[0].split('\n')

x=[]
y=[]
z=[]


for row in dataEnteringNode:
	if len(row) > 0:
		

		points=row.strip().split(" ")
		x.append(float(points[0])*1000)
		y.append(float(points[1])*1000)
		z.append(float(points[2])*1000)
		
	else:
		pass

	

# Place your code below this line

# Assign your output to the OUT variable.
OUT = x, y, z
# ----------------------------------------
code_block = CodeBlock { 0; }
getItemAtIndex = List.GetItemAtIndex(list=python_script, index=code_block)

# group: Basepoint / Survey Point Values
element_types = ElementTypes("BasePoint")  # graph input
all_elements_of_type = ElementsOfType(element_type=element_types)
parameters = Element.Parameters(element=all_elements_of_type)
watch = Watch(parameters)

number = DoubleInput(1)
getItemAtIndex_2 = List.GetItemAtIndex(list=watch, index=number)
number_2 = DoubleInput(4)
getItemAtIndex_3 = List.GetItemAtIndex(list=getItemAtIndex_2@L2, index=number_2)
string_from_object = FromObject(obj=getItemAtIndex_3)
number_3 = DoubleInput(0)
number_4 = DoubleInput(6)
remove = String.Remove(string=string_from_object, startIndex=number_3, count=number_4)
toNumber = String.ToNumber(string=remove)
sub = getItemAtIndex - toNumber  # lacing=Longest
code_block_2 = CodeBlock { 1; }
getItemAtIndex_4 = List.GetItemAtIndex(list=python_script, index=code_block_2)
number_5 = DoubleInput(8)
getItemAtIndex_5 = List.GetItemAtIndex(list=getItemAtIndex_2@L2, index=number_5)
string_from_object_2 = FromObject(obj=getItemAtIndex_5)
remove_2 = String.Remove(string=string_from_object_2, startIndex=number_3, count=number_4)
toNumber_2 = String.ToNumber(string=remove_2)
sub_2 = getItemAtIndex_4 - toNumber_2  # lacing=Longest

# group: Project North - Rotation
projectRotation = Coordinates.ProjectRotation()
watch_2 = Watch(projectRotation)
cos_theta = Math.Cos(angle=watch_2)
x_cos = CodeBlock(X=sub, COS=cos_theta) { X*COS; }
watch_3 = Watch(x_cos)
sin_theta = Math.Sin(angle=watch_2)
y_sin = CodeBlock(Y=sub_2, SIN=sin_theta) { Y*SIN; }
watch_4 = Watch(y_sin)
x_cos_y_sin = CodeBlock(xcos=watch_3, ysin=watch_4) { xcos-ysin; }
watch_5 = Watch(x_cos_y_sin)
x_coordinate = Watch(watch_5)
x_sin = CodeBlock(X=sub, SIN=sin_theta) { X*SIN; }
watch_6 = Watch(x_sin)
y_cos = CodeBlock(Y=sub_2, COS=cos_theta) { Y*COS; }
watch_7 = Watch(y_cos)
x_sin_y_cos = CodeBlock(xsin=watch_6, ycos=watch_7) { xsin+ycos; }
watch_8 = Watch(x_sin_y_cos)
y_coordinate = Watch(watch_8)

code_block_3 = CodeBlock { 2; }
getItemAtIndex_6 = List.GetItemAtIndex(list=python_script, index=code_block_3)
byCoordinates = Point.ByCoordinates(x=x_coordinate, y=y_coordinate, z=getItemAtIndex_6)
byPoints = Topography.ByPoints(points=byCoordinates)

# group: Change coordinates
# note: Index[0]- Shared Coordinates
# Index[1]- Project Coordinates
# Index[2]- Relative Coordinates
python_script_2 = Python()  # IronPython2; frozen; unwired: IN[0]
# ---------- python_script_2.python (81 lines) ----------
import clr
import math
clr.AddReference('ProtoGeometry')
from Autodesk.DesignScript import Geometry as geom
clr.AddReference("RevitServices")
import RevitServices 
from RevitServices.Persistence import DocumentManager
doc = DocumentManager.Instance.CurrentDBDocument
clr.AddReference("RevitNodes")
import Revit
clr.ImportExtensions(Revit.Elements)
clr.ImportExtensions(Revit.GeometryConversion)
clr.AddReference("RevitAPI")
from Autodesk.Revit.DB import *
 
# Create a list object from singleton...
def tolist(obj1):
	if hasattr(obj1,"__iter__"): return obj1
	else: return [obj1]
	
################# Definitions ###################
# Convert Point from Relative to Shared Coordinates...
def ToSharedCoordinates(pt,iop,pbp,rot):
	# First we need to translate the point by adding the Internal Origin to the Point we're converting...
	pt = geom.Point.ByCoordinates(pt.X+iop.X, pt.Y+iop.Y, pt.Z+iop.Z)
	# Then we need to rotate this point about the Internal Origin in the opposite direction as the Project Rotation...
	pt = geom.Geometry.Rotate(pt,iop,geom.Vector.ZAxis(),rot*-1)
	return pt

# Convert Point from Relative to Project Coordinates...
def ToProjectCoordinates(pt,iop,pbp,rot):
	# First we need to Rotate the Project Base Point about the Internal Origin Point by the Project Rotation...
	pbp = geom.Geometry.Rotate(pbp,iop,geom.Vector.ZAxis(),rot)
	# Then we need to Translate the point we're converting by subtracting the Project Base Point and then adding the Internal Origin Point...
	pt = geom.Point.ByCoordinates(pt.X-pbp.X+iop.X,pt.Y-pbp.Y+iop.Y,pt.Z-pbp.Z+iop.Z)
	return pt

################# Variables ###################
# Input Variables...
pts = tolist(IN[0])
 
# Internal Variables...
pbp = None
iop = None
rot = 0
# Conversion to mm...
ft2mm = 304.8
 
# Output Variables...
shared = []
project = []
relative = []

################# Main ###################
# Collect Project Basepoint...
basePt = FilteredElementCollector(doc).OfCategory(BuiltInCategory.OST_ProjectBasePoint).ToElements()
 
# Convert Project Basepoint (pbp) to DS Point...
for e in basePt:
	# Get Project Base Points Parameter Values...
	ew = e.get_Parameter(BuiltInParameter.BASEPOINT_EASTWEST_PARAM).AsDouble()*ft2mm
	ns = e.get_Parameter(BuiltInParameter.BASEPOINT_NORTHSOUTH_PARAM).AsDouble()*ft2mm
	ele = e.get_Parameter(BuiltInParameter.BASEPOINT_ELEVATION_PARAM).AsDouble()*ft2mm
	rot = e.get_Parameter(BuiltInParameter.BASEPOINT_ANGLETON_PARAM).AsDouble()*180/math.pi    
	# Create Point from Project Base Point Values...
	pbp = geom.Point.ByCoordinates(ew,ns,ele)

# Convert Internal Origin Point (iop) as DS Point...
projPos = doc.ActiveProjectLocation.GetProjectPosition (XYZ(0,0,0))
iop = geom.Point.ByCoordinates(projPos.EastWest*ft2mm,projPos.NorthSouth*ft2mm,0)
 
# Transform Input points to Shared/Project Coordinate System...
for pt in pts:
# Convert point to Shared Coordinates...
	shared.append(ToSharedCoordinates(pt,iop,pbp,rot))
	# Convert point to Project Coordinates...
	project.append(ToProjectCoordinates(pt,iop,pbp,rot))
	# Point is already Relative to the Internal Origin...
	relative.append(pt)
     
OUT = shared, project, relative
# ----------------------------------------

code_block_4 = CodeBlock { 1; }
getItemAtIndex_7 = List.GetItemAtIndex(list=python_script_2, index=code_block_4)
