# Dynamo graph TopoPointsToRevit_-JSv2.dyn (Dynamo 2.6.1.8786)
# packages: Clockwork for Dynamo 2.x 2.3.0

file_path = Filename("..\Documents\PointCloudExample\bangor.txt")
readText = FileSystem.ReadText(file=file_path)
python_script = Python(IN[0]=readText)
# ---------- python_script.python (32 lines) ----------
# Load the Python Standard and DesignScript Libraries
import sys
import clr
clr.AddReference('ProtoGeometry')
from Autodesk.DesignScript.Geometry import *

# The inputs to this node will be stored as a list in the IN variables.
dataEnteringNode = IN[0].split('\n')

x=[]
y=[]
z=[]


for row in dataEnteringNode:
	if len(row) > 0:
		

		points=row.strip().split(",")
		x.append(float(points[0])*1000)
		y.append(float(points[1])*1000)
		z.append(float(points[2])*1000)
		
	else:
		pass

	

# Place your code below this line

# Assign your output to the OUT variable.
OUT = x, y, z
# ----------------------------------------
code_block = CodeBlock { 0; }
getItemAtIndex = List.GetItemAtIndex(list=python_script, index=code_block)
projectPosition = Custom[Document.ProjectPosition]()  # package Clockwork for Dynamo 2.x
round = Math.Round(number=projectPosition.EastWest)
sub = getItemAtIndex - round  # lacing=Longest
code_block_2 = CodeBlock { 1; }
getItemAtIndex_2 = List.GetItemAtIndex(list=python_script, index=code_block_2)
watch = Watch(projectPosition.NorthSouth)
round_2 = Math.Round(number=watch)
sub_2 = getItemAtIndex_2 - round_2  # lacing=Longest
code_block_3 = CodeBlock { 2; }
getItemAtIndex_3 = List.GetItemAtIndex(list=python_script, index=code_block_3)
byCoordinates = Point.ByCoordinates(x=sub, y=sub_2, z=getItemAtIndex_3)
byPoints = Topography.ByPoints(points=byCoordinates)

# group: Change coordinates
# note: Index[0]- Shared Coordinates
# Index[1]- Project Coordinates
# Index[2]- Relative Coordinates
python_script_2 = Python()  # frozen; unwired: IN[0]
# ---------- python_script_2.python (81 lines) ----------
import clr
import math
clr.AddReference('ProtoGeometry')
from Autodesk.DesignScript import Geometry as geom
clr.AddReference("RevitServices")
import RevitServices 
from RevitServices.Persistence import DocumentManager
doc = DocumentManager.Instance.CurrentDBDocument
clr.AddReference("RevitNodes")
import Revit
clr.ImportExtensions(Revit.Elements)
clr.ImportExtensions(Revit.GeometryConversion)
clr.AddReference("RevitAPI")
from Autodesk.Revit.DB import *
 
# Create a list object from singleton...
def tolist(obj1):
	if hasattr(obj1,"__iter__"): return obj1
	else: return [obj1]
	
################# Definitions ###################
# Convert Point from Relative to Shared Coordinates...
def ToSharedCoordinates(pt,iop,pbp,rot):
	# First we need to translate the point by adding the Internal Origin to the Point we're converting...
	pt = geom.Point.ByCoordinates(pt.X+iop.X, pt.Y+iop.Y, pt.Z+iop.Z)
	# Then we need to rotate this point about the Internal Origin in the opposite direction as the Project Rotation...
	pt = geom.Geometry.Rotate(pt,iop,geom.Vector.ZAxis(),rot*-1)
	return pt

# Convert Point from Relative to Project Coordinates...
def ToProjectCoordinates(pt,iop,pbp,rot):
	# First we need to Rotate the Project Base Point about the Internal Origin Point by the Project Rotation...
	pbp = geom.Geometry.Rotate(pbp,iop,geom.Vector.ZAxis(),rot)
	# Then we need to Translate the point we're converting by subtracting the Project Base Point and then adding the Internal Origin Point...
	pt = geom.Point.ByCoordinates(pt.X-pbp.X+iop.X,pt.Y-pbp.Y+iop.Y,pt.Z-pbp.Z+iop.Z)
	return pt

################# Variables ###################
# Input Variables...
pts = tolist(IN[0])
 
# Internal Variables...
pbp = None
iop = None
rot = 0
# Conversion to mm...
ft2mm = 304.8
 
# Output Variables...
shared = []
project = []
relative = []

################# Main ###################
# Collect Project Basepoint...
basePt = FilteredElementCollector(doc).OfCategory(BuiltInCategory.OST_ProjectBasePoint).ToElements()
 
# Convert Project Basepoint (pbp) to DS Point...
for e in basePt:
	# Get Project Base Points Parameter Values...
	ew = e.get_Parameter(BuiltInParameter.BASEPOINT_EASTWEST_PARAM).AsDouble()*ft2mm
	ns = e.get_Parameter(BuiltInParameter.BASEPOINT_NORTHSOUTH_PARAM).AsDouble()*ft2mm
	ele = e.get_Parameter(BuiltInParameter.BASEPOINT_ELEVATION_PARAM).AsDouble()*ft2mm
	rot = e.get_Parameter(BuiltInParameter.BASEPOINT_ANGLETON_PARAM).AsDouble()*180/math.pi    
	# Create Point from Project Base Point Values...
	pbp = geom.Point.ByCoordinates(ew,ns,ele)

# Convert Internal Origin Point (iop) as DS Point...
projPos = doc.ActiveProjectLocation.GetProjectPosition (XYZ(0,0,0))
iop = geom.Point.ByCoordinates(projPos.EastWest*ft2mm,projPos.NorthSouth*ft2mm,0)
 
# Transform Input points to Shared/Project Coordinate System...
for pt in pts:
# Convert point to Shared Coordinates...
	shared.append(ToSharedCoordinates(pt,iop,pbp,rot))
	# Convert point to Project Coordinates...
	project.append(ToProjectCoordinates(pt,iop,pbp,rot))
	# Point is already Relative to the Internal Origin...
	relative.append(pt)
     
OUT = shared, project, relative
# ----------------------------------------

code_block_4 = CodeBlock { 1; }
getItemAtIndex_4 = List.GetItemAtIndex(list=python_script_2, index=code_block_4)
