# Dynamo graph TopoSplitGrid.dyn (Dynamo 2.3.0.5885)

select_model_element = DSModelElementSelection()  # 1 picked in the model
OLD = Python(IN[0]=select_model_element)  # frozen
# ---------- OLD.python (50 lines) ----------
# Load the Python Standard and DesignScript Libraries

import sys
import clr
clr.AddReference('RevitAPI')
from Autodesk.Revit.DB import *


clr.AddReference('RevitServices')
from RevitServices.Persistence import DocumentManager
from RevitServices.Transactions import TransactionManager

clr.AddReference('ProtoGeometry')
from Autodesk.DesignScript.Geometry import *

# The inputs to this node will be stored as a list in the IN variables.
Topo = UnwrapElement(IN[0])
doc = DocumentManager.Instance.CurrentDBDocument
#dataEnteringNode = IN

TopoPoints = Topo.GetPoints()
data=[]
	for x in TopoPoints:
		data.append(x)

xList=[]
yList=[]
zList=[]
for x in TopoPoints:
	y=(str(x)[1:-1].split(", "))
	xList.append(float(y[0]))
	yList.append(float(y[1]))
	zList.append(float(y[2]))
	
maxX = max(xList)
minX = min(xList)

maxY = max(yList)
minY = min(yList)

RangeX = abs(int((minX - maxX) / 10))
RangeY = abs(int((minY - maxY) / 10))
	





# Assign your output to the OUT variable.
OUT = data
# ----------------------------------------
grid_size_meters = DoubleSlider(3, range=1..100 step 1)
code_block = CodeBlock { 1000; }
mul = grid_size_meters * code_block
code_block_2 = CodeBlock { 304.8; }
div = mul / code_block_2
range_mm = DoubleSlider(400, range=100..1000 step 1)
div_2 = range_mm / code_block_2
python_script = Python(IN[0]=select_model_element, IN[1]=div, IN[2]=div_2)
# ---------- python_script.python (144 lines) ----------
# Load the Python Standard and DesignScript Libraries

import sys
import clr
clr.AddReference('RevitAPI')
from Autodesk.Revit.DB import *


clr.AddReference('RevitServices')
from RevitServices.Persistence import DocumentManager
from RevitServices.Transactions import TransactionManager

clr.AddReference('ProtoGeometry')
from Autodesk.DesignScript.Geometry import *

# The inputs to this node will be stored as a list in the IN variables.
Topo = UnwrapElement(IN[0])
gridSize = int(UnwrapElement(IN[1]))
rangeFix = int(UnwrapElement(IN[2]))
doc = DocumentManager.Instance.CurrentDBDocument
#dataEnteringNode = IN

TopoPoints = Topo.GetPoints()
data=[]

for x in TopoPoints:
	data.append([float(a) for a in (str(x)[1:-1].split(", "))])



x=[a[0] for a in data]
y=[a[1] for a in data]
z=[a[2] for a in data]

range1=[min(x), min(y), min(z)]
range2=[range1[0]+gridSize, range1[1]+gridSize]
done=False


count=0
fullgrid=[]
while not done:
    grid=[]
    for d in data:
        if d[0]>=range1[0] and d[0]<range2[0] and d[1]>=range1[1] and d[1]<range2[1]:
            grid.append(d)
            count+=1
    if grid:
        fullgrid.append(grid)
    range1[0]=range2[0]
    range2[0]=range2[0]+gridSize
    if range1[0]>max(x):
        range1[0]=min(x)
        range1[1]=range2[1]
        range2=[range1[0]+gridSize, range1[1]+gridSize]
    if range1[1]>max(y):
        done=True


OORValue=[] #Out of range value

def medianValue(a):
	n = len(a)
	index = n // 2
	
	if n % 2:
		return(sorted(a)[index])
	
	else:
		return(sum(sorted(a)[index - 1 :index + 1]) / 2)
		
def average(a):
	return(sum(a)/len(a))
	


#FeetToMm=304.8
	

#Trial

goodPoints = []
count=0
for count, x in enumerate(fullgrid):

	
	zValues =[]

			
	for z in x:
		zValues.append(z[2])
			
	highRange = medianValue(zValues) + rangeFix
	lowRange = medianValue(zValues) - rangeFix
			
	c=0
	for c, y in enumerate(zValues):
		if (highRange < y) or (lowRange > y):
		
			OORValue.append(fullgrid[count][c])
	
		else:
			goodPoints.append(fullgrid[count][c])


	

			
xPoint = []
yPoint = []
zPoint = []

for x in goodPoints:
	xPoint.append(x[0]*304.8)
	yPoint.append(x[1]*304.8)
	zPoint.append(x[2]*304.8)
	
bxPoint = []
byPoint = []
bzPoint = []

for x in OORValue:
	bxPoint.append(x[0]*304.8)
	byPoint.append(x[1]*304.8)
	bzPoint.append(x[2]*304.8)
	
	
	
"""
OORValueOutput=[]
for x in OORValue:
	OORValueOutput.append("(" + str(x[0]) + ", " + str(x[1]) + ", "+ str(x[2])+")")

	"""
	
		
		
	
		
	


# Assign your output to the OUT variable.
OUT =  xPoint, yPoint, zPoint, bxPoint, byPoint, bzPoint
# ----------------------------------------
code_block_3 = CodeBlock { 3; }
getItemAtIndex = List.GetItemAtIndex(list=python_script, index=code_block_3)  # frozen
python_script_2 = Python(IN[0]=select_model_element, IN[1]=getItemAtIndex)  # frozen
# ---------- python_script_2.python (82 lines) ----------
# Load the Python Standard and DesignScript Libraries

import sys
import clr
clr.AddReference('RevitAPI')
from Autodesk.Revit.DB import *
from Autodesk.Revit.DB.Architecture import *


clr.AddReference('RevitServices')
from RevitServices.Persistence import DocumentManager
from RevitServices.Transactions import TransactionManager

clr.AddReference('ProtoGeometry')
from Autodesk.DesignScript.Geometry import *

clr.AddReference('RevitNodes')
import Revit


# The inputs to this node will be stored as a list in the IN variables.
Topo = UnwrapElement(IN[0])
badPointsStr = UnwrapElement(IN[1])

doc = DocumentManager.Instance.CurrentDBDocument
uidoc = DocumentManager.Instance.CurrentUIApplication.ActiveUIDocument
uiapp = DocumentManager.Instance.CurrentUIApplication
app = uiapp.Application



TopoPoints = Topo.GetPoints()
badPoints=[]

for x in TopoPoints:
	for y in badPointsStr:
		if str(x) == y:
			badPoints.append(x)

		else:
			pass
			



"""
Revit.Transaction.Transaction.End(doc)

TransactionManager.Instance.EnsureInTransaction(doc)

#Trans = Transaction(doc)
#Trans.Start("MainTransaction")
#a = Trans.GetStatus()

TopEd=TopographyEditScope(doc, "TopoEdit")
TopEd.Start(Topo.Id)
	
Topo.DeletePoints(badPoints)
TopEd.Commit()
#Trans.Commit()

TransactionManager.Instance.TransactionTaskDone()
Revit.Transaction.Transaction.End(doc)
"""

Revit.Transaction.Transaction.End(doc)

TES=TopographyEditScope(doc, "Tran")
TES.Start(Topo.Id)
#TopoPoints = Topo.GetPoints()
Topo.DeletePoints(badPoints)

#TES.Commit()



		
	


# Assign your output to the OUT variable.
#OUT =  dir(TES)
# ----------------------------------------
watch = Watch()  # unwired: arg0

# group: Bad Points
code_block_4 = CodeBlock { 3; }
getItemAtIndex_2 = List.GetItemAtIndex(list=python_script, index=code_block_4)
code_block_5 = CodeBlock { 4; }
getItemAtIndex_3 = List.GetItemAtIndex(list=python_script, index=code_block_5)
code_block_6 = CodeBlock { 5; }
getItemAtIndex_4 = List.GetItemAtIndex(list=python_script, index=code_block_6)
byCoordinates = Point.ByCoordinates(x=getItemAtIndex_2, y=getItemAtIndex_3, z=getItemAtIndex_4)  # frozen

points = Topography.Points(topography=select_model_element)  # frozen
code_block_7 = CodeBlock { 0; }
getItemAtIndex_5 = List.GetItemAtIndex(list=python_script, index=code_block_7)
code_block_8 = CodeBlock { 1; }
getItemAtIndex_6 = List.GetItemAtIndex(list=python_script, index=code_block_8)
code_block_9 = CodeBlock { 2; }
getItemAtIndex_7 = List.GetItemAtIndex(list=python_script, index=code_block_9)
byCoordinates_2 = Point.ByCoordinates(x=getItemAtIndex_5, y=getItemAtIndex_6, z=getItemAtIndex_7)
byPoints = Topography.ByPoints(points=byCoordinates_2)
