# Dynamo graph TopoToFloor.dyn (Dynamo 2.3.1.11775)
# packages: Bakery 2018.4.301

select_model_element = DSModelElementSelection()  # 1 picked in the model
points = Topography.Points(topography=select_model_element)
select_model_element_2 = DSModelElementSelection()  # 1 picked in the model
shape_edit_floor_with_points = Custom[Shape Edit Floor With Points](points=points, floorElement=select_model_element_2)  # package Bakery
watch = Watch(shape_edit_floor_with_points)
