# Dynamo graph Topo_perimeter line.dyn (Dynamo 2.0.2.6826)

select_model_element = DSModelElementSelection()  # 1 picked in the model
mesh = Topography.Mesh(topography=select_model_element)
vertexPositions = Mesh.VertexPositions(mesh=mesh)
faceIndices = Mesh.FaceIndices(mesh=mesh)
code_block = CodeBlock(ind=faceIndices)
# ---------- code_block.designscript (3 lines) ----------
[ind.A,
ind.B,
ind.C];
# ----------------------------------------
getItemAtIndex = List.GetItemAtIndex(list=vertexPositions, index=code_block)
deconstructPoint = Geometry.Points.DeconstructPoint(point=getItemAtIndex)
code_block_2 = CodeBlock { 0.0; }
byCoordinates = Point.ByCoordinates(x=deconstructPoint.X, y=deconstructPoint.Y, z=code_block_2)
transpose = List.Transpose(lists=byCoordinates)
byPerimeterPoints = Surface.ByPerimeterPoints(points=transpose)
byJoinedSurfaces = PolySurface.ByJoinedSurfaces(surfaces=byPerimeterPoints)
perimeterCurves = Surface.PerimeterCurves(surface=byJoinedSurfaces)
views = Views(index=49)
fromCurve = Custom[DetailLine.FromCurve](curve=perimeterCurves, view=views)  # Creates a detail line based on a given curve
