# Dynamo graph TreePoints.dyn (Dynamo 2.12.0.5650)

file_path = Filename("C:\Users\krist\Documents\PointCloudExample\TREE - Cloud_reduced.txt")
readText = FileSystem.ReadText(file=file_path)
python_script = Python(IN[0]=readText)  # IronPython2
# ---------- python_script.python (32 lines) ----------
# Load the Python Standard and DesignScript Libraries
import sys
import clr
clr.AddReference('ProtoGeometry')
from Autodesk.DesignScript.Geometry import *

# The inputs to this node will be stored as a list in the IN variables.
dataEnteringNode = IN[0].split('\n')

x=[]
y=[]
z=[]


for row in dataEnteringNode:
	if len(row) > 0:
		

		points=row.strip().split(",")
		x.append(float(points[0]))
		y.append(float(points[1]))
		z.append(float(points[2]))
		
	else:
		pass

	

# Place your code below this line

# Assign your output to the OUT variable.
OUT = x, y, z
# ----------------------------------------
code_block = CodeBlock { 0; }
getItemAtIndex = List.GetItemAtIndex(list=python_script, index=code_block)
code_block_2 = CodeBlock { 1; }
getItemAtIndex_2 = List.GetItemAtIndex(list=python_script, index=code_block_2)
code_block_3 = CodeBlock { 2; }
getItemAtIndex_3 = List.GetItemAtIndex(list=python_script, index=code_block_3)
byCoordinates = Point.ByCoordinates(x=getItemAtIndex, y=getItemAtIndex_2, z=getItemAtIndex_3)
code_block_4 = CodeBlock { 10; }
byCenterPointRadius = Sphere.ByCenterPointRadius(centerPoint=byCoordinates, radius=code_block_4)
