# Dynamo graph UGS_BOXES.dyn "POINT2_Boxes" (Dynamo 2.3.1.11775)
# packages: Bakery 2018.4.301

select_model_element = DSModelElementSelection()  # 1 picked in the model
python_script = Python(IN[0]=select_model_element)
# ---------- python_script.python (31 lines) ----------
import clr
import sys
clr.AddReference('ProtoGeometry')
from Autodesk.DesignScript.Geometry import *
import Autodesk.DesignScript.Geometry as DS

clr.AddReference('RevitAPI')
import Autodesk
from Autodesk.Revit.DB import *
import Autodesk.Revit.DB as DB

clr.AddReference('RevitNodes')
import Revit
clr.ImportExtensions(Revit.GeometryConversion)
clr.ImportExtensions(Revit.Elements)


importinstance = UnwrapElement(IN[0])
out = []
opt = Options()
geoSet = importinstance.get_Geometry(opt)
for geo in geoSet:
	if isinstance(geo, GeometryInstance):
		for g in  geo.GetInstanceGeometry():
			if isinstance(g, Solid):
				for f in g.Faces:
					for loopCurve in f.GetEdgesAsCurveLoops():
						ds_polycurv = DS.PolyCurve.ByJoinedCurves(x.ToProtoType() for x in loopCurve)
						out.append(ds_polycurv)

OUT = out
# ----------------------------------------
byPatch = Surface.ByPatch(closedCurve=python_script)
code_block = CodeBlock { 0.5; }
normalAtParameter = Surface.NormalAtParameter(surface=byPatch, u=code_block, v=code_block)
asPoint = Vector.AsPoint(vector=normalAtParameter)
Z = Point.Z(point=asPoint)
to_int = Custom[To Int](listIn=Z)  # package Bakery
python_script_2 = Python(IN[0]=to_int, IN[1]=byPatch)
# ---------- python_script_2.python (24 lines) ----------
# Load the Python Standard and DesignScript Libraries
import sys
import clr
clr.AddReference('ProtoGeometry')
from Autodesk.DesignScript.Geometry import *

# The inputs to this node will be stored as a list in the IN variables.
Vectors = IN[0]
Surfaces =IN[1]

WallSurfaces=[]
TopSurfaces=[]
BottomSurfaces=[]
# Place your code below this line
for count, x in enumerate(Vectors):
	if x == 0:
		WallSurfaces.append(Surfaces[count])
	elif x == 1:
		TopSurfaces.append(Surfaces[count])
	elif x == -1:
		BottomSurfaces.append(Surfaces[count])

# Assign your output to the OUT variable.
OUT = WallSurfaces
# ----------------------------------------
code_block_2 = CodeBlock { 0; }
pointAtParameter = Surface.PointAtParameter(surface=python_script_2, u=code_block_2, v=code_block_2)
code_block_3 = CodeBlock { 1; }
pointAtParameter_2 = Surface.PointAtParameter(surface=python_script_2, u=code_block_2, v=code_block_3)
byStartPointEndPoint = Line.ByStartPointEndPoint(startPoint=pointAtParameter, endPoint=pointAtParameter_2)
pointAtParameter_3 = Surface.PointAtParameter(surface=python_script_2, u=code_block_3, v=code_block_3)
byStartPointEndPoint_2 = Line.ByStartPointEndPoint(startPoint=pointAtParameter_3, endPoint=pointAtParameter_2)
python_script_3 = Python(IN[0]=byStartPointEndPoint_2)
# ---------- python_script_3.python (17 lines) ----------
# Load the Python Standard and DesignScript Libraries
import sys
import clr
clr.AddReference('ProtoGeometry')
from Autodesk.DesignScript.Geometry import *

# The inputs to this node will be stored as a list in the IN variables.
dataEnteringNode = IN[0]

newList=[]
for x in dataEnteringNode:
	newList.append(x.Length)

# Place your code below this line

# Assign your output to the OUT variable.
OUT = newList
# ----------------------------------------
levels = Levels("POINT2-02-ZZ-M3-G-DATUM")
wall_types = WallTypes("POINT2_ExtWall_UndefinedW")
byCurveAndHeight = Wall.ByCurveAndHeight(curve=byStartPointEndPoint, height=python_script_3, level=levels, wallType=wall_types)
string = StringInput("Base Offset")
python_script_4 = Python(IN[0]=pointAtParameter_2)
# ---------- python_script_4.python (17 lines) ----------
# Load the Python Standard and DesignScript Libraries
import sys
import clr
clr.AddReference('ProtoGeometry')
from Autodesk.DesignScript.Geometry import *

# The inputs to this node will be stored as a list in the IN variables.
dataEnteringNode = IN[0]

newList=[]
for x in dataEnteringNode:
	newList.append(x.Z)

# Place your code below this line

# Assign your output to the OUT variable.
OUT = newList
# ----------------------------------------
setParameterByName = Element.SetParameterByName(element=byCurveAndHeight, parameterName=string, value=python_script_4)
