# Dynamo graph Using Dynamo nodes to python.dyn (Dynamo 2.0.2.6826)

family_types = FamilyTypes(index=33)
levels = Levels(index=2)
python_script = Python(IN[0]=family_types, IN[1]=levels)
# ---------- python_script.python (24 lines) ----------
# Enable Python support and load DesignScript library
import clr
clr.AddReference('ProtoGeometry')
from Autodesk.DesignScript.Geometry import *

clr.AddReference('RevitNodes')
#Import standart Dynamo Revit library
from Revit.Elements import *


# The inputs to this node will be stored as a list in the IN variables.
family = IN[0]
level = IN[1]

output = []
# Place your code below this line
for x in range(0, 5000, 1000):
	point = Point.ByCoordinates(x, x, 0)
	column = FamilyInstance.ByPointAndLevel(family, point, level)
	output.append(column)
	

# Assign your output to the OUT variable.
OUT = output
# ----------------------------------------
byPointAndLevel = FamilyInstance.ByPointAndLevel()  # unwired: familyType, point, level
