# Dynamo graph Using REVIT API.dyn (Dynamo 2.0.2.6826)

family_types = FamilyTypes(index=1)
python_script = Python(IN[0]=family_types)
# ---------- python_script.python (42 lines) ----------
# Enable Python support and load DesignScript library
import clr
clr.AddReference('ProtoGeometry')
from Autodesk.DesignScript.Geometry import *

#import Revit API
clr.AddReference('RevitAPI')
from Autodesk.Revit.DB import *

#import Manager Classes(this is for transactions)

clr.AddReference('RevitServices')
from RevitServices.Persistence import DocumentManager
from RevitServices.Transactions import TransactionManager

clr.AddReference('RevitNodes')
import Revit
clr.ImportExtensions(Revit.Elements)
clr.ImportExtensions(Revit.GeometryConversion)

# The inputs to this node will be stored as a list in the IN variables.
familytype = UnwrapElement(IN[0])
output =[]

# Place your code below this line
doc = DocumentManager.Instance.CurrentDBDocument

TransactionManager.Instance.EnsureInTransaction(doc)

for x in range(0, 5000, 500):
	x =UnitUtils.ConvertToInternalUnits(x, DisplayUnitType.DUT_MILLIMETERS)
	fam = doc.Create.NewFamilyInstance(XYZ(x, 0, 0), familytype, Structure.StructuralType.NonStructural)
	wrappedfam = fam.ToDSType(True) #wraps element so it's visible in Dynamo
	output.append(wrappedfam)
	
#End transaction

TransactionManager.Instance.TransactionTaskDone()
	

# Assign your output to the OUT variable.
OUT = output
# ----------------------------------------
