# Dynamo graph ViewsCreator.dyn (Dynamo 2.6.1.8786)
# packages: archi-lab.net 2020.23.13

# group: Element type View
view = ElementTypes("View")

all_elements_of_type = ElementsOfType(element_type=view)
isNull = Object.IsNull(obj=all_elements_of_type)
filterByBoolMask = List.FilterByBoolMask(list=all_elements_of_type, mask=isNull)
watch = Watch(filterByBoolMask.out)
python_script = Python(IN[0]=watch)
# ---------- python_script.python (37 lines) ----------
# Load the Python Standard and DesignScript Libraries
import sys
import clr
clr.AddReference('RevitAPI')
from Autodesk.Revit.DB import *


clr.AddReference('RevitServices')
from RevitServices.Persistence import DocumentManager
from RevitServices.Transactions import TransactionManager

clr.AddReference('ProtoGeometry')
from Autodesk.DesignScript.Geometry import *

# The inputs to this node will be stored as a list in the IN variables.

doc = DocumentManager.Instance.CurrentDBDocument
dataEnteringNode = UnwrapElement(IN[0])

# Place your code below this line
creatorList=[]
changedList=[]



for x in dataEnteringNode:
	creatorList.append(WorksharingUtils.GetWorksharingTooltipInfo(doc, x.Id).Creator.ToString())

for x in dataEnteringNode:
	changedList.append(WorksharingUtils.GetWorksharingTooltipInfo(doc, x.Id).LastChangedBy.ToString())
	




# Assign your output to the OUT variable.
OUT = creatorList, changedList
# ----------------------------------------
code_block = CodeBlock { 0; 1; }
last_edited_by = List.GetItemAtIndex(list=python_script, index=code_block.out1)
name = Family.Name(family=watch)
creator = List.GetItemAtIndex(list=python_script, index=code_block.out0)

# group: Freeze to reset the old View name
python_script_2 = Python(IN[0]=name, IN[1]=creator)
# ---------- python_script_2.python (17 lines) ----------
# Load the Python Standard and DesignScript Libraries
import sys
import clr
clr.AddReference('ProtoGeometry')
from Autodesk.DesignScript.Geometry import *

# The inputs to this node will be stored as a list in the IN variables.
View = IN[0]
User = IN[1]

# Place your code below this line
nameingList=[]
for count, x in enumerate(View):
	nameingList.append(x +"(Creator - " + User[count] +")")
	
# Assign your output to the OUT variable.
OUT = nameingList
# ----------------------------------------
setName = archilab.Revit.Views.Views.SetName(view=watch, name=python_script_2)

# group: UnFreeze to reset the old View name
python_script_old_name = Python(IN[0]=name)  # frozen
# ---------- python_script_old_name.python (15 lines) ----------
# Load the Python Standard and DesignScript Libraries
import sys
import clr
clr.AddReference('ProtoGeometry')
from Autodesk.DesignScript.Geometry import *

# The inputs to this node will be stored as a list in the IN variables.
renamedViews = IN[0]

newNameList=[]
# Place your code below this line
for x in renamedViews:
	newNameList.append(x.split("(Creator - ")[0])
# Assign your output to the OUT variable.
OUT = newNameList
# ----------------------------------------
setName_2 = archilab.Revit.Views.Views.SetName(view=watch, name=python_script_old_name)
