# Dynamo graph WINDOWSHAPEMAKERDEMO.dyn (Dynamo 2.3.0.5885)

select_model_element = DSModelElementSelection()  # 1 picked in the model
geometry = Element.Geometry(element=select_model_element)
code_block = CodeBlock { 2; }
getItemAtIndex = List.GetItemAtIndex(list=geometry, index=code_block)
python_script = Python(IN[0]=getItemAtIndex)
# ---------- python_script.python (13 lines) ----------
# Load the Python Standard and DesignScript Libraries
import sys
import clr
clr.AddReference('ProtoGeometry')
from Autodesk.DesignScript.Geometry import *

# The inputs to this node will be stored as a list in the IN variables.
dataEnteringNode = IN[0]

# Place your code below this line

# Assign your output to the OUT variable.
OUT = dir(dataEnteringNode)
# ----------------------------------------
byGeometry = BoundingBox.ByGeometry(geom=getItemAtIndex)  # frozen
toPolySurface = BoundingBox.ToPolySurface(boundingBox=byGeometry)

# group: Get element
area = Solid.Area(solid=geometry)
maximumItem = List.MaximumItem(list=area)

volume = Solid.Volume(solid=geometry)
maximumItem_2 = List.MaximumItem(list=volume)
sort = List.Sort(list=area)
watch = Watch(byGeometry)
toPolySurface_2 = BoundingBox.ToPolySurface(boundingBox=watch)
faces = Topology.Faces(topology=getItemAtIndex)
edges = Face.Edges(face=faces)
XY = Plane.XY()
centroid = Solid.Centroid(solid=getItemAtIndex)
XZ = Plane.XZ()
XAxis = Plane.XAxis(plane=XZ)
code_block_2 = CodeBlock { 30; }
rotate = Geometry.Rotate(geometry=getItemAtIndex, origin=centroid, axis=XAxis, degrees=code_block_2)
byGeometry_2 = BoundingBox.ByGeometry(geom=rotate)  # frozen
watch_2 = Watch(byGeometry_2)
toPolySurface_3 = BoundingBox.ToPolySurface(boundingBox=watch_2)
toPolySurface_4 = BoundingBox.ToPolySurface(boundingBox=byGeometry_2)
code_block_3 = CodeBlock { 300; }
