# Dynamo graph WallChangeTopConstraint.dyn (Dynamo 2.0.2.6826)

levels = Levels(index=4)
all_elements_at_level = ElementsAtLevel(Level=levels)
string_from_object = FromObject(obj=all_elements_at_level)
string = StringInput("Wall")
eq = string_from_object == string
filterByBoolMask = List.FilterByBoolMask(list=all_elements_at_level, mask=eq)
watch = Watch(filterByBoolMask.in)
string_2 = StringInput("Top Constraint")
parameterByName = Parameter.ParameterByName(element=watch, name=string_2)
levels_2 = Levels(index=6)
setValue = Parameter.SetValue(parameter=parameterByName, value=levels_2)
code_block = CodeBlock { 1; }
getItemAtIndex = List.GetItemAtIndex(list=watch, index=code_block)
parameters = Element.Parameters(element=getItemAtIndex)
string_from_object_2 = FromObject(obj=levels_2)
watch_2 = Watch()  # unwired: arg0
