# Dynamo graph WallLevelChange.dyn (Dynamo 2.3.1.11775)

# group: Walls
select_model_elements = DSModelElementsSelection()  # 18 picked in the model; frozen
string = StringInput("Base Constraint")
getParameterValueByName = Element.GetParameterValueByName(element=select_model_elements, parameterName=string)
name = Level.Name(level=getParameterValueByName)
string_2 = StringInput("Base Offset")
elevation = Level.Elevation(level=getParameterValueByName)
levels = Levels("POINT2-04-B1-M3-G")
elevation_2 = Level.Elevation(level=levels)
sub = elevation - elevation_2
getParameterValueByName_2 = Element.GetParameterValueByName(element=select_model_elements, parameterName=string_2)
add = sub + getParameterValueByName_2
setParameterByName = Element.SetParameterByName(element=select_model_elements, parameterName=string_2, value=add)
setParameterByName_2 = Element.SetParameterByName(element=select_model_elements, parameterName=string, value=levels)

# group: Windows/Doors
select_model_elements_2 = DSModelElementsSelection()  # 11 picked in the model
string_3 = StringInput("Level")
getParameterValueByName_3 = Element.GetParameterValueByName(element=select_model_elements_2, parameterName=string_3)
name_2 = Level.Name(level=getParameterValueByName_3)
string_4 = StringInput("Sill Height")
elevation_3 = Level.Elevation(level=getParameterValueByName_3)
levels_2 = Levels("POINT2-03-B1-M3-G")
elevation_4 = Level.Elevation(level=levels_2)
sub_2 = elevation_3 - elevation_4
getParameterValueByName_4 = Element.GetParameterValueByName(element=select_model_elements_2, parameterName=string_4)
add_2 = sub_2 + getParameterValueByName_4
setParameterByName_3 = Element.SetParameterByName(element=select_model_elements_2, parameterName=string_4, value=add_2)
setParameterByName_4 = Element.SetParameterByName(element=select_model_elements_2, parameterName=string_3, value=levels_2)
