# Dynamo graph WallParametersByType.dyn (Dynamo 2.3.1.11775)
# packages: Clockwork for Dynamo 2.x 2.3.0, archi-lab.net 2020.22.9

categories = Categories("OST_Doors")
string = StringInput("Concrete - Rectangular Beam")  # frozen
byName = Family.ByName(name=string)
types = Family.Types(family=byName)
string_2 = StringInput("b")
getParameterValueByName = Element.GetParameterValueByName(element=types, parameterName=string_2)  # frozen
string_3 = StringInput("h")
getParameterValueByName_2 = Element.GetParameterValueByName(element=types, parameterName=string_3)
python_script = Python(IN[0]=getParameterValueByName, IN[1]=getParameterValueByName_2)
# ---------- python_script.python (17 lines) ----------
# Enable Python support and load DesignScript library
import clr
clr.AddReference('ProtoGeometry')
from Autodesk.DesignScript.Geometry import *

# The inputs to this node will be stored as a list in the IN variables.
B = IN[0]
H = IN[1]

# Place your code below this line
nameList=[]
for count, each in enumerate(B):
	nameList.append("B" + str(int(each)) +"x" + "H" + str(int(H[count])))
#"B" + str(B[]) + " H" + str(Thickness)
#namestr = ("B" +str(Offset) + " H" + str(Thickness))
# Assign your output to the OUT variable.
OUT = nameList
# ----------------------------------------
setName = Custom[Element.SetName](element=types, name=python_script)  # package Clockwork for Dynamo 2.x; Gets the name of a given Revit element
watch = Watch(setName.element)
categories_2 = Categories("OST_Walls")
all_elements_of_category = ElementsOfCategory(Category=categories_2)
type = archilab.Revit.Elements.Elements.Type(element=all_elements_of_category)
uniqueItems = List.UniqueItems(list=type)
string_4 = StringInput("Width")
getParameterValueByName_3 = Element.GetParameterValueByName(element=uniqueItems, parameterName=string_4)
string_5 = StringInput("")
eq = getParameterValueByName_3 == string_5
filterByBoolMask = List.FilterByBoolMask(list=uniqueItems, mask=eq)
watch_2 = Watch(filterByBoolMask.out)
string_6 = StringInput("Model")
string_7 = StringInput("Width")
getParameterValueByName_4 = Element.GetParameterValueByName(element=watch_2, parameterName=string_7)
string_8 = StringInput("Function")
# note: 0==INT
# 1==EXT
getParameterValueByName_5 = Element.GetParameterValueByName(element=watch_2, parameterName=string_8)
string_9 = StringInput("UndefinedThickness")
# note: 1==Undefined
getParameterValueByName_6 = Element.GetParameterValueByName(element=watch_2, parameterName=string_9)
python_script_2 = Python(IN[0]=getParameterValueByName_4, IN[1]=getParameterValueByName_5, IN[2]=getParameterValueByName_6)
# ---------- python_script_2.python (44 lines) ----------
# Load the Python Standard and DesignScript Libraries
import sys
import clr
clr.AddReference('ProtoGeometry')
from Autodesk.DesignScript.Geometry import *

# The inputs to this node will be stored as a list in the IN variables.
P0 = IN[0]#Width
P1 = IN[1]#Fuction
P2 = IN[2]#UndefinedThickness

# Place your code below this line

modelList=[]
typeComList=[] #also typecomments
#descList=[]

for count, x in enumerate(P2):
	if x == 1 and P1[count] == 0:
		modelList.append("Internal Undefined Thickness Wall")
		typeComList.append("Existing Undefined Thickness Internal Wall")
	elif x == 1 and P1[count] == 1:
		modelList.append("External Undefined Thickness Wall")
		typeComList.append("Existing Undefined Thickness External Wall")
	elif x =="" and P1[count] == 0:
		modelList.append("Internal " + str(int(P0[count])) +"mm Wide Wall")
		typeComList.append("Existing "+ str(int(P0[count])) +"mm Internal Wall")
	elif x =="" and P1[count] == 1:
		modelList.append("External " + str(int(P0[count])) +"mm Wide Wall")
		typeComList.append("Existing "+ str(int(P0[count])) +"mm External Wall")
	else:
		pass
		




#MODEL - External 200mm Wide Wall
#TYPE COMMENTS - Existing 200mm Wide External Wall
#DESCRIPTION - Existing 200mm Wide External Wall
#

# Assign your output to the OUT variable.
OUT = modelList, typeComList
# ----------------------------------------
code_block = CodeBlock { 0; }
getItemAtIndex = List.GetItemAtIndex(list=python_script_2, index=code_block)
setParameterByName = Element.SetParameterByName(element=watch_2, parameterName=string_6, value=getItemAtIndex)
watch_3 = Watch(setParameterByName)
string_10 = StringInput("Type Comments")
code_block_2 = CodeBlock { 1; }
getItemAtIndex_2 = List.GetItemAtIndex(list=python_script_2, index=code_block_2)
setParameterByName_2 = Element.SetParameterByName(element=watch_2, parameterName=string_10, value=getItemAtIndex_2)
watch_4 = Watch(setParameterByName_2)
string_11 = StringInput("Description")
setParameterByName_3 = Element.SetParameterByName(element=watch_2, parameterName=string_11, value=getItemAtIndex_2)
watch_5 = Watch(setParameterByName_3)
