# Dynamo graph WallWidthCheck.dyn (Dynamo 2.3.0.5885)
# packages: archi-lab.net 2020.22.9

type = archilab.Revit.Elements.Elements.Type()  # unwired: element
categories = Categories("OST_Walls")
all_elements_of_category = ElementsOfCategory(Category=categories)
type_2 = archilab.Revit.Elements.Elements.Type(element=all_elements_of_category)
parameters = Element.Parameters(element=type_2)
string = StringInput("Width")
getParameterValueByName = Element.GetParameterValueByName(element=type_2, parameterName=string)
python_script = Python(IN[0]=all_elements_of_category, IN[1]=getParameterValueByName)
# ---------- python_script.python (41 lines) ----------
# Load the Python Standard and DesignScript Libraries
import sys
import clr
clr.AddReference('ProtoGeometry')
from Autodesk.DesignScript.Geometry import *

# The inputs to this node will be stored as a list in the IN variables.
dataEnteringNode = UnwrapElement(IN[0])
dataEnteringNode2 = UnwrapElement(IN[1])

wallTypes=[]
badList=[]


for x in dataEnteringNode:
	wallTypes.append(x.Name.split('_')[-1][0:-1])
	
	
for x in dataEnteringNode2:
	badList.append(type(x))
count=0	
"""
for x in dataEnteringNode2:
	if x == None :
		badList.append(count)
		count +=1
		
	elif x == wallTypes[count]:
		count += 1
	else:
		count +=1
		
"""	
	
	
	
	
# Place your code below this line

# Assign your output to the OUT variable.
OUT = wallTypes
# ----------------------------------------
string_from_object = FromObject(obj=python_script)
string_from_object_2 = FromObject(obj=getParameterValueByName)
toNumber = String.ToNumber(str=python_script)
eq = toNumber == getParameterValueByName
filterByBoolMask = List.FilterByBoolMask(list=all_elements_of_category, mask=eq)
watch = Watch(filterByBoolMask.in)
watch_2 = Watch(filterByBoolMask.out)
