# Dynamo graph Warning_Fixer.dyn (Dynamo 2.0.2.6826)

all_warnings_of_type = WarningsOfType()  # nothing selected
failingElements = Bang.Revit.Elements.Warning.FailingElements(warning=all_warnings_of_type)
flatten = List.Flatten(list=failingElements)
code_block = CodeBlock { 2; }
dropEveryNthItem = List.DropEveryNthItem(list=flatten, n=code_block)
code_block_2 = CodeBlock { 2; }
takeEveryNthItem = List.TakeEveryNthItem(list=flatten, n=code_block_2)

# group: Unfreeze to join Elements
joinGeometry = Custom[Element.JoinGeometry](element1=dropEveryNthItem, element2=takeEveryNthItem)  # frozen; Joins two model elements (if possible). Only works inside the project environment.

# group: Unfreeze to UNjoin Elements
ꟿ_element_unjoin = Custom[ꟿ Element.Unjoin](firstElement=dropEveryNthItem, secondElement=takeEveryNthItem)  # frozen; Unjoins the element(s) in the second list from the primary input element.

# group: Unfreeze to Isolate warnings
views = Views(index=6)
isolate_in_view = Custom[Isolate in View](Element=flatten, View=views)  # frozen; This node will take input of elements and a view to isolate selected elements in a view.

# group: Delete duplicates
python_script = Python(IN[0]=failingElements)  # frozen
# ---------- python_script.python (15 lines) ----------
# Enable Python support and load DesignScript library
import clr
clr.AddReference('ProtoGeometry')
from Autodesk.DesignScript.Geometry import *

# The inputs to this node will be stored as a list in the IN variables.
elList = IN[0]
elList2 = []
# Place your code below this line

for  x in elList:
	elList2.append(x[1])

# Assign your output to the OUT variable.
OUT = elList2
# ----------------------------------------
delete = archilab.Revit.Elements.Elements.Delete(element=python_script)

watch = Watch(delete)

# group: Type Mark change for category
categories = Categories(index=159)  # frozen
all_elements_of_category = ElementsOfCategory(Category=categories)
string = StringInput("Mark")
python_script_2 = Python(IN[0]=all_elements_of_category)
# ---------- python_script_2.python (20 lines) ----------
# Enable Python support and load DesignScript library
import clr
clr.AddReference('ProtoGeometry')
from Autodesk.DesignScript.Geometry import *

# The inputs to this node will be stored as a list in the IN variables.
dataEnteringNode = UnwrapElement(IN[0])
newTypeM=[]

count=0


for y in range(len(dataEnteringNode)):
	newTypeM.append(str(count))
	count=count+1
	
# Place your code below this line

# Assign your output to the OUT variable.
OUT = newTypeM
# ----------------------------------------
setParameterByName = Element.SetParameterByName(element=all_elements_of_category, parameterName=string, value=python_script_2)
parameterByName = Parameter.ParameterByName(element=setParameterByName, name=string)
parameters = Element.Parameters(element=all_elements_of_category)
type = archilab.Revit.Elements.Elements.Type(element=flatten)
