# Dynamo graph Warning_Fixer_RVT2020.dyn (Dynamo 2.3.0.5885)
# packages: Bang! 2019.3.1, Clockwork for Dynamo 2.x 2.1.2, spring nodes 203.1.0, archi-lab.net 2020.22.9

# group: Unfreeze to UNjoin Elements
ꟿ_element_unjoin = Custom[ꟿ Element.Unjoin]()  # package spring nodes; unwired: firstElement, secondElement

all_warnings_of_type = WarningsOfType("Highlighted walls overlap. One of them may be.....")
failingElements = Bang.Revit.Elements.Warning.FailingElements(warning=all_warnings_of_type)
flatten = List.Flatten(list=failingElements)

# group: Unfreeze to Isolate warnings
views = Views("{3D - kristaps.rusis} Copy 1")
isolate_in_view = Custom[Isolate in View](element=flatten, view=views)  # package archi-lab.net; This node will take input of elements and a view to isolate selected elements in a view.

code_block = CodeBlock { 2; }
dropEveryNthItem = List.DropEveryNthItem(list=flatten, n=code_block)
code_block_2 = CodeBlock { 2; }
takeEveryNthItem = List.TakeEveryNthItem(list=flatten, n=code_block_2)

# group: Unfreeze to join Elements
joinGeometry = Custom[Element.JoinGeometry](element1=dropEveryNthItem, element2=takeEveryNthItem)  # frozen; package Clockwork for Dynamo 2.x; Joins two model elements (if possible). Only works inside the project environment.

watch = Watch(joinGeometry.success)
ꟿ_element_unjoin_2 = Custom[ꟿ Element.Unjoin](firstElement=dropEveryNthItem, secondElement=takeEveryNthItem)  # frozen
watch_2 = Watch(ꟿ_element_unjoin_2)
