# Dynamo graph WatchViews.dyn (Dynamo 2.0.2.6826)

select_model_element = DSModelElementSelection()  # 1 picked in the model
id = Element.Id(element=select_model_element)
integer_slider = IntegerSlider(3, range=0..100 step 1)
add = id + integer_slider
byElementId = archilab.Revit.Selection.Select.ByElementId(id=add)
getCategory = Element.GetCategory(element=byElementId)
getCategory_2 = Element.GetCategory(element=select_model_element)
categories = Categories(index=602)
all_elements_of_category = ElementsOfCategory(Category=categories)
watch = Watch(all_elements_of_category)
integer_slider_2 = IntegerSlider(16, range=0..100 step 1)
getItemAtIndex = List.GetItemAtIndex(list=watch, index=integer_slider_2)
watch_2 = Watch(getItemAtIndex)
getLocation = Element.GetLocation(element=watch_2)
ꟿ_collect_elementsketch = Custom[ꟿ Collect.ElementSketch](element=watch_2)  # Get the actual sketch lines of a sketch based element (floor, ceiling, modified wall, etc.) . You can optionally fetch the matching model curves, however this might prove comptationally heavy on larger data sets. Does not work with elements from linked files.
watch_3 = Watch(ꟿ_collect_elementsketch.curves)
watch_4 = Watch(ꟿ_collect_elementsketch.model_curves)
elementPlaneReference = SketchPlane.ElementPlaneReference(sketchPlane=watch_2)
direction = Custom[View.Direction](view=watch_2)  # Returns the direction of a view
watch_5 = Watch(direction)
plane = Custom[View.Plane]()  # Retrieves the plane of a given view; unwired: view
