# Dynamo graph WhoDidWhat.dyn (Dynamo 2.3.1.11775)
# packages: archi-lab.net 2020.22.9

all_elements_in_active_view = ElementsInView()
getWorksharingTooltipInfo = archilab.Revit.Elements.Elements.GetWorksharingTooltipInfo(element=all_elements_in_active_view)
watch = Watch(getWorksharingTooltipInfo.Creator)
uniqueItems = List.UniqueItems(list=watch)
code_block = CodeBlock { 3; }
getItemAtIndex = List.GetItemAtIndex(list=uniqueItems, index=code_block)
string_from_object = FromObject(obj=getItemAtIndex)
indexOf = List.IndexOf(list=watch, element=string_from_object)
id = Element.Id(element=all_elements_in_active_view)
allIndicesOf = List.AllIndicesOf(list=watch, item=string_from_object)
getItemAtIndex_2 = List.GetItemAtIndex(list=id, index=allIndicesOf)
byElementId = archilab.Revit.Selection.Select.ByElementId(id=getItemAtIndex_2)
views = Views("Architectural Elevation")
isVisible = archilab.Revit.Elements.Elements.IsVisible(element=byElementId, view=views)
filterByBoolMask = List.FilterByBoolMask(list=byElementId, mask=isVisible)
isolate_in_view = Custom[Isolate in View](element=filterByBoolMask.in, view=views)  # package archi-lab.net; This node will take input of elements and a view to isolate selected elements in a view.
count = List.Count(list=filterByBoolMask.in)
