# Dynamo graph WoksetChangeElement.dyn (Dynamo 2.3.0.5885)
# packages: archi-lab.net 2020.22.9, Clockwork for Dynamo 2.x 2.1.2

code_block = CodeBlock { "Workset"; }
worksets = WorksetUi("POINT2_INTERNALS")
id = archilab.Revit.Elements.Workset.Id(workset=worksets)
watch = Watch(id)
setWorkset = Custom[Element.SetWorkset](workset=worksets)  # frozen; package Clockwork for Dynamo 2.x; Sets the workset of a given element; unwired: element
watch_2 = Watch(setWorkset.elements)
watch_3 = Watch(setWorkset.success)
uniqueItems = List.UniqueItems(list=watch_3)
all_elements_in_active_view = ElementsInView()
getCategory = Element.GetCategory(element=all_elements_in_active_view)
uniqueItems_2 = List.UniqueItems(list=getCategory)
code_block_2 = CodeBlock { 3; }
getItemAtIndex = List.GetItemAtIndex(list=uniqueItems_2, index=code_block_2)
eq = getCategory == getItemAtIndex
filterByBoolMask = List.FilterByBoolMask(list=all_elements_in_active_view, mask=eq)
watch_4 = Watch(filterByBoolMask.in)
