# Dynamo graph disallow_join_beams.dyn (Dynamo 2.0.2.6826)

select_model_elements = DSModelElementsSelection()  # 171 picked in the model
python_script = Python(IN[0]=select_model_elements)
# ---------- python_script.python (30 lines) ----------
import clr

clr.AddReference('RevitAPI')
from Autodesk.Revit.DB import *
from Autodesk.Revit.DB.Structure import *

clr.AddReference('RevitNodes')
import Revit
clr.ImportExtensions(Revit.GeometryConversion)
clr.ImportExtensions(Revit.Elements)

clr.AddReference('RevitServices')
import RevitServices
from RevitServices.Persistence import DocumentManager
from RevitServices.Transactions import TransactionManager

doc = DocumentManager.Instance.CurrentDBDocument
uidoc=DocumentManager.Instance.CurrentUIApplication.ActiveUIDocument

#Unwrapping Dynamoelement to Revit element.
beams = UnwrapElement(IN[0])

#Do some action in a Transaction
TransactionManager.Instance.EnsureInTransaction(doc)
for beam in beams:
	StructuralFramingUtils.DisallowJoinAtEnd(beam,0)
	StructuralFramingUtils.DisallowJoinAtEnd(beam,1)
TransactionManager.Instance.TransactionTaskDone()

OUT = 0
# ----------------------------------------
