# Dynamo graph floor to topo.dyn (Dynamo 2.0.2.6826)

select_model_element = DSModelElementSelection()  # 1 picked in the model
points = Floor.Points(floor=select_model_element)
byPoints = Topography.ByPoints(points=points)
