# Dynamo graph sectionM.dyn (Dynamo 2.0.2.6826)

select_model_element = DSModelElementSelection()  # 1 picked in the model
python_script = Python(IN[0]=select_model_element)
# ---------- python_script.python (13 lines) ----------
# Enable Python support and load DesignScript library
import clr
clr.AddReference('ProtoGeometry')
from Autodesk.DesignScript.Geometry import *

# The inputs to this node will be stored as a list in the IN variables.
dataEnteringNode = UnwrapElement(IN[0])


# Place your code below this line

# Assign your output to the OUT variable.
OUT = 0
# ----------------------------------------
